# Grasshopper definition 161104_CityMatrix_HCU_Health.gh (Grasshopper 0.9.76)
# plug-ins: Firefly.X, HDTReference

# ---- group: mesh coloring
mesh = Mesh(<mesh referenced from the Rhino model>)
res_color = ColourSwatch(SwatchColor=RGB(251, 255, 122))
sidewalk = ColourSwatch(SwatchColor=RGB(107, 107, 107))
res_gray = ColourSwatch(SwatchColor=RGB(227, 227, 227))
bikelane = ColourSwatch(SwatchColor=RGB(86, 135, 87))
off_gray = ColourSwatch(SwatchColor=RGB(171, 171, 171))
offcolor = ColourSwatch(SwatchColor=RGB(255, 122, 122))
parking = ColourSwatch(SwatchColor=RGB(196, 156, 100))
blank = ColourSwatch(SwatchColor=RGB(110, 110, 110))
road = ColourSwatch(SwatchColor=RGB(64, 64, 64))
park = ColourSwatch(SwatchColor=RGB(165, 201, 44))
# Building Type Mesh
text = ColourSwatch(SwatchColor=RGB(0, 0, 0))
res_warm = ColourSwatch(SwatchColor=RGB(255, 251, 230))
text_new = ColourSwatch(SwatchColor=RGB(64, 64, 64))
off_cold = ColourSwatch(SwatchColor=RGB(230, 242, 255))
mcol = MeshColours(Mesh=mesh, Colours=blank)
mesh_2 = Mesh(mcol)

# ---- group: Int Grid X Extent Intervention
number_slider = Slider(20, range=1..44)

# ---- group: Int Grid X Shift
number_slider_2 = Slider(6, range=1..44)

# ---- group: Int Grid Y Shift
number_slider_3 = Slider(23, range=1..44)

# ---- group: Int Grid Y Extent Intervention
number_slider_4 = Slider(20, range=1..44)

# ---- group: Int Grid X Extent
number_slider_5 = Slider(44, range=1..44)

# ---- group: Int Grid Y Extent
number_slider_6 = Slider(44, range=1..44)

# ---- group: module meshes lego ref: 0 to 5
# Reference in the Building or Road
# geometry from Rhino. They will be
# instantiated/copied to the cell position
# where it has the same Type ID.
# 
# To simplify the data tree. The reference
# geometry should be single Mesh. You
# can paint different mesh with the set-up
# on the right, and join them together.
mesh_3 = Mesh([<mesh referenced from the Rhino model> x15])

# ---- group: module meshes lego ref: -1
mesh_4 = Mesh(<mesh referenced from the Rhino model>)

# ----
# CityMatrix CV
path = FilePath("C:\Users\RYAN\Dropbox (MIT)\01_Work\MAS\06_Fall 2016\CityMatrix\01_Software\RH_GH\Map\CityMatrix_ML_Cam.PNG")
# Everthing below this line is only for CityMatrix
# CV. You don't need to care about them unless
# you want to use the CityMatrix Table. Let me
# know if you need to use them. I will calibrate it
# for you. <ryanz@mit.edu>
load_bitmap = LoadBitmap(FilePathToImageLocation=path)

# ---- group: all color code quarts (no rotation)
panel = Panel("2,0,0,0\t2,1,0,0\t2,0,1,0\t2,0,0,1\t2,1,1,0\t2,1,0,1\t2,0,1,1\t2,1,1,1\t3,0,0,0\t3,1,0,0\t3,0,1,0\t3,0,0,1\t3,1,1,0\t3,1,0,1\t3,0,1,1\t3,1,1,1\t4,0,0,0\t4,1,0,0\t4,0,1,0\t4,0,0,1\t4,1,1,0\t4,1,0,1\t4,0,1,1\t4,1,1,1\t5,0,0,0\t5,1,0,0\t5,0,1,0\t5,0,0,1\t5,1,1,0\t5,1,0,1\t5,0,1,1\t5,1,1,1")

# ---- group: Pts Sample Grid Corner
pt = Point([<point referenced from the Rhino model> x4])

# ----
video_stream = WebCamVideoStream()  # disabled
pline = PolyLine(Vertices=pt, Closed=False)

# ---- group: Sample White
# You need firefly plugin for this. It streams
# the Webcam footage from the CityMatrix
# Table. (It is now disabled and we are now
# using the text data fomat. )
# 
# Ideal setting (right click):
# 100ms
# 480px x 360px
# Reference Color
pt_2 = Point(<point referenced from the Rhino model>)

# ---- group: Sample Black
pt_3 = Point(<point referenced from the Rhino model>)

# ---- group: Sample Red
pt_4 = Point(<point referenced from the Rhino model>)

# ---- group: Sample Yellow
pt_5 = Point(<point referenced from the Rhino model>)

# ---- group: Sample Blue
pt_6 = Point(<point referenced from the Rhino model>)  # disabled

# ---- group: Sample Green
# Grid Sampling
pt_7 = Point(<point referenced from the Rhino model>)  # disabled

# ----
preview = CustomPreview(Geometry=pline, Shader=ColourSwatch(SwatchColor=RGB(255, 0, 230)))

# ---- group: gridExtent_y_i
int = Integer(number_slider_4)

# ---- group: gridExtent_y_s
# Decode Piece ID
int_2 = Integer(number_slider_3)

# ---- group: gridExtent_x_s
int_3 = Integer(number_slider_2)

# ---- group: gridExtent_x_i
int_4 = Integer(number_slider)

# ---- group: gridExtent_y
int_5 = Integer(number_slider_6)

# ---- group: gridExtent_x
int_6 = Integer(number_slider_5)

# ---- group: all color code quarts (with rotation)
panel_2 = Panel("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")

# ----
multiplication = Multiplication(A=int, B=2)
multiplication_2 = Multiplication(A=int_4, B=2)
crv = Curve(<curve referenced from the Rhino model>)  # disabled
crv_2 = Curve(<curve referenced from the Rhino model>)
crv_3 = Curve(<curve referenced from the Rhino model>)  # disabled
crv_4 = Curve(<curve referenced from the Rhino model>)
crv_5 = Curve(<curve referenced from the Rhino model>)
crv_6 = Curve(<curve referenced from the Rhino model>)
boundary = BoundarySurfaces(Edges=crv)  # disabled
boundary_2 = BoundarySurfaces(Edges=crv_3)  # disabled
boundary_3 = BoundarySurfaces(Edges=crv_2)
boundary_4 = BoundarySurfaces(Edges=crv_4)
boundary_5 = BoundarySurfaces(Edges=crv_6)
boundary_6 = BoundarySurfaces(Edges=crv_5)
replacingitemid = ReplacingItemID(int_4=int_4, int=int, int_6=int_6, int_5=int_5, int_3=int_3, int_2=int_2)
perspective = Perspective(pt=pt, int_2=multiplication_2, int=multiplication)

# ---- group: webcam stream
# You can feed a screen shot of the camera
# stream into the "webcam stream", when
# you don't have a CityMatrix table near
# you.
data = Data(load_bitmap)

# ---- group: tab
panel_3 = Panel("\t")

# ----
split = TextSplit(Text=panel_2, Separators=panel_3)
mesh_5 = MeshBrep(
    Brep=boundary,
    Settings={GridMaxCount=0, GridMinCount=16, JaggedSeams=False, MaxEdgeLength=0, MinEdgeLength=0.0001, MinTolerance=0, Refine=True, RefineAngle=0, RelativeTolerance=0.65, SimplePlanes=True, Tolerance=0})  # disabled
mesh_6 = MeshBrep(
    Brep=boundary_2,
    Settings={GridMaxCount=0, GridMinCount=16, JaggedSeams=False, MaxEdgeLength=0, MinEdgeLength=0.0001, MinTolerance=0, Refine=True, RefineAngle=0, RelativeTolerance=0.65, SimplePlanes=True, Tolerance=0})  # disabled
mesh_7 = MeshBrep(
    Brep=boundary_3,
    Settings={GridMaxCount=0, GridMinCount=16, JaggedSeams=False, MaxEdgeLength=0, MinEdgeLength=0.0001, MinTolerance=0, Refine=True, RefineAngle=0, RelativeTolerance=0.65, SimplePlanes=True, Tolerance=0})
mesh_8 = MeshBrep(
    Brep=boundary_4,
    Settings={GridMaxCount=0, GridMinCount=16, JaggedSeams=False, MaxEdgeLength=0, MinEdgeLength=0.0001, MinTolerance=0, Refine=True, RefineAngle=0, RelativeTolerance=0.65, SimplePlanes=True, Tolerance=0})
mesh_9 = MeshBrep(
    Brep=boundary_5,
    Settings={GridMaxCount=0, GridMinCount=16, JaggedSeams=False, MaxEdgeLength=0, MinEdgeLength=0.0001, MinTolerance=0, Refine=True, RefineAngle=0, RelativeTolerance=0.65, SimplePlanes=True, Tolerance=0})
mesh_10 = MeshBrep(
    Brep=boundary_6,
    Settings={GridMaxCount=0, GridMinCount=16, JaggedSeams=False, MaxEdgeLength=0, MinEdgeLength=0.0001, MinTolerance=0, Refine=True, RefineAngle=0, RelativeTolerance=0.65, SimplePlanes=True, Tolerance=0})

# ---- group: replacing item ID
int_7 = Integer(replacingitemid)

# ---- group: CityMatrix CV Calibration
mesh_11 = MeshFromImage(Bmp=data, Sx=Domain(0, 1), Sy=Domain(0, 1), Z=0, C=True)

# ---- group: all color quarts data
txt = Text(split)

# ----
lng = ListLength(List=txt)

# ---- group: webcam stream
bmp = BitmapToModify(data)

# ----
sample = BitmapSampler(BitmapToModify=bmp, PointToSample=pt_6, BitmapToModify_2=bmp, PointToSample_2=pt_6, bitmap_filter=0)  # -> SampledImageData, SampledImageData_2; disabled
sample_2 = BitmapSampler(BitmapToModify=bmp, PointToSample=pt_7, BitmapToModify_2=bmp, PointToSample_2=pt_7, bitmap_filter=0)  # -> SampledImageData, SampledImageData_2; disabled
sample_3 = BitmapSampler(BitmapToModify=bmp, PointToSample=pt_5, BitmapToModify_2=bmp, PointToSample_2=pt_5, bitmap_filter=0)  # -> SampledImageData, SampledImageData_2
sample_4 = BitmapSampler(BitmapToModify=bmp, PointToSample=pt_3, BitmapToModify_2=bmp, PointToSample_2=pt_3, bitmap_filter=0)  # -> SampledImageData, SampledImageData_2
sample_5 = BitmapSampler(BitmapToModify=bmp, PointToSample=pt_4, BitmapToModify_2=bmp, PointToSample_2=pt_4, bitmap_filter=0)  # -> SampledImageData, SampledImageData_2
sample_6 = BitmapSampler(BitmapToModify=bmp, PointToSample=pt_2, BitmapToModify_2=bmp, PointToSample_2=pt_2, bitmap_filter=0)  # -> SampledImageData, SampledImageData_2

# ---- group: x
series = Series(Start=0, Step=1, Count=int_4)

# ---- group: y
series_2 = Series(Start=0, Step=1, Count=int)

# ----
division = Division(A=lng, B="4")

# ---- group: webcam stream
bmp_2 = BitmapToModify(data)

# ----
col = Colour(sample.SampledImageData_2)  # disabled
col_2 = Colour(sample_3.SampledImageData_2)
col_3 = Colour(sample_2.SampledImageData_2)  # disabled
col_4 = Colour(sample_4.SampledImageData_2)
col_5 = Colour(sample_6.SampledImageData_2)
col_6 = Colour(sample_5.SampledImageData_2)
panel_4 = Panel(txt)
mcol_2 = MeshColours(Mesh=mesh_5, Colours=col)  # disabled
mcol_3 = MeshColours(Mesh=mesh_6, Colours=col_3)  # disabled
mcol_4 = MeshColours(Mesh=mesh_7, Colours=col_2)
multiplication_3 = Multiplication(A=series_2, B=4)
mcol_5 = MeshColours(Mesh=mesh_8, Colours=col_4)
mcol_6 = MeshColours(Mesh=mesh_9, Colours=col_6)
mcol_7 = MeshColours(Mesh=mesh_10, Colours=col_5)
series_3 = Series(Start=0, Step=1, Count=division)
# Defining the floor number for each
# building type.
panel_5 = Panel("""0,0,0,0,0,0,0,0,0,0,0,0,0,0,0,4,0,0,0,0,0,0,0,0,0,0,0,0,0,0,0,0,0,0,0,0,0,0,0,0,0,0,0,0
0,0,0,0,0,0,0,0,0,0,0,4,0,0,6,0,0,0,0,0,0,0,0,0,0,0,0,0,0,0,0,0,0,0,0,0,0,0,0,0,0,0,0,0
0,0,0,0,0,0,0,0,0,0,0,0,4,6,6,0,0,0,0,0,0,0,0,0,0,0,0,0,0,0,0,0,0,0,0,0,0,0,0,0,0,0,0,0
0,0,0,0,0,0,0,0,0,0,0,0,0,0,4,0,0,0,0,0,0,0,0,0,0,4,4,4,4,4,4,4,4,4,4,4,4,4,4,4,4,4,4,4
0,0,0,0,0,0,0,4,0,4,0,0,0,0,0,0,0,0,0,0,0,0,0,0,0,0,0,0,0,0,0,0,0,0,0,0,0,0,0,0,0,0,0,0
0,0,0,0,6,0,0,0,0,0,0,0,0,0,0,0,0,0,0,0,0,0,0,0,0,4,4,4,4,4,4,4,4,4,4,4,4,4,4,4,4,4,4,4
0,0,0,4,4,0,0,0,4,0,0,4,6,0,0,0,4,4,4,4,4,0,4,0,0,0,0,0,0,0,0,0,0,0,0,0,0,0,0,0,0,0,0,0
0,0,0,4,4,0,0,0,0,0,0,6,0,6,0,0,4,0,4,6,4,4,4,0,0,0,0,0,0,0,0,0,0,0,0,0,0,0,0,0,0,0,0,0
0,0,0,0,0,0,0,0,0,0,0,0,0,0,0,0,0,4,0,4,0,4,4,0,0,0,0,0,0,0,0,0,0,0,0,0,0,0,0,0,0,0,0,0
0,0,0,0,0,0,0,0,0,0,0,0,0,0,0,0,4,0,4,4,6,4,4,0,0,0,0,0,0,0,0,0,0,4,4,0,4,4,4,4,4,4,0,0
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""")
multiplication_4 = Multiplication(A=series, B=2)

# ---- group: keystoned grid pts
pt_8 = Point(perspective)

# ----
pshift = ShiftPaths(Data=series_3, Offset=-1)
multiplication_5 = Multiplication(A=division, B="4")
multiplication_6 = Multiplication(A=multiplication_3, B=int_4)
preview_2 = CustomPreview(
    Geometry=mcol_2,
    Shader={ambient=RGB(0, 0, 0), diffuse=RGB(255, 105, 180), emission=RGB(76, 32, 54), shine=0.5, specular=RGB(255, 255, 255), transparency=0})  # disabled
preview_3 = CustomPreview(
    Geometry=mcol_3,
    Shader={ambient=RGB(0, 0, 0), diffuse=RGB(255, 105, 180), emission=RGB(76, 32, 54), shine=0.5, specular=RGB(255, 255, 255), transparency=0})  # disabled
preview_4 = CustomPreview(
    Geometry=mcol_4,
    Shader={ambient=RGB(0, 0, 0), diffuse=RGB(255, 105, 180), emission=RGB(76, 32, 54), shine=0.5, specular=RGB(255, 255, 255), transparency=0})
preview_5 = CustomPreview(
    Geometry=mcol_5,
    Shader={ambient=RGB(0, 0, 0), diffuse=RGB(255, 105, 180), emission=RGB(76, 32, 54), shine=0.5, specular=RGB(255, 255, 255), transparency=0})
preview_6 = CustomPreview(
    Geometry=mcol_6,
    Shader={ambient=RGB(0, 0, 0), diffuse=RGB(255, 105, 180), emission=RGB(76, 32, 54), shine=0.5, specular=RGB(255, 255, 255), transparency=0})
pshift_2 = ShiftPaths(Data=pt_8, Offset=-1)

# ---- group: all sample pts
pt_9 = Point(pshift_2)

# ----
sample_7 = BitmapSampler(BitmapToModify=bmp_2, PointToSample=pt_9, BitmapToModify_2=bmp_2, PointToSample_2=pt_9, bitmap_filter=0)  # -> SampledImageData, SampledImageData_2
preview_7 = CustomPreview(
    Geometry=mcol_7,
    Shader={ambient=RGB(0, 0, 0), diffuse=RGB(255, 105, 180), emission=RGB(76, 32, 54), shine=0.5, specular=RGB(255, 255, 255), transparency=0})
box = CenterBox(Base=pt_9, X=0.003, Y=0.003, Z=0.003)
repeat = RepeatData(Data=pshift, Length=multiplication_5)
addition = Addition(A=multiplication_4, B=graft(multiplication_6))
merge = Merge(Data1=col_5, Data2=col_4, Data3=col_6, Data4=col_2, Data5=col, Data6=col_3)

_4_commed = Slider(6, range=1..25)
_1_resmed = Slider(9, range=1..25)
_3_comhq = Slider(3, range=1..25)
# Building Heights
_0_reslux = Slider(1, range=1..25)
_2_resmu = Slider(12, range=1..25)
_5_rescw = Slider(15, range=1..25)

pshift_3 = ShiftPaths(Data=repeat, Offset=-1)

# ---- group: all color quart ids
int_8 = Integer(pshift_3)

# ---- group: all sample color
col_7 = Colour(sample_7.SampledImageData_2)

# ---- group: all sample boxes
box_2 = Box(box)

# ---- group: all piece ids
int_9 = Integer([0, 6, 2, 2, 2, 2, 6, 1, 1, 1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])

# ----
txt_2 = Text(int_9)
shift = ShiftList(List=int_8, Shift=-1, Wrap=False)
pshift_4 = ShiftPaths(Data=addition, Offset=-1)
join = TextJoin(Text=txt_2, Join=",")
multiplication_7 = Multiplication(A=int_4, B=2)
pshift_5 = ShiftPaths(Data=shift, Offset=-1)

# ---- group: all ref colors
col_8 = Colour([RGB(217, 199, 178), RGB(96, 89, 93), RGB(218, 42, 36), RGB(227, 168, 29)])

# ----
addition_2 = Addition(A=pshift_4, B=multiplication_7)
merge_2 = Merge(Data1=pshift_5, Data2=graft("32"))
panel_6 = Panel(merge_2)
addition_3 = Addition(A=pshift_4, B=1)
int_10 = Integer(_5_rescw)

# ---- group: all perfect colors
# Closest Color Code
col_9 = Colour([ColourSwatch(SwatchColor=RGB(255, 255, 255)), ColourSwatch(SwatchColor=RGB(0, 0, 0)), ColourSwatch(SwatchColor=RGB(255, 0, 0))])

# ----
int_11 = Integer(_4_commed)
int_12 = Integer(_2_resmu)
int_13 = Integer(_3_comhq)
int_14 = Integer(_1_resmed)
int_15 = Integer(_0_reslux)
merge_3 = Merge(Data1=int_15, Data2=int_14, Data3=int_12, Data4=int_13, Data5=int_11, Data6=int_10)
addition_4 = Addition(A=addition_2, B=1)
textformating = TextFormating(txt=panel_5)
dist = Distance(PointA=graft(col_7), PointB=col_8)

# ---- group: floor height
panel_7 = Panel("3.5")

# ---- group: floor num for each type
int_16 = Integer(merge_3)

# ----
multiplication_8 = Multiplication(A=int_16, B=panel_7)
lng_2 = ListLength(List=dist)
series_4 = Series(Start=0, Step=1, Count=lng_2)
series_5 = Series(Start=0, Step=1, Count=int_5)

# ---- group: all module piece ids - from Text Data
int_17 = Integer(textformating)

# ----
int_18 = Integer(series_4)

# ---- group: building height for each type
# CityMatrix
# 
# "Ryan" Yan Zhang <ryanz@mit.edu>
# MIT Media Lab, Changing Place Group
# September. 2016
# Here you choose to use Text Data that you
# can edit or CityMatrix CV.
# 
# For Text Data, simple edit the text panel on
# the left (arrow 1), by change the ID in each
# slot, you change what building module to
# copy to the stage. Currently, ID -1 is blank,
# ID 0 to 5 are 6 different building type.
# 
# For CityMatrix CV, rewire this (arrow 2) and
# enable the video stream (arrow 3). Contact
# me for using and calibrating the physical
# CityMatrix table. <ryanz@mit.edu>
num = Number(multiplication_8)

# ----
repeat_2 = RepeatData(Data=graft(series_5), Length=int_6)
sort = SortList(Keys=dist, ValuesA=int_18)  # -> Keys, ValuesA
multiplication_9 = Multiplication(A=int_6, B=int_5)
series_6 = Series(Start=0, Step=1, Count=int_6)

# ---- group: sample pts
item = ListItem(List=pt_9, Index=addition_2, Wrap=False)
item_2 = ListItem(List=pt_9, Index=pshift_4, Wrap=False)
item_3 = ListItem(List=pt_9, Index=addition_4, Wrap=False)
item_4 = ListItem(List=pt_9, Index=addition_3, Wrap=False)

# ----
addition_5 = Addition(A=item_2, B=item_3)

# ---- group: replacing item ID
int_19 = Integer(int_7)

# ----
pshift_6 = ShiftPaths(Data=repeat_2, Offset=-1)
repeat_3 = RepeatData(Data=series_6, Length=multiplication_9)
item_5 = ListItem(List=sort.ValuesA, Index=0, Wrap=False)
division_2 = Division(A=addition_5, B=2)
pshift_7 = ShiftPaths(Data=pshift_6, Offset=-1)
pshift_8 = ShiftPaths(Data=repeat_3, Offset=-1)
lng_3 = ListLength(List=pshift_8)
repeat_4 = RepeatData(Data="0", Length=lng_3)
pshift_9 = ShiftPaths(Data=repeat_4, Offset=-1)

# ---- group: quart mid pts
pt_10 = Point(division_2)

# ----
pshift_10 = ShiftPaths(Data=item_5, Offset=-1)

# ---- group: x
int_20 = Integer(pshift_8)

# ---- group: y
int_21 = Integer(pshift_7)

# ---- group: rotation
int_22 = Integer(pshift_9)

# ----
pshift_11 = ShiftPaths(Data=pshift_10, Offset=-1)
panel_8 = Panel(int_22)
panel_9 = Panel(int_20)
panel_10 = Panel(int_21)

# ---- group: color code of each smaple pt
int_23 = Integer(pshift_11)

# ----
item_6 = ListItem(List=col_8, Index=int_23, Wrap=False)
preview_8 = CustomPreview(Geometry=box_2, Shader=item_6)

# ---- group: color codes
item_7 = ListItem(List=int_23, Index=pshift_4, Wrap=False)
item_8 = ListItem(List=int_23, Index=addition_2, Wrap=False)
item_9 = ListItem(List=int_23, Index=addition_4, Wrap=False)
item_10 = ListItem(List=int_23, Index=addition_3, Wrap=False)

# ----
merge_4 = Merge(Data1=graft(item_7), Data2=graft(item_8), Data3=graft(item_9), Data4=graft(item_10))

# ---- group: color code quarts
int_24 = Integer(merge_4)

# ----
rev = ReverseList(List=int_24)
txt_3 = Text(rev)
join_2 = TextJoin(Text=txt_3, Join=",")
pshift_12 = ShiftPaths(Data=join_2, Offset=-1)

# ---- group: color code quart texts
txt_4 = Text(pshift_12)

# ----
keysearch = KeyValueSearch(Keys=txt, Values=merge_2, Search=graft(txt_4))
nullrep = ReplaceNulls(Items=keysearch, Replacements="-1")  # -> Items, Count
pshift_13 = ShiftPaths(Data=nullrep.Items, Offset=-1)

# ---- group: all module piece ids
int_25 = Integer(pshift_13)

# ----
addition_6 = Addition(A=int_25, B=1)
tag = TextTag3D(Location=pt_10, Text=addition_6, Size=0.01, Justification=5)
panel_11 = Panel(addition_6)

# ---- group: all module piece ids - from CityMatrix CV
int_26 = Integer(addition_6)

# ----
replace = ReplaceItems(List=int_17, Item=int_26, Indices=int_19, Wrap=False)

# ---- group: module id
int_27 = Integer(replace)

# ----
panel_12 = Panel(int_27)

# ---- group: y
int_28 = Integer(int_21)

# ---- group: x
int_29 = Integer(int_20)

# ---- group: indexes of groups
series_7 = Series(Start=1, Step=1, Count=14)
cull_i = CullIndex(List=series_7, Indices=[2, 3, 4], Wrap=True)
merge_5 = Merge(Data1=cull_i)  # -> graft(Result)
lng_4 = ListLength(List=int_27)
series_8 = Series(Start=0, Step=1, Count=lng_4)
equals = Equality(FirstNumber=int_27, SecondNumber=merge_5)  # -> Equality, Inequality
dispatch = Dispatch(List=series_8, DispatchPattern=equals.Equality)  # -> ListA, ListB

# ----
int_30 = Integer()
panel_13 = Panel(cull_i)

# ---- group: intervention
panel_14 = Panel("0.00001")  # disabled
panel_15 = Panel("0")  # disabled

# ----
int_31 = Integer([14, 9])
int_32 = Integer([8, 10, 11])
int_33 = Integer([12, 13, 1, 2])

# ---- group: pREVENTIVE
panel_16 = Panel(int_33)
panel_17 = Panel(int_32)
panel_18 = Panel(int_31)

# ---- group: Sort index into radius groups / r1
int_34 = Integer([14, 9])

# ----
pt_11 = ConstructPoint(XCoordinate=int_20, YCoordinate=int_21, ZCoordinate=0)  # disabled
pt_12 = ConstructPoint(XCoordinate=panel_14, YCoordinate=panel_15, ZCoordinate=0)  # disabled
series_9 = Series(Start=1, Step=1, Count=14)
panel_19 = Panel("1873")  # disabled
panel_20 = Panel("1")  # disabled
panel_21 = Panel("1785")  # disabled
panel_22 = Panel("1741")  # disabled
panel_23 = Panel("1829")  # disabled

# ----
# Here's the code for the abstract point
# color example I shown in the class.
# It's a very good starting point to build
# your own logic without worring about
# the output part too much.
# 
# Currently, move arround the 2 reference
# points will change the heatmap.
# 
# Mind that the x,y coordinate is from
# 0 to 15, so it is pretty small. Zoom in to
# see the points, or you can use Camera
# "HeatMapPts" saved for you.
pt_13 = Point(<point referenced from the Rhino model>)  # disabled
pt_14 = Point(<point referenced from the Rhino model>)  # disabled

panel_24 = Panel("1697")  # disabled
item_11 = ListItem(List=panel_12, Index=panel_19, Wrap=False)  # disabled
cull_i_2 = CullIndex(List=series_9, Indices=[0, 1, 2, 6, 7, 8, 9, 10, 11, 12, 13, 14], Wrap=True)
item_12 = ListItem(List=panel_12, Index=panel_23, Wrap=False)  # disabled
item_13 = ListItem(List=panel_12, Index=panel_22, Wrap=False)  # disabled
item_14 = ListItem(List=panel_12, Index=panel_21, Wrap=False)  # disabled
item_15 = ListItem(List=panel_12, Index=panel_24, Wrap=False)  # disabled

# ---- group: Sort index into radius groups / R2
int_35 = Integer([12, 13, 1, 2, 6, 7])

# ----
series_10 = Series(Start=1, Step=1, Count=3)

# ---- group: Sort index into radius groups / R2
int_36 = Integer([12, 13, 1, 2, 6, 7])

# ----
number_slider_7 = Slider(11, range=0..1000)
merge_6 = Merge(Data1=cull_i_2)  # -> graft(Result)
int_37 = Integer(item_11)  # disabled
number_slider_8 = Slider(22, range=0..1000)
dist_2 = Distance(PointA=pt_14, PointB=pt_11)  # disabled
dist_3 = Distance(PointA=pt_13, PointB=pt_11)  # disabled
int_38 = Integer(item_12)  # disabled
int_39 = Integer(item_13)  # disabled
int_40 = Integer(item_14)  # disabled
lng_5 = ListLength(List=int_27)
int_41 = Integer(item_15)  # disabled
panel_25 = Panel("32")  # disabled
panel_26 = Panel("1")  # disabled
equals_2 = Equality(FirstNumber=int_37, SecondNumber=panel_25)  # -> Equality, Inequality; disabled
equals_3 = Equality(FirstNumber=int_39, SecondNumber=panel_25)  # -> Equality, Inequality; disabled
equals_4 = Equality(FirstNumber=int_40, SecondNumber=panel_25)  # -> Equality, Inequality; disabled
equals_5 = Equality(FirstNumber=int_41, SecondNumber=panel_25)  # -> Equality, Inequality; disabled
equals_6 = Equality(FirstNumber=int_38, SecondNumber=panel_25)  # -> Equality, Inequality; disabled
min = Minimum(A=dist_3, B=dist_2)  # disabled
series_11 = Series(Start=0, Step=1, Count=lng_5)

# ---- group: Sort index into radius groups / R3
int_42 = Integer([8, 10, 11])

# ---- group: Sort index into radius groups
panel_27 = Panel(int_34)
panel_28 = Panel(int_27)
panel_29 = Panel(int_35)
int_43 = Integer(panel_28)
panel_30 = Panel(int_42)
mindex = MemberIndex(Set=int_43, Member=int_35)  # -> flatten(Index), Count
mindex_2 = MemberIndex(Set=int_43, Member=int_42)  # -> flatten(Index), Count
mindex_3 = MemberIndex(Set=int_43, Member=int_34)  # -> flatten(Index), Count

# ----
equals_7 = Equality(FirstNumber=int_27, SecondNumber=merge_6)  # -> Equality, Inequality

# ---- group: Sort index into radius groups / R3
int_44 = Integer([8, 10, 11])

# ---- group: Sort index into radius groups
panel_31 = Panel(int_27)
int_45 = Integer(panel_31)
mindex_4 = MemberIndex(Set=int_45, Member=int_36)  # -> flatten(Index), Count
mindex_5 = MemberIndex(Set=int_45, Member=int_44)  # -> flatten(Index), Count

panel_32 = Panel(int_36)
panel_33 = Panel(int_44)

# ----
mindex_6 = MemberIndex(Set=int_45, Member=int_33)  # -> flatten(Index), Count
mindex_7 = MemberIndex(Set=int_45, Member=int_31)  # -> flatten(Index), Count
panel_34 = Panel(min)  # disabled
graft = GraftTree(Tree=series_10, IncludeEmptyLists=True, IncludeNullItems=True)
lng_6 = ListLength(List=dispatch.ListA)
show_railway_noise_map = Panel(equals_2.Equality)  # disabled
dispatch_2 = Dispatch(List=series_11, DispatchPattern=equals_7.Equality)  # -> ListA, ListB
show_street_noise_map = Panel(equals_6.Equality)  # disabled
show_google_map = Panel(equals_4.Equality)  # disabled
panel_35 = Panel(equals_7.Equality)
path_mapper = PathMapper(mindex_7.Index, source="{A}", target="{0}")
path_mapper_2 = PathMapper(mindex_2.Index, source="{A}", target="{2}")
path_mapper_3 = PathMapper(mindex.Index, source="{A}", target="{1}")
path_mapper_4 = PathMapper(mindex_3.Index, source="{A}", target="{0}")
path_mapper_5 = PathMapper(mindex_6.Index, source="{A}", target="{1}")
path_mapper_6 = PathMapper(mindex_5.Index, source="{A}", target="{2}")
path_mapper_7 = PathMapper(mindex_4.Index, source="{A}", target="{1}")
repeat_5 = RepeatData(Data=Slider(3, range=1..44), Length=lng_6)
merge_7 = Merge(Data1=path_mapper_4, Data2=path_mapper_3, Data3=path_mapper_2)
merge_8 = Merge(Data1=path_mapper, Data2=path_mapper_5)
merge_9 = Merge(Data1=path_mapper_7, Data2=path_mapper_6)

# ---- group: safety score
division_3 = Division(A=panel_26, B=panel_34)  # disabled

# ----
panel_36 = Panel(dispatch_2.ListA)
panel_37 = Panel("C:\Users\CSlab\Downloads\CityMatrix\Maps\Railroadnoise.png")  # disabled
pshift_14 = ShiftPaths(Data=repeat_5, Offset=-1)
# C:\Users\Cedric\Desktop\Eigene Dateien\Studium\Master\3. Semester\Q-Studie 2 Rothenburgsort\Map\sat_map_rothenburgsort.jpg
panel_38 = Panel("C:\Users\CSlab\Downloads\CityMatrix\Maps\sat_map_rothenburgsort.jpg")  # disabled
panel_39 = Panel("C:\Users\CSlab\Downloads\CityMatrix\Maps\Roadnoise.png")  # disabled
multiplication_10 = Multiplication(A=pshift_14, B=1)
panel_40 = Panel(division_3)  # disabled
panel_41 = Panel("\"null\"")  # disabled
panel_42 = Panel("\"null\"")  # disabled
panel_43 = Panel("\"null\"")  # disabled
dispatch_3 = Dispatch(List=panel_41, DispatchPattern=equals_2.Inequality)  # -> ListA, ListB; disabled
dispatch_4 = Dispatch(List=panel_37, DispatchPattern=show_railway_noise_map)  # -> ListA, ListB; disabled
dispatch_5 = Dispatch(List=panel_42, DispatchPattern=equals_6.Inequality)  # -> ListA, ListB; disabled
dispatch_6 = Dispatch(List=panel_43, DispatchPattern=equals_4.Inequality)  # -> ListA, ListB; disabled
dispatch_7 = Dispatch(List=panel_39, DispatchPattern=show_street_noise_map)  # -> ListA, ListB; disabled
dispatch_8 = Dispatch(List=panel_38, DispatchPattern=show_google_map)  # -> ListA, ListB; disabled
gradient = Gradient(LowerLimit=0, UpperLimit=1, Parameter=division_3, stops=[0: RGB(255, 0, 0), 0.5: RGB(255, 255, 0), 1: RGB(0, 128, 0)])  # disabled
panel_44 = Panel(merge_7)
panel_45 = Panel(merge_8)
max = Slider(30, range=0..100)

max_2 = Slider(20, range=0..100)
max_3 = Slider(31, range=0..100)
max_4 = Slider(21, range=0..100)

preview_9 = CustomPreview(Geometry=pt_11, Shader=gradient)  # disabled

# ---- group: NEGATIVE / r1
int_46 = Integer(max)

# ---- group: r1
int_47 = Integer(max_2)

# ---- group: r2
int_48 = Integer(max_3)

# ---- group: r3
int_49 = Integer(max_4)

# ----
max_5 = Slider(22, range=0..100)
max_6 = Slider(12, range=0..100)
max_7 = Slider(28, range=0..100)

graft_2 = GraftTree(Tree=[int_48, int_49, int_47], IncludeEmptyLists=True, IncludeNullItems=True)

# ---- group: r1
int_50 = Integer(max_5)

# ---- group: r2
int_51 = Integer(max_7)

# ---- group: r3
int_52 = Integer(max_6)

# ----
x_width = Slider(2799, range=100..5000)  # disabled
y_height = Slider(2801, range=100..5000)  # disabled
number_slider_9 = Slider(0.357, range=0..1)  # disabled
graft_3 = GraftTree(Tree=[int_51, int_52, int_50], IncludeEmptyLists=True, IncludeNullItems=True)
x_width_2 = Slider(2799, range=100..5000)  # disabled
y_height_2 = Slider(2801, range=100..5000)  # disabled
number_slider_10 = Slider(0.357, range=0..1)  # disabled
multiplication_11 = Multiplication(A=y_height, B=number_slider_9)  # disabled
multiplication_12 = Multiplication(A=x_width, B=number_slider_9)  # disabled
x_width_3 = Slider(2799, range=100..5000)  # disabled
y_height_3 = Slider(2801, range=100..5000)  # disabled
number_slider_11 = Slider(0.357, range=0..1)  # disabled
multiplication_13 = Multiplication(A=y_height_2, B=number_slider_10)  # disabled
multiplication_14 = Multiplication(A=x_width_2, B=number_slider_10)  # disabled
number_slider_12 = Slider(360, range=345..360)  # disabled
multiplication_15 = Multiplication(A=y_height_3, B=number_slider_11)  # disabled
multiplication_16 = Multiplication(A=x_width_3, B=number_slider_11)  # disabled
number_slider_13 = Slider(20, range=-10..20)  # disabled
number_slider_14 = Slider(360, range=345..360)  # disabled
number_slider_15 = Slider(360, range=345..360)  # disabled
panel_46 = Panel("Railroadnoise.png")  # disabled
number_slider_16 = Slider(19.758, range=-10..20)  # disabled
Z = UnitZ(Factor=number_slider_13)  # disabled
number_slider_17 = Slider(19.758, range=-10..20)  # disabled
number_slider_18 = Slider(0, range=0..1)  # disabled
toggle = BooleanToggle(True)  # disabled
Z_2 = UnitZ(Factor=number_slider_16)  # disabled
number_slider_19 = Slider(0, range=0..1)  # disabled
Z_3 = UnitZ(Factor=number_slider_17)  # disabled
number_slider_20 = Slider(0, range=0..1)  # disabled

# ---- group: gridExtent_x
int_53 = Integer(int_6)

# ---- group: shrink
cell_shrink = Slider(0.337, range=0.01..1)

# ---- group: toggle1
bool = Boolean(False)

# ---- group: gridExtent_y
int_54 = Integer(int_5)

# ---- group: rotation
int_55 = Integer(int_22)

# ---- group: module id
int_56 = Integer(int_27)

# ---- group: y
int_57 = Integer(int_21)

# ---- group: x
int_58 = Integer(int_20)

# ---- group: colortizer orgin
pt_15 = Point(<point referenced from the Rhino model>)

# ---- group: table size ref pt
pt_16 = Point(<point referenced from the Rhino model>)

# ----
# LEGO Grid System
pt_17 = Point(<point referenced from the Rhino model>)
xy = XYPlane(Origin=pt_17)
dist_4 = Distance(PointA=pt_15, PointB=pt_16)
division_4 = Division(A=dist_4, B=int_53)
movetoorgin = MoveToOrgin(G=mesh_4, num=cell_shrink)
movetoorgin_2 = MoveToOrgin(G=mesh_3, num=cell_shrink)

# ---- group: base cplane
pln = Plane(xy)

# ----
# Google Map @ Lego
planesrf = PlaneSurface(Plane=pln, XSize=multiplication_12, YSize=multiplication_11)  # disabled
planesrf_2 = PlaneSurface(Plane=pln, XSize=multiplication_14, YSize=multiplication_13)  # disabled
rotate = Rotate(Geometry=planesrf, Angle=degrees(number_slider_12), Plane=PlaneXY(0, 0, 0))  # -> Geometry, Transform; disabled
planesrf_3 = PlaneSurface(Plane=pln, XSize=multiplication_16, YSize=multiplication_15)  # disabled
move = Move(Geometry=rotate.Geometry, Motion=Z)  # -> Geometry, Transform; disabled
rotate_2 = Rotate(Geometry=planesrf_2, Angle=degrees(number_slider_14), Plane=PlaneXY(0, 0, 0))  # -> Geometry, Transform; disabled
filter = StreamFilter(Gate=toggle, Stream1=move.Geometry)  # disabled
move_2 = Move(Geometry=rotate_2.Geometry, Motion=Z_2)  # -> Geometry, Transform; disabled
rotate_3 = Rotate(Geometry=planesrf_3, Angle=degrees(number_slider_15), Plane=PlaneXY(0, 0, 0))  # -> Geometry, Transform; disabled
filter_2 = StreamFilter(Gate=show_street_noise_map, Stream1=move_2.Geometry)  # disabled
move_3 = Move(Geometry=rotate_3.Geometry, Motion=Z_3)  # -> Geometry, Transform; disabled
previewmat = CustomPreviewMaterials(Geometry=filter, DiffuseColor=RGB(255, 255, 255), Transparency=number_slider_18, DiffuseBitmap=panel_46)  # disabled
filter_3 = StreamFilter(Gate=show_railway_noise_map, Stream1=move_3.Geometry)  # disabled
previewmat_2 = CustomPreviewMaterials(
    Geometry=filter_2,
    DiffuseColor=RGB(255, 255, 255),
    Transparency=number_slider_19,
    DiffuseBitmap=[dispatch_7.ListA, dispatch_5.ListA])  # disabled
previewmat_3 = CustomPreviewMaterials(Geometry=filter_3, DiffuseColor=RGB(255, 255, 255), Transparency=number_slider_20, DiffuseBitmap=dispatch_4.ListA)  # disabled

# ---- group: ref mesh plane at origin
mesh_12 = Mesh(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)

# ---- group: cell size
num_2 = Number(division_4)

# ----
modulecenter = ModuleCenter_2(pt=pt_15, num=num_2, int_2=int_29, int=int_28)  # -> flatten(pt_5), transform_2
item_16 = ListItem(List=modulecenter.pt_5, Index=dispatch_2.ListA, Wrap=True)

# ---- group: Coordinates XY
item_17 = ListItem(List=modulecenter.pt_5, Index=dispatch.ListA, Wrap=True)

# ----
item_18 = ListItem(List=modulecenter.pt_5, Index=merge_8, Wrap=True)
item_19 = ListItem(List=modulecenter.pt_5, Index=merge_9, Wrap=True)
# Need index numbet from up,
# but compound Index (i) doesnt work
panel_47 = Panel(item_19)

# ---- group: Heathmap! / POSITIVE
pt_18 = Point(modulecenter.pt_5)
# HEALTH CARE FIELD
# ID 9 6 7 8 10 11
pt_19 = Point(modulecenter.pt_5)
cps = ClosestPoints(Point=panel_47, Cloud=pt_19, Count=graft_2)  # -> ClosestPoint, CPIndex, Distance
max_8 = Slider(46, range=0..100)
min_2 = Slider(6, range=0..100)
graft_4 = GraftTree(Tree=[min_2, max_8], IncludeEmptyLists=True, IncludeNullItems=True)
Z_4 = UnitZ(Factor=Slider(1, range=0..1))
move_4 = Move(Geometry=pt_18, Motion=Z_4)  # -> Geometry, Transform
pshift_15 = ShiftPaths(Data=cps.ClosestPoint, Offset=-2)
cp = ClosestPoint(Point=move_4.Geometry, Cloud=pshift_15)  # -> ClosestPoint, CPIndex, Distance
division_5 = Division(A=Slider(37.4, range=0..50), B=cp.Distance)

# ---- group: NEGATIVE / all neg pts
pt_20 = Point(item_16)

# ---- group: Heathmap! / POSITIVE
pt_21 = Point(modulecenter.pt_5)
# PREVENTIVE FIELD 12 13 14 1 2
pt_22 = Point(modulecenter.pt_5)
cps_2 = ClosestPoints(Point=item_18, Cloud=pt_22, Count=graft_3)  # -> ClosestPoint, CPIndex, Distance
max_9 = Slider(46, range=0..100)
min_3 = Slider(6, range=0..100)
graft_5 = GraftTree(Tree=[min_3, max_9], IncludeEmptyLists=True, IncludeNullItems=True)
Z_5 = UnitZ(Factor=Slider(1, range=0..1))
move_5 = Move(Geometry=pt_21, Motion=Z_5)  # -> Geometry, Transform
pshift_16 = ShiftPaths(Data=cps_2.ClosestPoint, Offset=-2)
cp_2 = ClosestPoint(Point=move_5.Geometry, Cloud=pshift_16)  # -> ClosestPoint, CPIndex, Distance
division_6 = Division(A=Slider(37.4, range=0..50), B=cp_2.Distance)

# ----
panel_48 = Panel(division_5)
panel_49 = Panel(division_6)
remap = RemapNumbers(Value=panel_48, Source="0.0 to 1", Target=Domain(0, 1))  # -> Mapped, Clipped
min_4 = Minimum(A=remap.Mapped, B=1)
panel_50 = Panel(min_4)
bnd = Bounds(Numbers=panel_48)
panel_51 = Panel(bnd)
remap_2 = RemapNumbers(Value=panel_49, Source="0.0 to 1", Target=Domain(0, 1))  # -> Mapped, Clipped
min_5 = Minimum(A=remap_2.Mapped, B=1)

# ---- group: map1
panel_52 = Panel(min_5)

# ----
bnd_2 = Bounds(Numbers=panel_49)
panel_53 = Panel(bnd_2)

# ---- group: module center pts
pt_23 = Point(pt_19)

# ----
modulecenter_2 = ModuleCenter(pt=pt_15, num=num_2, int_2=int_58, int=int_57)  # -> pt_5, transform_2

# ---- group: map1 scores
num_3 = Number(panel_52)

# ----
panel_54 = Panel("Railroadnoise.jpg")
panel_55 = Panel("Roadnoise.jpg")

scale = Scale(Geometry=mesh_12, Center=Point(0, 0, 0), Factor=0.3)  # -> Geometry, Transform

# ---- group: module meshes lego at orgin
mesh_13 = Mesh(movetoorgin)

mesh_14 = Mesh(movetoorgin_2)

# ---- group: module center
pt_24 = Point(modulecenter_2.pt_5)

# ----
vec2pt = Vector2Pt(PointA=Point(0, 0, 0), PointB=pt_23, Unitize=False)  # -> Vector, Length
planesrf_4 = PlaneSurface(Plane=pln, XSize=Domain(0, 1000), YSize=Domain(-1000, 0))
Z_6 = UnitZ(Factor=5.3)
move_6 = Move(Geometry=scale.Geometry, Motion=Z_6)  # -> Geometry, Transform
Z_7 = UnitZ(Factor=Slider(-0.5, range=-10..10))
# Google Map @ Lego
srf = Surface(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)
move_7 = Move(Geometry=srf, Motion=Z_7)  # -> Geometry, Transform
move_8 = Move(Geometry=move_6.Geometry, Motion=vec2pt.Vector)  # -> Geometry, Transform
larger = LargerThan(FirstNumber=int_56, SecondNumber="0")  # -> LargerThan, OrEqualTo
smaller = SmallerThan(FirstNumber=int_56, SecondNumber="15")  # -> SmallerThan, OrEqualTo
gradient_2 = Gradient(LowerLimit=0, UpperLimit=1, Parameter=num_3, stops=[0: RGB(255, 0, 0), 0.5: RGB(255, 255, 0), 1: RGB(0, 255, 0)])
and = GateAnd(A=larger.OrEqualTo, B=smaller.OrEqualTo)
dispatch_9 = Dispatch(List=int_56, DispatchPattern=and)  # -> ListA, ListB
previewmat_4 = CustomPreviewMaterials(
    Geometry=move_7.Geometry,
    DiffuseColor=ColourSwatch(SwatchColor=RGB(255, 255, 255)),
    Transparency="0.0",
    DiffuseBitmap="sat_map_rothenburgsort.jpg")
smaller_2 = SmallerThan(FirstNumber=int_56, SecondNumber="0")  # -> SmallerThan, OrEqualTo

# ---- group: mesh planes for heatmaps
mesh_15 = Mesh(move_8.Geometry)

# ----
item_20 = ListItem(List=mesh_14, Index=graft(dispatch_9.ListA), Wrap=False)
argb = SplitARGB(Colour=gradient_2, IntegerChannels=True)  # -> Alpha, Red, Green, Blue
dispatch_10 = Dispatch(List=pt_24, DispatchPattern=smaller_2.SmallerThan)  # -> ListA, ListB
pshift_17 = ShiftPaths(Data=item_20, Offset=-1)
dispatch_11 = Dispatch(List=int_55, DispatchPattern=and)  # -> ListA, ListB
rgb = ColourRGB(Alpha=Slider(150, range=0..255), Red=argb.Red, Green=argb.Green, Blue=argb.Blue)
vec2pt_2 = Vector2Pt(PointA=Point(0, 0, 0), PointB=dispatch_10.ListA, Unitize=False)  # -> Vector, Length
rotate_4 = Rotate(Geometry=pshift_17, Angle=degrees(dispatch_11.ListA), Plane=PlaneXY(0, 0, 0))  # -> Geometry, Transform
dispatch_12 = Dispatch(List=pt_24, DispatchPattern=and)  # -> ListA, ListB
move_9 = Move(Geometry=mesh_13, Motion=vec2pt_2.Vector)  # -> Geometry, Transform
vec2pt_3 = Vector2Pt(PointA=Point(0, 0, 0), PointB=dispatch_12.ListA, Unitize=False)  # -> Vector, Length
move_10 = Move(Geometry=rotate_4.Geometry, Motion=vec2pt_3.Vector)  # -> Geometry, Transform

# ---- group: map1 viz
preview_10 = CustomPreview(Geometry=mesh_15, Shader=rgb)

# ---- group: building lego modules
mesh_16 = Mesh(move_10.Geometry)

# ---- group: blank
mesh_17 = Mesh(move_9.Geometry)

# ---- group: module center
pt_25 = Point(pt_24)

# ---- group: 3D building site move amount
# 3D City Grid System
panel_56 = Panel("10000")
X = UnitX(Factor=panel_56)

# ---- group: module id
int_59 = Integer(int_27)

# ----
com = ColourSwatch(SwatchColor=RGB(158, 158, 158))
com_2 = ColourSwatch(SwatchColor=RGB(71, 71, 71))
res = ColourSwatch(SwatchColor=RGB(212, 212, 212))
res_2 = ColourSwatch(SwatchColor=RGB(76, 76, 76))

# ---- group: blank
mesh_18 = Mesh(mesh_17)

# ----
larger_2 = LargerThan(FirstNumber=int_59, SecondNumber="0")  # -> LargerThan, OrEqualTo
smaller_3 = SmallerThan(FirstNumber=int_59, SecondNumber="5")  # -> SmallerThan, OrEqualTo

# ---- group: road mesh final!
mesh_19 = Mesh()

# ---- group: sidewalk mesh final!
mesh_20 = Mesh()

# ----
vec = Vector(X)
merge_10 = Merge(Data1=res, Data2=res, Data3=res, Data4=com, Data5=com, Data6=com)
merge_11 = Merge(Data1=res_2, Data2=res_2, Data3=res_2, Data4=com_2, Data5=com_2, Data6=com_2)
and_2 = GateAnd(A=larger_2.OrEqualTo, B=smaller_3.OrEqualTo)
merge_12 = Merge(Data1=merge_10, Data2=merge_11)

# ---- group: is building or not
bool_2 = Boolean(and_2)

# ---- group: cell size
num_4 = Number(division_4)

# ----
dispatch_13 = Dispatch(List=pt_25, DispatchPattern=bool_2)  # -> ListA, ListB
dispatch_14 = Dispatch(List=int_59, DispatchPattern=bool_2)  # -> ListA, ListB

# ---- group: color for each type
col_10 = Colour(merge_12)

# ----
division_7 = Division(A=num_4, B=2)

# ---- group: building center
pt_26 = Point(dispatch_13.ListA)

# ---- group: building id
int_60 = Integer(dispatch_14.ListA)

# ----
equals_8 = Equality(FirstNumber=int_60)  # -> Equality, Inequality
multiplication_17 = Multiplication(A=equals_8.Inequality, B=6)
move_11 = Move(Geometry=mesh_19, Motion=vec)  # -> Geometry, Transform
move_12 = Move(Geometry=mesh_20, Motion=vec)  # -> Geometry, Transform

# ---- group: base height
panel_57 = Panel("5.0")

# ----
move_13 = Move(Geometry=mesh_18, Motion=vec)  # -> Geometry, Transform
multiplication_18 = Multiplication(A=division_7, B=Slider(0.95, range=0..1))
addition_7 = Addition(A=int_60, B=multiplication_17)
neg = Negative(Value=multiplication_18)
filter_4 = StreamFilter(Gate=0, Stream0=addition_7, Stream1=int_60)
item_21 = ListItem(List=col_10, Index=graft(filter_4), Wrap=False)
pshift_18 = ShiftPaths(Data=item_21, Offset=-1)
dom = ConstructDomain(DomainStart=neg, DomainEnd=multiplication_18)
panel_58 = Panel(num)

# ---- group: color for each building
col_11 = Colour(pshift_18)

# ----
item_22 = ListItem(List=panel_58, Index=graft(int_60), Wrap=False)
pshift_19 = ShiftPaths(Data=item_22, Offset=-1)

# ---- group: building height factor
number_slider_21 = Slider(3.1, range=0..10)

# ----
multiplication_19 = Multiplication(A=pshift_19, B=number_slider_21)

# ---- group: building height of each building
num_5 = Number(multiplication_19)

# ----
addition_8 = Addition(A=num_5, B=panel_57)
dom_2 = ConstructDomain(DomainStart=0, DomainEnd=addition_8)
box_3 = DomainBox(Base=pt_26, X=dom, Y=dom, Z=dom_2)
move_14 = Move(Geometry=box_3, Motion=vec)  # -> Geometry, Transform

# ---- group: building geo
box_4 = Box(move_14.Geometry)

# ---- group: 3D Buldings
preview_11 = CustomPreview(Geometry=box_4, Shader=col_11)

# ---- group: road
mesh_21 = Mesh(move_11.Geometry)

# ---- group: sidewalk
mesh_22 = Mesh(move_12.Geometry)

# ---- group: blank
mesh_23 = Mesh(move_13.Geometry)

# ---- group: NEGATIVE
max_10 = Slider(9, range=0..100)
max_11 = Slider(24, range=0..100)
pt_27 = Point(modulecenter.pt_5)
move_15 = Move(Geometry=pt_27, Motion=Vector(0, 0, 10))  # -> Geometry, Transform

# ---- group: NEGATIVE / r2
int_61 = Integer(max_11)

# ---- group: NEGATIVE / r3
int_62 = Integer(max_10)

# ---- group: NEGATIVE (continued)
graft_6 = GraftTree(Tree=[int_46, int_61, int_62], IncludeEmptyLists=True, IncludeNullItems=True)
cps_3 = ClosestPoints(Point=pt_20, Cloud=pt_27, Count=graft_6)  # -> ClosestPoint, CPIndex, Distance
pshift_20 = ShiftPaths(Data=cps_3.ClosestPoint, Offset=-2)
cp_3 = ClosestPoint(Point=move_15.Geometry, Cloud=pshift_20)  # -> ClosestPoint, CPIndex, Distance
division_8 = Division(A=Slider(37.4, range=-50..160), B=cp_3.Distance)

# ----
panel_59 = Panel(division_8)
remap_3 = RemapNumbers(Value=panel_59, Source="0.0 to 1", Target=Domain(0, 1))  # -> Mapped, Clipped
min_6 = Minimum(A=remap_3.Mapped, B=1)
panel_60 = Panel(min_6)
bnd_3 = Bounds(Numbers=panel_59)
panel_61 = Panel(bnd_3)
subtraction = Subtraction(A=panel_50, B=panel_60)
panel_62 = Panel(subtraction)
bnd_4 = Bounds(Numbers=panel_62)
panel_63 = Panel(bnd_4)
remap_4 = RemapNumbers(Value=panel_62, Source=panel_63, Target=Domain(0, 1))  # -> Mapped, Clipped

# ---- group: map2
panel_64 = Panel(remap_4.Mapped)

# ----
bnd_5 = Bounds(Numbers=remap_4.Mapped)
panel_65 = Panel(bnd_5)
pshift_21 = ShiftPaths(Data=panel_64, Offset=-2)

# ---- group: map2 scores
num_6 = Number(pshift_21)

# ----
gradient_3 = Gradient(LowerLimit=0, UpperLimit=1, Parameter=num_6, stops=[0: RGB(255, 0, 0), 0.5: RGB(255, 255, 0), 1: RGB(0, 255, 0)])
argb_2 = SplitARGB(Colour=gradient_3, IntegerChannels=True)  # -> Alpha, Red, Green, Blue
rgb_2 = ColourRGB(Alpha=Slider(150, range=0..255), Red=argb_2.Red, Green=argb_2.Green, Blue=argb_2.Blue)

# ---- group: map2 viz
preview_12 = CustomPreview(Geometry=mesh_15, Shader=rgb_2)

# ==== cluster ModuleCenter
pt = ClusterInput()
int = ClusterInput()
num = ClusterInput()
int_2 = ClusterInput()

# ---- group: y
int_3 = Integer(int)

# ---- group: cell size
num_2 = Number(num)

# ---- group: x
int_4 = Integer(int_2)

# ---- group: center
pt_2 = Point(pt)

# ----
pt_3 = ConstructPoint(XCoordinate=0, YCoordinate=0, ZCoordinate=0)  # disabled
addition = Addition(A=int_4, B=0.5)
vec2pt = Vector2Pt(PointA=pt_3, PointB=pt_2, Unitize=False)  # -> Vector, Length; disabled
addition_2 = Addition(A=int_3, B=0.5)
multiplication = Multiplication(A=addition, B=num_2)
move = Move(Motion=vec2pt.Vector)  # -> Geometry, Transform; disabled
lng = ListLength(List=int_4)  # disabled
multiplication_2 = Multiplication(A=addition_2, B=num_2)
X = UnitX(Factor=multiplication)
repeat = RepeatData(Data=move.Transform, Length=lng)  # disabled
neg = Negative(Value=multiplication_2)
move_2 = Move(Geometry=pt_2, Motion=X)  # -> Geometry, Transform
graft = GraftTree(Tree=move_2.Transform, IncludeEmptyLists=True, IncludeNullItems=True)  # disabled
Y = UnitY(Factor=neg)
pshift = ShiftPaths(Data=repeat, Offset=-1)  # disabled
move_3 = Move(Geometry=move_2.Geometry, Motion=Y)  # -> Geometry, Transform
graft_2 = GraftTree(Tree=move_3.Transform, IncludeEmptyLists=True, IncludeNullItems=True)  # disabled
comp = Compound(Transforms=[graft, graft_2])  # disabled
graft_3 = GraftTree(Tree=pshift, IncludeEmptyLists=True, IncludeNullItems=True)  # disabled
comp_2 = Compound(Transforms=[comp, graft_3])  # disabled

# ---- group: module center
pt_4 = Point(move_3.Geometry)

# ----
pshift_2 = ShiftPaths(Data=comp_2, Offset=-1)  # disabled
transform = Transform(pshift_2)  # disabled
pt_5 = ClusterOutput(pt_4)
transform_2 = ClusterOutput(transform)  # disabled

# ==== cluster MoveToOrgin
num = ClusterInput()
G = ClusterInput()
num_2 = Number(num)
geobottomcenter = GeoBottomCenter(geo=G)
vec2pt = Vector2Pt(PointA=geobottomcenter, PointB=Point(0, 0, 0), Unitize=False)  # -> Vector, Length
move = Move(Geometry=G, Motion=vec2pt.Vector)  # -> Geometry, Transform
scale_nu = ScaleNU(Geometry=move.Geometry, Plane=PlaneXY(0, 0, 0), ScaleX=num_2, ScaleY=num_2, ScaleZ=1)  # -> Geometry, Transform
G_2 = ClusterOutput(scale_nu.Geometry)

# ==== cluster Perspective
int = ClusterInput()
int_2 = ClusterInput()
pt = ClusterInput()

# ---- group: grid extent y
int_3 = Integer(int)

# ---- group: grid extent x
int_4 = Integer(int_2)

# ---- group: Pts Sample Grid Corner
pt_2 = Point(pt)

# ----
subtraction = Subtraction(A=int_4, B=1)
subtraction_2 = Subtraction(A=int_3, B=1)
item = ListItem(List=pt_2, Index=0, Wrap=False)
item_2 = ListItem(List=pt_2, Index=1, Wrap=False)
item_3 = ListItem(List=pt_2, Index=2, Wrap=False)
item_4 = ListItem(List=pt_2, Index=3, Wrap=False)
pt_3 = Point(item_4)
pt_4 = Point(item)
ln = Line(StartPoint=pt_3, EndPoint=pt_4)
pt_5 = Point(item_2)
ln_2 = Line(StartPoint=pt_4, EndPoint=pt_5)
pt_6 = Point(item_3)
ln_3 = Line(StartPoint=pt_6, EndPoint=pt_3)
ln_4 = Line(StartPoint=pt_5, EndPoint=pt_6)
llx = LineLine(Line1=ln, Line2=ln_4)  # -> ParamA, ParamB, PointA, PointB
pt_7 = Point(llx.PointA)
llx_2 = LineLine(Line1=ln_2, Line2=ln_3)  # -> ParamA, ParamB, PointA, PointB
pt_8 = Point(llx_2.PointA)
vec2pt = Vector2Pt(PointA=pt_8, PointB=pt_7, Unitize=False)  # -> Vector, Length
line = LineSDL(Start=pt_3, Direction=vec2pt.Vector, Length=1)
llx_3 = LineLine(Line1=ln_2, Line2=line)  # -> ParamA, ParamB, PointA, PointB
pt_9 = Point(llx_3.PointA)
ln_5 = Line(StartPoint=pt_3, EndPoint=pt_9)
divide = DivideCurve(Curve=ln_5, Count=subtraction_2, Kinks=False)  # -> Points, Tangents, Parameters
ln_6 = Line(StartPoint=pt_8, EndPoint=divide.Points)
llx_4 = LineLine(Line1=ln_4, Line2=line)  # -> ParamA, ParamB, PointA, PointB
pt_10 = Point(llx_4.PointA)
ln_7 = Line(StartPoint=pt_3, EndPoint=pt_10)
divide_2 = DivideCurve(Curve=ln_7, Count=subtraction, Kinks=False)  # -> Points, Tangents, Parameters
ln_8 = Line(StartPoint=pt_7, EndPoint=divide_2.Points)
ln_9 = Line(StartPoint=pt_8, EndPoint=pt_7)

# ---- group: x
line_2 = Line(ln_8)

# ---- group: y
line_3 = Line(ln_6)

# ----
graft = GraftTree(Tree=ln_6, IncludeEmptyLists=True, IncludeNullItems=True)
llx_5 = LineLine(Line1=line_2, Line2=graft)  # -> ParamA, ParamB, PointA, PointB

# ---- group: keystoned grid pts
pt_11 = Point(llx_5.PointA)

# ----
pt_12 = ClusterOutput(pt_11)

# ==== cluster TextFormating
txt = ClusterInput()
txt_2 = Text(txt)

# ---- group: 'Enter'
panel = Panel("")

# ----
split = TextSplit(Text=txt_2, Separators=panel)
lng = ListLength(List=split)
addition = Addition(A=lng, B=1)
division = Division(A=addition, B=2)
series = Series(Start=0, Step=2, Count=division)
item = ListItem(List=split, Index=series, Wrap=False)
pshift = ShiftPaths(Data=item, Offset=1)
graft = GraftTree(Tree=pshift, IncludeEmptyLists=True, IncludeNullItems=True)
split_2 = TextSplit(Text=graft, Separators=",")
pshift_2 = ShiftPaths(Data=split_2, Offset=-2)
txt_3 = Text(pshift_2)
txt_4 = ClusterOutput(txt_3)

# ==== cluster ReplacingItemID
int = ClusterInput()
int_2 = ClusterInput()
int_3 = ClusterInput()
int_4 = ClusterInput()
int_5 = ClusterInput()
int_6 = ClusterInput()

# ---- group: gridExtent_y_i
int_7 = Integer(int)

# ---- group: gridExtent_y_s
int_8 = Integer(int_2)

# ---- group: gridExtent_x_s
int_9 = Integer(int_3)

# ---- group: gridExtent_x_i
int_10 = Integer(int_4)

# ---- group: gridExtent_y
int_11 = Integer(int_5)

# ---- group: gridExtent_x
int_12 = Integer(int_6)

# ---- group: adding y
series = Series(Start=0, Step=1, Count=int_7)
int_13 = Integer(series)
graft = GraftTree(Tree=int_13, IncludeEmptyLists=True, IncludeNullItems=True)
repeat = RepeatData(Data=graft, Length=int_10)
pshift = ShiftPaths(Data=repeat, Offset=-2)
addition = Addition(A=int_8, B=pshift)
multiplication = Multiplication(A=addition, B=int_12)

# ---- group: adding x
multiplication_2 = Multiplication(A=int_10, B=int_7)
series_2 = Series(Start=0, Step=1, Count=multiplication_2)
int_14 = Integer(series_2)
mod = Modulus(A=int_14, B=int_10)
addition_2 = Addition(A=int_9, B=mod)

# ----
addition_3 = Addition(A=multiplication, B=addition_2)

# ---- group: item replacing ID
int_15 = Integer(addition_3)

# ----
int_16 = ClusterOutput(int_15)

# ==== cluster ModuleCenter_2
pt = ClusterInput()
int = ClusterInput()
num = ClusterInput()
int_2 = ClusterInput()

# ---- group: y
int_3 = Integer(int)

# ---- group: x
int_4 = Integer(int_2)

# ---- group: cell size
num_2 = Number(num)

# ---- group: center
pt_2 = Point(pt)

# ----
pt_3 = ConstructPoint(XCoordinate=0, YCoordinate=0, ZCoordinate=0)  # disabled
addition = Addition(A=int_4, B=0.5)
vec2pt = Vector2Pt(PointA=pt_3, PointB=pt_2, Unitize=False)  # -> Vector, Length; disabled
addition_2 = Addition(A=int_3, B=0.5)
multiplication = Multiplication(A=addition, B=num_2)
move = Move(Motion=vec2pt.Vector)  # -> Geometry, Transform; disabled
lng = ListLength(List=int_4)  # disabled
multiplication_2 = Multiplication(A=addition_2, B=num_2)
X = UnitX(Factor=multiplication)
repeat = RepeatData(Data=move.Transform, Length=lng)  # disabled
neg = Negative(Value=multiplication_2)
move_2 = Move(Geometry=pt_2, Motion=X)  # -> Geometry, Transform
graft = GraftTree(Tree=move_2.Transform, IncludeEmptyLists=True, IncludeNullItems=True)  # disabled
Y = UnitY(Factor=neg)
pshift = ShiftPaths(Data=repeat, Offset=-1)  # disabled
move_3 = Move(Geometry=move_2.Geometry, Motion=Y)  # -> Geometry, Transform
graft_2 = GraftTree(Tree=move_3.Transform, IncludeEmptyLists=True, IncludeNullItems=True)  # disabled
comp = Compound(Transforms=[graft, graft_2])  # disabled
graft_3 = GraftTree(Tree=pshift, IncludeEmptyLists=True, IncludeNullItems=True)  # disabled
comp_2 = Compound(Transforms=[comp, graft_3])  # disabled

# ---- group: module center
pt_4 = Point(move_3.Geometry)

# ----
pshift_2 = ShiftPaths(Data=comp_2, Offset=-1)  # disabled
transform = Transform(pshift_2)  # disabled
pt_5 = ClusterOutput(pt_4)
transform_2 = ClusterOutput(transform)  # disabled

# ==== cluster GeoBottomCenter
geo = ClusterInput()
geo_2 = Geometry(geo)
bbox = BoundingBox(Content=geo_2, Plane=PlaneXY(0, 0, 0))  # -> Box, Box_2
box_corners = BoxCorners(Box=bbox.Box)  # -> CornerA, CornerB, CornerC, CornerD, CornerE, CornerF, CornerG, CornerH
pdecon = Deconstruct(Point=box_corners.CornerA)  # -> XComponent, YComponent, ZComponent
pdecon_2 = Deconstruct(Point=box_corners.CornerC)  # -> XComponent, YComponent, ZComponent
addition = Addition(A=pdecon.XComponent, B=pdecon_2.XComponent)
addition_2 = Addition(A=pdecon.YComponent, B=pdecon_2.YComponent)
division = Division(A=addition, B=2)
division_2 = Division(A=addition_2, B=2)
pt = ConstructPoint(XCoordinate=division, YCoordinate=division_2, ZCoordinate=pdecon.ZComponent)
pt_2 = Point(pt)
pt_3 = ClusterOutput(pt_2)
