# Grasshopper definition 161104_CityMatrix_HCU_Mix-use_16x16.gh (Grasshopper 0.9.76)
# plug-ins: Firefly.X, HDTReference

# ---- group: Int Grid X Extent
number_slider = Slider(16, range=1..20)

# ---- group: Int Grid Y Extent
number_slider_2 = Slider(16, range=1..20)

# ---- group: module meshes lego ref: -1
# Building Type Mesh
mesh = Mesh(<mesh referenced from the Rhino model>)

# ---- group: module meshes lego ref: 0 to 5
# Reference in the Building or Road
# geometry from Rhino. They will be
# instantiated/copied to the cell position
# where it has the same Type ID.
# 
# To simplify the data tree. The reference
# geometry should be single Mesh. You
# can paint different mesh with the set-up
# on the right, and join them together.
mesh_2 = Mesh([<mesh referenced from the Rhino model> x6])

# ----
# CityMatrix CV
path = FilePath("C:\Users\RYAN\Dropbox (MIT)\01_Work\MAS\06_Fall 2016\CityMatrix\01_Software\RH_GH\Map\CityMatrix_ML_Cam.PNG")
load_bitmap = LoadBitmap(FilePathToImageLocation=path)

# ----
# You need firefly plugin for this. It streams
# the Webcam footage from the CityMatrix
# Table. (It is now disabled and we are now
# using the text data fomat. )
# 
# Ideal setting (right click):
# 100ms
# 480px x 360px
video_stream = WebCamVideoStream()  # disabled

# ---- group: all color code quarts (no rotation)
panel = Panel("2,0,0,0\t2,1,0,0\t2,0,1,0\t2,0,0,1\t2,1,1,0\t2,1,0,1\t2,0,1,1\t2,1,1,1\t3,0,0,0\t3,1,0,0\t3,0,1,0\t3,0,0,1\t3,1,1,0\t3,1,0,1\t3,0,1,1\t3,1,1,1\t4,0,0,0\t4,1,0,0\t4,0,1,0\t4,0,0,1\t4,1,1,0\t4,1,0,1\t4,0,1,1\t4,1,1,1\t5,0,0,0\t5,1,0,0\t5,0,1,0\t5,0,0,1\t5,1,1,0\t5,1,0,1\t5,0,1,1\t5,1,1,1")

# ---- group: Pts Sample Grid Corner
pt = Point([<point referenced from the Rhino model> x4])

# ---- group: all color code quarts (with rotation)
# Decode Piece ID
panel_2 = Panel("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")

# ----
pline = PolyLine(Vertices=pt, Closed=False)

# ---- group: Sample White
# Reference Color
pt_2 = Point(<point referenced from the Rhino model>)

# ---- group: Sample Black
pt_3 = Point(<point referenced from the Rhino model>)

# ---- group: Sample Red
pt_4 = Point(<point referenced from the Rhino model>)

# ---- group: Sample Yellow
pt_5 = Point(<point referenced from the Rhino model>)  # disabled

# ---- group: Sample Blue
pt_6 = Point(<point referenced from the Rhino model>)  # disabled

# ---- group: Sample Green
# Grid Sampling
pt_7 = Point(<point referenced from the Rhino model>)  # disabled

# ---- group: gridExtent_y
int = Integer(number_slider_2)

# ----
preview = CustomPreview(Geometry=pline, Shader=ColourSwatch(SwatchColor=RGB(255, 0, 230)))

# ---- group: gridExtent_x
int_2 = Integer(number_slider)

# ---- group: mesh coloring
mesh_3 = Mesh(<mesh referenced from the Rhino model>)
res_color = ColourSwatch(SwatchColor=RGB(251, 255, 122))
sidewalk = ColourSwatch(SwatchColor=RGB(107, 107, 107))
res_gray = ColourSwatch(SwatchColor=RGB(227, 227, 227))
bikelane = ColourSwatch(SwatchColor=RGB(86, 135, 87))
off_gray = ColourSwatch(SwatchColor=RGB(171, 171, 171))
offcolor = ColourSwatch(SwatchColor=RGB(255, 122, 122))
parking = ColourSwatch(SwatchColor=RGB(196, 156, 100))
blank = ColourSwatch(SwatchColor=RGB(110, 110, 110))
road = ColourSwatch(SwatchColor=RGB(64, 64, 64))
park = ColourSwatch(SwatchColor=RGB(165, 201, 44))
# Everthing below this line is only for CityMatrix
# CV. You don't need to care about them unless
# you want to use the CityMatrix Table. Let me
# know if you need to use them. I will calibrate it
# for you. <ryanz@mit.edu>
text = ColourSwatch(SwatchColor=RGB(0, 0, 0))
res_warm = ColourSwatch(SwatchColor=RGB(255, 251, 230))
text_new = ColourSwatch(SwatchColor=RGB(64, 64, 64))
off_cold = ColourSwatch(SwatchColor=RGB(230, 242, 255))
mcol = MeshColours(Mesh=mesh_3, Colours=off_cold)
mesh_4 = Mesh(mcol)

# ----
multiplication = Multiplication(A=int, B=2)
multiplication_2 = Multiplication(A=int_2, B=2)
crv = Curve(<curve referenced from the Rhino model>)  # disabled
crv_2 = Curve(<curve referenced from the Rhino model>)  # disabled
crv_3 = Curve(<curve referenced from the Rhino model>)  # disabled
crv_4 = Curve(<curve referenced from the Rhino model>)
crv_5 = Curve(<curve referenced from the Rhino model>)
crv_6 = Curve(<curve referenced from the Rhino model>)
boundary = BoundarySurfaces(Edges=crv)  # disabled
boundary_2 = BoundarySurfaces(Edges=crv_3)  # disabled
boundary_3 = BoundarySurfaces(Edges=crv_2)  # disabled
boundary_4 = BoundarySurfaces(Edges=crv_4)
boundary_5 = BoundarySurfaces(Edges=crv_6)
boundary_6 = BoundarySurfaces(Edges=crv_5)

# ---- group: webcam stream
# You can feed a screen shot of the camera
# stream into the "webcam stream", when
# you don't have a CityMatrix table near
# you.
data = Data(load_bitmap)

# ----
perspective = Perspective(pt=pt, int_2=multiplication_2, int=multiplication)

# ---- group: tab
panel_3 = Panel("\t")

# ----
split = TextSplit(Text=panel_2, Separators=panel_3)
mesh_5 = MeshBrep(
    Brep=boundary,
    Settings={GridMaxCount=0, GridMinCount=16, JaggedSeams=False, MaxEdgeLength=0, MinEdgeLength=0.0001, MinTolerance=0, Refine=True, RefineAngle=0, RelativeTolerance=0.65, SimplePlanes=True, Tolerance=0})  # disabled
mesh_6 = MeshBrep(
    Brep=boundary_2,
    Settings={GridMaxCount=0, GridMinCount=16, JaggedSeams=False, MaxEdgeLength=0, MinEdgeLength=0.0001, MinTolerance=0, Refine=True, RefineAngle=0, RelativeTolerance=0.65, SimplePlanes=True, Tolerance=0})  # disabled
mesh_7 = MeshBrep(
    Brep=boundary_3,
    Settings={GridMaxCount=0, GridMinCount=16, JaggedSeams=False, MaxEdgeLength=0, MinEdgeLength=0.0001, MinTolerance=0, Refine=True, RefineAngle=0, RelativeTolerance=0.65, SimplePlanes=True, Tolerance=0})  # disabled
mesh_8 = MeshBrep(
    Brep=boundary_4,
    Settings={GridMaxCount=0, GridMinCount=16, JaggedSeams=False, MaxEdgeLength=0, MinEdgeLength=0.0001, MinTolerance=0, Refine=True, RefineAngle=0, RelativeTolerance=0.65, SimplePlanes=True, Tolerance=0})
mesh_9 = MeshBrep(
    Brep=boundary_5,
    Settings={GridMaxCount=0, GridMinCount=16, JaggedSeams=False, MaxEdgeLength=0, MinEdgeLength=0.0001, MinTolerance=0, Refine=True, RefineAngle=0, RelativeTolerance=0.65, SimplePlanes=True, Tolerance=0})
mesh_10 = MeshBrep(
    Brep=boundary_6,
    Settings={GridMaxCount=0, GridMinCount=16, JaggedSeams=False, MaxEdgeLength=0, MinEdgeLength=0.0001, MinTolerance=0, Refine=True, RefineAngle=0, RelativeTolerance=0.65, SimplePlanes=True, Tolerance=0})

# ---- group: CityMatrix CV Calibration
mesh_11 = MeshFromImage(Bmp=data, Sx=Domain(0, 1), Sy=Domain(0, 1), Z=0, C=True)

# ---- group: all color quarts data
txt = Text(split)

# ----
lng = ListLength(List=txt)

# ---- group: webcam stream
bmp = BitmapToModify(data)

# ---- group: x
series = Series(Start=0, Step=1, Count=int_2)

# ---- group: y
series_2 = Series(Start=0, Step=1, Count=int)

# ----
division = Division(A=lng, B="4")

# ---- group: webcam stream
bmp_2 = BitmapToModify(data)

# ----
col = Colour()  # disabled
col_2 = Colour()  # disabled
col_3 = Colour()  # disabled
col_4 = Colour()
col_5 = Colour()
col_6 = Colour()
panel_4 = Panel(txt)
mcol_2 = MeshColours(Mesh=mesh_5, Colours=col)  # disabled
mcol_3 = MeshColours(Mesh=mesh_6, Colours=col_3)  # disabled
mcol_4 = MeshColours(Mesh=mesh_7, Colours=col_2)  # disabled
multiplication_3 = Multiplication(A=series_2, B=4)
mcol_5 = MeshColours(Mesh=mesh_8, Colours=col_4)
mcol_6 = MeshColours(Mesh=mesh_9, Colours=col_6)
mcol_7 = MeshColours(Mesh=mesh_10, Colours=col_5)
series_3 = Series(Start=0, Step=1, Count=division)
multiplication_4 = Multiplication(A=series, B=2)

# ---- group: keystoned grid pts
pt_8 = Point(perspective)

# ----
pshift = ShiftPaths(Data=series_3, Offset=-1)
multiplication_5 = Multiplication(A=division, B="4")
multiplication_6 = Multiplication(A=multiplication_3, B=int_2)
preview_2 = CustomPreview(
    Geometry=mcol_2,
    Shader={ambient=RGB(0, 0, 0), diffuse=RGB(255, 105, 180), emission=RGB(76, 32, 54), shine=0.5, specular=RGB(255, 255, 255), transparency=0})  # disabled
preview_3 = CustomPreview(
    Geometry=mcol_3,
    Shader={ambient=RGB(0, 0, 0), diffuse=RGB(255, 105, 180), emission=RGB(76, 32, 54), shine=0.5, specular=RGB(255, 255, 255), transparency=0})  # disabled
preview_4 = CustomPreview(
    Geometry=mcol_4,
    Shader={ambient=RGB(0, 0, 0), diffuse=RGB(255, 105, 180), emission=RGB(76, 32, 54), shine=0.5, specular=RGB(255, 255, 255), transparency=0})  # disabled
preview_5 = CustomPreview(
    Geometry=mcol_5,
    Shader={ambient=RGB(0, 0, 0), diffuse=RGB(255, 105, 180), emission=RGB(76, 32, 54), shine=0.5, specular=RGB(255, 255, 255), transparency=0})
preview_6 = CustomPreview(
    Geometry=mcol_6,
    Shader={ambient=RGB(0, 0, 0), diffuse=RGB(255, 105, 180), emission=RGB(76, 32, 54), shine=0.5, specular=RGB(255, 255, 255), transparency=0})
pshift_2 = ShiftPaths(Data=pt_8, Offset=-1)

# ---- group: all sample pts
pt_9 = Point(pshift_2)

# ----
preview_7 = CustomPreview(
    Geometry=mcol_7,
    Shader={ambient=RGB(0, 0, 0), diffuse=RGB(255, 105, 180), emission=RGB(76, 32, 54), shine=0.5, specular=RGB(255, 255, 255), transparency=0})

panel_5 = Panel("""-1,-1,-1,-1,-1,-1,-1,-1,-1,-1,-1,-1,-1,-1,-1,-1,-1,-1,-1,-1
-1,-1,-1,-1,-1,6,4,4,9,6,6,6,-1,-1,-1,-1,-1,-1,-1,-1
4,-1,-1,-1,-1,-1,4,-1,1,1,1,-1,-1,-1,-1,-1,-1,1,-1,1
1,1,1,1,1,-1,4,-1,-1,-1,-1,1,-1,-1,-1,-1,-1,-1,-1,-1
1,1,2,1,1,-1,4,-1,4,8,8,1,1,1,1,1,1,1,1,1,1
1,1,1,3,1,4,6,1,-1,8,6,1,1,4,4,4,4,1,1,-1
-1,-1,-1,1,1,4,6,-1,-1,4,4,-1,-1,4,1,9,9,-1,4,4
4,4,4,4,1,1,-1,1,-1,-1,-1,-1,6,1,1,9,9,4,-1,-1
5,-1,1,1,-1,1,1,1,1,1,1,1,6,1,1,1,-1,6,6,-1
6,4,1,1,-1,1,2,1,1,1,1,9,9,6,1,1,-1,6,6,-1
-1,-1,1,1,1,1,1,1,3,1,1,4,4,1,1,-1,-1,6,-1,-1
4,-1,1,1,1,1,1,1,1,1,1,1,1,1,1,1,-1,6,-1,-1
6,-1,-1,-1,-1,1,1,1,-1,1,1,-1,-1,-1,4,4,6,8,-1,-1
-1,-1,-1,-1,-1,8,4,-1,-1,-1,-1,-1,-1,-1,4,4,8,8,6,-1
-1,-1,-1,-1,-1,6,4,-1,-1,-1,-1,-1,6,4,4,8,8,8,8
-1,-1,-1,-1,-1,-1,-1,-1,-1,-1,-1,-1,-1,-1,-1,-1,-1,-1,-1,-1
-1,-1,-1,-1,-1,-1,-1,-1,-1,-1,-1,-1,-1,-1,-1,-1,-1,-1,-1,-1
-1,-1,-1,-1,-1,-1,-1,-1,-1,-1,-1,-1,-1,-1,-1,-1,-1,-1,-1,-1
-1,-1,-1,-1,-1,-1,-1,-1,-1,-1,-1,-1,-1,-1,-1,-1,-1,-1,-1,-1
-1,-1,-1,-1,-1,-1,-1,-1,-1,-1,-1,-1,-1,-1,4,6,-1,-1,-1,-1""")

box = CenterBox(Base=pt_9, X=0.003, Y=0.003, Z=0.003)
repeat = RepeatData(Data=pshift, Length=multiplication_5)
addition = Addition(A=multiplication_4, B=graft(multiplication_6))
merge = Merge(Data1=col_5, Data2=col_4, Data3=col_6, Data4=col_2, Data5=col, Data6=col_3)

# ----
# Defining the floor number for each
# building type.
_4_commed = Slider(6, range=1..25)
_1_resmed = Slider(9, range=1..25)
_3_comhq = Slider(3, range=1..25)
# Building Heights
_0_reslux = Slider(1, range=1..25)
_2_resmu = Slider(12, range=1..25)
_5_rescw = Slider(15, range=1..25)

pshift_3 = ShiftPaths(Data=repeat, Offset=-1)

# ---- group: all color quart ids
int_3 = Integer(pshift_3)

# ---- group: all sample color
col_7 = Colour()

# ---- group: all sample boxes
box_2 = Box(box)

# ---- group: all piece ids
int_4 = Integer([0, 6, 2, 2, 2, 2, 6, 1, 1, 1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])

# ----
txt_2 = Text(int_4)
pshift_4 = ShiftPaths(Data=addition, Offset=-1)
join = TextJoin(Text=txt_2, Join=",")
multiplication_7 = Multiplication(A=int_2, B=2)
panel_6 = Panel(int_3)

# ---- group: all ref colors
col_8 = Colour([RGB(198, 184, 140), RGB(96, 87, 65), RGB(153, 81, 42)])

# ----
addition_2 = Addition(A=pshift_4, B=multiplication_7)
addition_3 = Addition(A=pshift_4, B=1)
int_5 = Integer(_5_rescw)

# ---- group: all perfect colors
# Closest Color Code
col_9 = Colour([ColourSwatch(SwatchColor=RGB(255, 255, 255)), ColourSwatch(SwatchColor=RGB(0, 0, 0)), ColourSwatch(SwatchColor=RGB(255, 0, 0))])

# ----
int_6 = Integer(_4_commed)
int_7 = Integer(_2_resmu)
int_8 = Integer(_3_comhq)
int_9 = Integer(_1_resmed)
int_10 = Integer(_0_reslux)
path_2 = FilePath()
merge_2 = Merge(Data1=int_10, Data2=int_9, Data3=int_7, Data4=int_8, Data5=int_6, Data6=int_5)
addition_4 = Addition(A=addition_2, B=1)
video_player = VideoPlayer()
textformating = TextFormating(txt=panel_5)
dist = Distance(PointA=graft(col_7), PointB=col_8)

# ---- group: floor height
panel_7 = Panel("3.5")

# ---- group: floor num for each type
int_11 = Integer(merge_2)

# ----
multiplication_8 = Multiplication(A=int_11, B=panel_7)
lng_2 = ListLength(List=dist)
series_4 = Series(Start=0, Step=1, Count=lng_2)

# ---- group: all module piece ids - from Text Data
int_12 = Integer(textformating)

# ----
int_13 = Integer(series_4)

# ---- group: building height for each type
# CityMatrix
# 
# "Ryan" Yan Zhang <ryanz@mit.edu>
# MIT Media Lab, Changing Place Group
# September. 2016
# Here you choose to use Text Data that you
# can edit or CityMatrix CV.
# 
# For Text Data, simple edit the text panel on
# the left (arrow 1), by change the ID in each
# slot, you change what building module to
# copy to the stage. Currently, ID -1 is blank,
# ID 0 to 5 are 6 different building type.
# 
# For CityMatrix CV, rewire this (arrow 2) and
# enable the video stream (arrow 3). Contact
# me for using and calibrating the physical
# CityMatrix table. <ryanz@mit.edu>
num = Number(multiplication_8)

# ---- group: x
# 16x16
int_14 = Integer([0, 1, 2, 3, 4, 5, 6, 7, 8, 9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])

# ---- group: y
# 16x16
int_15 = Integer([0, 0, 0, 0, 0, 0, 0, 0, 0, 0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])

# ---- group: rotation
# 16x16
int_16 = Integer([0, 0, 0, 0, 0, 0, 0, 0, 0, 0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])

# ----
sort = SortList(Keys=dist, ValuesA=int_13)  # -> Keys, ValuesA

# ---- group: sample pts
item = ListItem(List=pt_9, Index=addition_2, Wrap=False)
item_2 = ListItem(List=pt_9, Index=pshift_4, Wrap=False)
item_3 = ListItem(List=pt_9, Index=addition_4, Wrap=False)
item_4 = ListItem(List=pt_9, Index=addition_3, Wrap=False)

# ----
addition_5 = Addition(A=item_2, B=item_3)

panel_8 = Panel("""5,6,2,2,2,2,6,1,1,1,1,6,1,1,1,1
6,6,6,6,6,6,6,6,6,6,6,6,6,6,6,6
2,6,5,5,5,5,6,4,7,7,4,6,1,1,1,1
2,6,5,-1,-1,5,6,4,-1,-1,4,6,1,-1,-1,1
2,6,5,-1,-1,5,6,4,-1,-1,4,6,1,-1,-1,1
2,6,5,5,5,5,6,4,4,4,4,6,1,1,1,1
6,6,6,7,6,6,6,6,6,6,6,6,6,6,6,6
2,6,2,2,2,2,6,3,3,3,3,6,3,3,3,3
2,6,2,-1,-1,2,6,3,-1,-1,3,6,3,-1,-1,3
2,6,2,-1,-1,2,6,3,-1,-1,3,6,3,-1,-1,3
2,6,2,2,2,2,6,3,3,3,3,6,3,3,3,3
6,6,6,6,6,6,6,6,6,6,6,6,6,6,6,6
0,6,0,0,0,0,6,0,0,0,0,6,0,0,0,0
0,6,0,-1,-1,0,6,0,-1,-1,0,6,0,-1,-1,0
0,6,0,-1,-1,0,6,0,-1,-1,0,6,0,-1,-1,0
0,6,0,0,0,0,6,0,0,0,0,6,0,0,0,3""")

item_5 = ListItem(List=sort.ValuesA, Index=0, Wrap=False)
division_2 = Division(A=addition_5, B=2)

# ---- group: quart mid pts
pt_10 = Point(division_2)

# ----
pshift_5 = ShiftPaths(Data=item_5, Offset=-1)

# ---- group: x
# 20x20
int_17 = Integer([0, 1, 2, 3, 4, 5, 6, 7, 8, 9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])

# ---- group: module id
int_18 = Integer(int_12)

# ---- group: y
# 20x20
int_19 = Integer([0, 0, 0, 0, 0, 0, 0, 0, 0, 0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])

# ---- group: rotation
# 20x20
int_20 = Integer([0, 0, 0, 0, 0, 0, 0, 0, 0, 0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])

# ----
pshift_6 = ShiftPaths(Data=pshift_5, Offset=-1)
panel_9 = Panel(int_18)
panel_10 = Panel(int_20)
panel_11 = Panel(int_19)
panel_12 = Panel(int_17)

# ---- group: color code of each smaple pt
int_21 = Integer(pshift_6)

# ----
item_6 = ListItem(List=col_8, Index=int_21, Wrap=False)
preview_8 = CustomPreview(Geometry=box_2, Shader=item_6)

# ---- group: color codes
item_7 = ListItem(List=int_21, Index=pshift_4, Wrap=False)
item_8 = ListItem(List=int_21, Index=addition_2, Wrap=False)
item_9 = ListItem(List=int_21, Index=addition_4, Wrap=False)
item_10 = ListItem(List=int_21, Index=addition_3, Wrap=False)

# ----
merge_3 = Merge(Data1=graft(item_7), Data2=graft(item_8), Data3=graft(item_9), Data4=graft(item_10))

# ---- group: color code quarts
int_22 = Integer(merge_3)

# ----
rev = ReverseList(List=int_22)
txt_3 = Text(rev)
join_2 = TextJoin(Text=txt_3, Join=",")
pshift_7 = ShiftPaths(Data=join_2, Offset=-1)

# ---- group: color code quart texts
txt_4 = Text(pshift_7)

# ----
keysearch = KeyValueSearch(Keys=txt, Values=int_3, Search=graft(txt_4))
nullrep = ReplaceNulls(Items=keysearch, Replacements="-1")  # -> Items, Count
pshift_8 = ShiftPaths(Data=nullrep.Items, Offset=-1)

# ---- group: all module piece ids
int_23 = Integer(pshift_8)

# ----
tag = TextTag3D(Location=pt_10, Text=int_23, Size=0.01, Justification=5)
panel_13 = Panel(int_23)

# ---- group: all module piece ids - from CityMatrix CV
int_24 = Integer(int_23)

# ----
# Radians of Building
number_slider_3 = Slider(2, range=0..30)

radians = Slider(20, range=20..40)
radians_scale = Slider(60, range=60..100)

int_25 = Integer(int_12)
panel_14 = Panel(int_25)
series_5 = Series(Start=1, Step=1, Count=9)  # -> graft(Series)
cluster = Cluster_3(A=int_25, B=series_5)
lng_3 = ListLength(List=cluster)  # -> flatten(Length)
item_11 = ListItem(List=lng_3, Index=[0, 1, 2], Wrap=True)
item_12 = ListItem(List=lng_3, Index=[3, 5, 7], Wrap=True)
item_13 = ListItem(List=lng_3, Index=[3, 5, 7], Wrap=True)
multiplication_9 = Multiplication(A=item_11, B=50)
panel_15 = Panel(multiplication_9)
multiplication_10 = Multiplication(A=item_12, B=50)
multiplication_11 = Multiplication(A=item_13, B=10)
item_14 = ListItem(List=multiplication_9, Index=0, Wrap=True)
item_15 = ListItem(List=multiplication_9, Index=1, Wrap=True)
item_16 = ListItem(List=multiplication_9, Index=2, Wrap=True)
item_17 = ListItem(List=multiplication_10, Index=0, Wrap=True)
item_18 = ListItem(List=multiplication_10, Index=1, Wrap=True)
item_19 = ListItem(List=multiplication_10, Index=2, Wrap=True)
item_20 = ListItem(List=multiplication_11, Index=0, Wrap=True)
item_21 = ListItem(List=multiplication_11, Index=1, Wrap=True)
item_22 = ListItem(List=multiplication_11, Index=2, Wrap=True)
int_26 = Integer(int_12)
int_27 = Integer(int_12)
dom = ConstructDomain(DomainStart=0, DomainEnd=3000)
lng_4 = ListLength(List=int_26)
dom_2 = ConstructDomain(DomainStart=0, DomainEnd=1000)
dom_3 = ConstructDomain(DomainStart=0, DomainEnd=300)
dom_4 = ConstructDomain(DomainStart=0, DomainEnd=2000)
lng_5 = ListLength(List=int_27)
dom_5 = ConstructDomain(DomainStart=0, DomainEnd=5000)
dom_6 = ConstructDomain(DomainStart=0, DomainEnd=2000)
panel_16 = Panel(item_14)
panel_17 = Panel(item_15)
addition_6 = Addition(A=item_20, B=item_17)
addition_7 = Addition(A=item_21, B=item_18)
addition_8 = Addition(A=item_22, B=item_19)
panel_18 = Panel(item_16)
series_6 = Series(Start=0, Step=1, Count=lng_4)
equals = Equality(FirstNumber=int_26, SecondNumber=Slider(7, range=0..10))  # -> Equality, Inequality
series_7 = Series(Start=0, Step=1, Count=lng_5)
equals_2 = Equality(FirstNumber=int_27, SecondNumber=Slider(7, range=0..10))  # -> Equality, Inequality
dom_7 = ConstructDomain(DomainStart=1, DomainEnd=10)

# ---- group: gridExtent_x
int_28 = Integer(int_2)

# ---- group: shrink
cell_shrink = Slider(0.98, range=0.75..1)

# ---- group: toggle1
bool = Boolean(False)

# ---- group: gridExtent_y
int_29 = Integer(int)

# ---- group: rotation
int_30 = Integer(int_20)

# ---- group: module id
int_31 = Integer(int_18)

# ---- group: y
int_32 = Integer(int_19)

# ---- group: x
int_33 = Integer(int_17)

# ---- group: colortizer orgin
# LEGO Grid System
pt_11 = Point(<point referenced from the Rhino model>)

# ---- group: table size ref pt
pt_12 = Point(<point referenced from the Rhino model>)

# ----
panel_19 = Panel(addition_6)
panel_20 = Panel(addition_7)
panel_21 = Panel(addition_8)
dispatch = Dispatch(List=series_6, DispatchPattern=equals.Equality)  # -> ListA, ListB
dispatch_2 = Dispatch(List=series_7, DispatchPattern=equals_2.Equality)  # -> ListA, ListB
remap = RemapNumbers(Value=item_14, Source=dom_5, Target=dom_7)  # -> Mapped, Clipped
remap_2 = RemapNumbers(Value=item_15, Source=dom_6, Target=dom_7)  # -> Mapped, Clipped
remap_3 = RemapNumbers(Value=item_16, Source=dom_3, Target=dom_7)  # -> Mapped, Clipped
remap_4 = RemapNumbers(Value=addition_6, Source=dom, Target=dom_7)  # -> Mapped, Clipped
remap_5 = RemapNumbers(Value=addition_7, Source=dom_4, Target=dom_7)  # -> Mapped, Clipped
remap_6 = RemapNumbers(Value=addition_8, Source=dom_2, Target=dom_7)  # -> Mapped, Clipped
Z = UnitZ(Factor=20)
panel_22 = Panel("C:\Users\RYAN\Dropbox (MIT)\01_Work\MAS\06_Fall 2016\CityMatrix\01_Software\RH_GH\Map\HAMBURG RS 1600pxl.jpg")

# ----
# Google Map @ Lego
show_google_map = BooleanToggle(False)

xy = XYPlane(Origin=pt_11)
dist_2 = Distance(PointA=pt_11, PointB=pt_12)
timer = Timer(TimerInterval=500, Target=division_3)  # disabled
division_3 = Division(A=dist_2, B=int_28)
movetoorgin = MoveToOrgin(G=mesh, num=cell_shrink)
movetoorgin_2 = MoveToOrgin(G=mesh_2, num=cell_shrink)

# ----
# Scale Radar
# Window Size
# Window Position
# Background color
number_slider_4 = Slider(331, range=0..1000)
number_slider_5 = Slider(92, range=0..1000)
panel_23 = Panel([remap.Mapped, remap_2.Mapped, remap_3.Mapped, remap_4.Mapped, remap_5.Mapped, remap_6.Mapped])
panel_24 = Panel([remap.Mapped, remap_2.Mapped, remap_3.Mapped, remap_4.Mapped, remap_5.Mapped, remap_6.Mapped])
panel_25 = Panel([remap.Mapped, remap_2.Mapped, remap_3.Mapped, remap_4.Mapped, remap_5.Mapped, remap_6.Mapped])
panel_26 = Panel("""Res. Low
Res. Middle
Res. High
Job qualitiy Low
Job qualitiy Medium
Job qualitiy High""")
panel_27 = Panel([panel_25, panel_24, panel_23])
col_10 = Colour(graft([ColourSwatch(SwatchColor=RGBA(255, 0, 103, 237)), ColourSwatch(SwatchColor=RGBA(255, 141, 103, 237)), ColourSwatch(SwatchColor=RGBA(253, 0, 244, 237))]))
cluster_2 = Cluster_2(
    N=panel_27,
    R_2=number_slider_5,
    sc=col_10,
    R=number_slider_5,
    L=panel_27,
    C=col_10,
    L_3=panel_26,
    A=number_slider_5,
    B=number_slider_5,
    T=panel_26,
    A_3=number_slider_5,
    A_2=number_slider_4,
    L_2=panel_27,
    R_3=number_slider_5,
    S=Toggle(True),
    W=number_slider_4,
    H=number_slider_4,
    X=Slider(11, range=0..1000),
    Y=Slider(108, range=0..1000),
    bg=ColourSwatch(SwatchColor=RGB(0, 0, 0)))

# ---- group: base cplane
pln = Plane(xy)

# ----
planesrf = PlaneSurface(Plane=pln, XSize=Domain(0, 1000), YSize=Domain(-1000, 0))
move = Move(Geometry=planesrf, Motion=Z)  # -> Geometry, Transform
filter = StreamFilter(Gate=show_google_map, Stream1=move.Geometry)

# ---- group: cell size
num_2 = Number(division_3)

# ----
modulecenter = ModuleCenter(pt=pt_11, num=num_2, int_2=int_33, int=int_32)  # -> pt_5, transform_2
merge_4 = Merge(Data1=Slider(1, range=0..10), Data2=Slider(2, range=0..10), Data3=Slider(3, range=0..10))  # -> graft(Result)
merge_5 = Merge(Data1=Slider(0, range=0..1), Data2=Slider(0.5, range=0..1), Data3=Slider(1, range=0..1))  # -> graft(Result)
int_34 = Integer(int_12)
data_2 = Data(merge_4)
data_3 = Data(merge_5)
data_4 = Data(int_34)

int_35 = Integer(int_12)
equals_3 = Equality(FirstNumber=int_35, SecondNumber=-1)  # -> Equality, Inequality
# Here's the code for the abstract point
# color example I shown in the class.
# It's a very good starting point to build
# your own logic without worring about
# the output part too much.
# 
# Currently, move arround the 2 reference
# points will change the heatmap.
# 
# Mind that the x,y coordinate is from
# 0 to 15, so it is pretty small. Zoom in to
# see the points, or you can use Camera
# "HeatMapPts" saved for you.
lng_6 = ListLength(List=int_35)
series_8 = Series(Start=0, Step=1, Count=lng_6)
pt_13 = Point(modulecenter.pt_5)
dispatch_3 = Dispatch(List=series_8, DispatchPattern=equals_3.Inequality)  # -> ListA, ListB
item_23 = ListItem(List=pt_13, Index=dispatch_3.ListA, Wrap=True)
cps = ClosestPoints(Point=graft(item_23), Cloud=item_23, Count=Slider(18, range=0..200))  # -> ClosestPoint, CPIndex, Distance
item_24 = ListItem(List=int_35, Index=cps.CPIndex, Wrap=True)
sort_2 = SortList(Keys=item_24)  # -> Keys, ValuesA
dcon = DeleteConsecutive(Set=sort_2.Keys, Wrap=False)  # -> Set, Count
lng_7 = ListLength(List=dcon.Set)
division_4 = Division(A=lng_7, B=Slider(7, range=0..10))  # -> flatten(Result)
sort_3 = SortList(Keys=division_4)  # -> Keys, ValuesA
bnd = Bounds(Numbers=sort_3.Keys)
dom_8 = ConstructDomain(DomainStart=0, DomainEnd=1)
remap_7 = RemapNumbers(Value=division_4, Source=bnd, Target=dom_8)  # -> Mapped, Clipped
dom_9 = ConstructDomain(DomainStart="30", DomainEnd=expr("-x", "30"))
gradient = Gradient(
    LowerLimit=0,
    UpperLimit=1,
    Parameter=remap_7.Mapped,
    stops=[0: RGB(255, 0, 0), 0.5: RGB(255, 255, 0), 1: RGB(0, 128, 0)])
rectangle = Rectangle(Plane=item_23, XSize=dom_9, YSize=dom_9, Radius=0)  # -> Rectangle, Length
boundary_7 = BoundarySurfaces(Edges=rectangle.Rectangle)

low_10 = Slider(4, range=0..10)
low_50 = Slider(5, range=0..10)
mid_10 = Slider(6, range=0..10)
mid_50 = Slider(7, range=0..10)
high_10 = Slider(8, range=0..10)
high = Slider(9, range=0..10)
modulecenter_2 = ModuleCenter(pt=pt_11, num=num_2, int_2=int_33, int=int_32)  # -> pt_5, transform_2
merge_6 = Merge(Data1=low_10, Data2=low_50, Data3=mid_10, Data4=mid_50, Data5=high_10, Data6=high)  # -> graft(Result)
int_36 = Integer(int_12)
merge_7 = Merge(Data1=Slider(0, range=0..1), Data2=Slider(0.5, range=0..1), Data3=Slider(1, range=0..1))  # -> graft(Result)
data_5 = Data(merge_6)
data_6 = Data(merge_7)
data_7 = Data(int_36)

int_37 = Integer(int_12)
data_8 = Data(int_37)
series_9 = Series(Start=1, Step=1, Count=9)  # -> graft(Series)
lng_8 = ListLength(List=modulecenter.pt_5)
equals_4 = Equality(FirstNumber=data_8, SecondNumber=series_9)  # -> Equality, Inequality
series_10 = Series(Start=0, Step=1, Count=lng_8)
dispatch_4 = Dispatch(List=series_10, DispatchPattern=equals_4.Equality)  # -> ListA, ListB
pt_14 = Point(modulecenter.pt_5)
item_25 = ListItem(List=pt_14, Index=dispatch_4.ListA, Wrap=True)

lng_9 = ListLength(List=item_25)
series_11 = Series(Start=0, Step=1, Count=9)
pshift_9 = ShiftPaths(Data=lng_9, Offset=-1)
merge_8 = Merge(Data1=Slider(10, range=0..50), Data2=Slider(50, range=0..50))
split_2 = SplitList(List=series_11, Index=3)  # -> ListA, ListB
dup = DuplicateData(Data=merge_8, Number=3, Order=True)
item_26 = ListItem(List=pshift_9, Index=split_2.ListA, Wrap=True)
item_27 = ListItem(List=pshift_9, Index=split_2.ListB, Wrap=True)
multiplication_12 = Multiplication(A=item_26, B=25)  # -> graft(Result)
multiplication_13 = Multiplication(A=item_27, B=dup)
partition = PartitionList(List=multiplication_13, Size=2)
ma = MassAddition(Input=partition)  # -> Result, PartialResults
subtraction = Subtraction(A=multiplication_12, B=ma.Result)

panel_28 = Panel(multiplication_12)
# > 0 More People than  jobs created
# < 0 Less People than  jobs created
panel_29 = Panel(ma.Result)

sort_4 = SortList(Keys=flatten(subtraction))  # -> Keys, ValuesA
item_28 = ListItem(List=sort_4.Keys, Index=[0, 2], Wrap=True)
dispatch_5 = Dispatch(List=item_28, DispatchPattern=[True, False])  # -> ListA, ListB
dom_10 = ConstructDomain(DomainStart=dispatch_5.ListA, DomainEnd=dispatch_5.ListB)
remap_8 = RemapNumbers(Value=flatten(subtraction), Source=dom_10, Target=Domain(0, 1))  # -> Mapped, Clipped
dup_2 = DuplicateData(Data=remap_8.Mapped, Number=2, Order=False)

preview_9 = CustomPreview(Geometry=boundary_7, Shader=gradient)
panel_30 = Panel(dup_2)
modulecenter_3 = ModuleCenter(pt=pt_11, num=num_2, int_2=int_33, int=int_32)  # -> pt_5, transform_2
pt_15 = Point(modulecenter_3.pt_5)
pt_16 = Point(modulecenter_3.pt_5)
cull_i = CullIndex(List=pt_15, Indices=dispatch.ListA, Wrap=True)
item_29 = ListItem(List=pt_15, Index=dispatch.ListA, Wrap=True)
item_30 = ListItem(List=pt_16, Index=dispatch_2.ListA, Wrap=True)
cps_2 = ClosestPoints(Point=item_30, Cloud=pt_16, Count=Slider(1, range=0..20))  # -> ClosestPoint, CPIndex, Distance
data_9 = Data(item_29)
data_10 = Data(cull_i)
dist_3 = Distance(PointA=item_30, PointB=cps_2.ClosestPoint)  # -> simplify(Distance)
dist_4 = Distance(PointA=graft(data_10), PointB=data_9)
series_12 = Series(Start=0, Step=1, Count=10)
previewmat = CustomPreviewMaterials(Geometry=filter, DiffuseColor=ColourSwatch(SwatchColor=RGB(255, 255, 255)), Transparency="0.0", DiffuseBitmap=panel_22)

# ---- group: module meshes lego at orgin
mesh_12 = Mesh(movetoorgin_2)

mesh_13 = Mesh(movetoorgin)

# ---- group: module center
pt_17 = Point(modulecenter_3.pt_5)

# ----
bnd_2 = Bounds(Numbers=dist_4)
lng_10 = ListLength(List=flatten(dist_3))
dedomain = DeconstructDomain(Domain=bnd_2)  # -> Start, End
larger = LargerThan(FirstNumber=int_31, SecondNumber="0")  # -> LargerThan, OrEqualTo
smaller = SmallerThan(FirstNumber=int_31, SecondNumber="5")  # -> SmallerThan, OrEqualTo
dom_11 = ConstructDomain(DomainStart=Slider(1, range=0..20), DomainEnd=Slider(0, range=0..20))
item_31 = ListItem(List=dedomain.Start, Index=0, Wrap=True)
sort_5 = SortList(ValuesA=dist_3)  # -> Keys, ValuesA
and = GateAnd(A=larger.OrEqualTo, B=smaller.OrEqualTo)
remap_9 = RemapNumbers(Value=dist_3, Source=Domain(0, 1), Target=dom_11)  # -> Mapped, Clipped
dispatch_6 = Dispatch(List=int_31, DispatchPattern=and)  # -> ListA, ListB
division_5 = Division(A="50", B=item_31)  # -> flatten(Result)
smaller_2 = SmallerThan(FirstNumber=int_31, SecondNumber="0")  # -> SmallerThan, OrEqualTo
item_32 = ListItem(List=mesh_12, Index=graft(dispatch_6.ListA), Wrap=False)
gradient_2 = Gradient(
    LowerLimit=0,
    UpperLimit=1,
    Parameter=division_5,
    stops=[0: RGB(177, 72, 229), 0: RGB(117, 200, 62), 0: RGB(255, 0, 0), 0.495: RGB(255, 255, 0), 1: RGB(0, 128, 0)])
dispatch_7 = Dispatch(List=pt_17, DispatchPattern=smaller_2.SmallerThan)  # -> ListA, ListB
pshift_10 = ShiftPaths(Data=item_32, Offset=-1)
dispatch_8 = Dispatch(List=int_30, DispatchPattern=and)  # -> ListA, ListB
vec2pt = Vector2Pt(PointA=Point(0, 0, 0), PointB=dispatch_7.ListA, Unitize=False)  # -> Vector, Length
rotate = Rotate(Geometry=pshift_10, Angle=degrees(dispatch_8.ListA), Plane=PlaneXY(0, 0, 0))  # -> Geometry, Transform
dispatch_9 = Dispatch(List=pt_17, DispatchPattern=and)  # -> ListA, ListB
move_2 = Move(Geometry=mesh_13, Motion=vec2pt.Vector)  # -> Geometry, Transform
vec2pt_2 = Vector2Pt(PointA=Point(0, 0, 0), PointB=dispatch_9.ListA, Unitize=False)  # -> Vector, Length
preview_10 = CustomPreview(Geometry=flatten(pt_15), Shader=gradient_2)
move_3 = Move(Geometry=rotate.Geometry, Motion=vec2pt_2.Vector)  # -> Geometry, Transform
panel_31 = Panel(gradient_2)

# ---- group: building lego modules
mesh_14 = Mesh(move_3.Geometry)

# ---- group: blank
mesh_15 = Mesh(move_2.Geometry)

# ---- group: module center
pt_18 = Point(pt_17)

# ---- group: 3D building site move amount
# 3D City Grid System
panel_32 = Panel("10000")
X = UnitX(Factor=panel_32)

# ---- group: module id
int_38 = Integer(int_18)

# ----
com = ColourSwatch(SwatchColor=RGB(158, 158, 158))
com_2 = ColourSwatch(SwatchColor=RGB(71, 71, 71))
res = ColourSwatch(SwatchColor=RGB(212, 212, 212))
res_2 = ColourSwatch(SwatchColor=RGB(76, 76, 76))

# ---- group: blank
mesh_16 = Mesh(mesh_15)

# ----
larger_2 = LargerThan(FirstNumber=int_38, SecondNumber="0")  # -> LargerThan, OrEqualTo
smaller_3 = SmallerThan(FirstNumber=int_38, SecondNumber="5")  # -> SmallerThan, OrEqualTo

# ---- group: road mesh final!
mesh_17 = Mesh()

# ---- group: sidewalk mesh final!
mesh_18 = Mesh()

# ----
vec = Vector(X)
merge_9 = Merge(Data1=res, Data2=res, Data3=res, Data4=com, Data5=com, Data6=com)
merge_10 = Merge(Data1=res_2, Data2=res_2, Data3=res_2, Data4=com_2, Data5=com_2, Data6=com_2)
and_2 = GateAnd(A=larger_2.OrEqualTo, B=smaller_3.OrEqualTo)
merge_11 = Merge(Data1=merge_9, Data2=merge_10)

# ---- group: is building or not
bool_2 = Boolean(and_2)

# ---- group: cell size
num_3 = Number(division_3)

# ----
dispatch_10 = Dispatch(List=pt_18, DispatchPattern=bool_2)  # -> ListA, ListB
dispatch_11 = Dispatch(List=int_38, DispatchPattern=bool_2)  # -> ListA, ListB

# ---- group: color for each type
col_11 = Colour(merge_11)

# ----
division_6 = Division(A=num_3, B=2)

# ---- group: building center
pt_19 = Point(dispatch_10.ListA)

# ---- group: building id
int_39 = Integer(dispatch_11.ListA)

# ----
equals_5 = Equality(FirstNumber=int_39)  # -> Equality, Inequality
multiplication_14 = Multiplication(A=equals_5.Inequality, B=6)
move_4 = Move(Geometry=mesh_17, Motion=vec)  # -> Geometry, Transform
move_5 = Move(Geometry=mesh_18, Motion=vec)  # -> Geometry, Transform

# ---- group: base height
panel_33 = Panel("5.0")

# ----
move_6 = Move(Geometry=mesh_16, Motion=vec)  # -> Geometry, Transform
multiplication_15 = Multiplication(A=division_6, B=Slider(0.95, range=0..1))
addition_9 = Addition(A=int_39, B=multiplication_14)
neg = Negative(Value=multiplication_15)
filter_2 = StreamFilter(Gate=0, Stream0=addition_9, Stream1=int_39)
item_33 = ListItem(List=col_11, Index=graft(filter_2), Wrap=False)
pshift_11 = ShiftPaths(Data=item_33, Offset=-1)
dom_12 = ConstructDomain(DomainStart=neg, DomainEnd=multiplication_15)
panel_34 = Panel(num)

# ---- group: color for each building
col_12 = Colour(pshift_11)

# ----
item_34 = ListItem(List=panel_34, Index=graft(int_39), Wrap=False)
pshift_12 = ShiftPaths(Data=item_34, Offset=-1)

# ---- group: building height factor
number_slider_6 = Slider(3.1, range=0..10)

# ----
multiplication_16 = Multiplication(A=pshift_12, B=number_slider_6)

# ---- group: building height of each building
num_4 = Number(multiplication_16)

# ----
addition_10 = Addition(A=num_4, B=panel_33)
dom_13 = ConstructDomain(DomainStart=0, DomainEnd=addition_10)
box_3 = DomainBox(Base=pt_19, X=dom_12, Y=dom_12, Z=dom_13)
move_7 = Move(Geometry=box_3, Motion=vec)  # -> Geometry, Transform

# ---- group: building geo
box_4 = Box(move_7.Geometry)

# ---- group: 3D Buldings
preview_11 = CustomPreview(Geometry=box_4, Shader=col_12)

# ---- group: road
mesh_19 = Mesh(move_4.Geometry)

# ---- group: sidewalk
mesh_20 = Mesh(move_5.Geometry)

# ---- group: blank
mesh_21 = Mesh(move_6.Geometry)

# ----
# Density living
data_11 = Data(data_4)
data_12 = Data(data_3)
data_13 = Data(data_2)
pt_20 = Point(modulecenter.pt_5)
lng_11 = ListLength(List=data_11)
series_13 = Series(Start=0, Step=1, Count=lng_11)
equals_6 = Equality(FirstNumber=data_11, SecondNumber=data_13)  # -> Equality, Inequality
dispatch_12 = Dispatch(List=series_13, DispatchPattern=equals_6.Equality)  # -> ListA, ListB
item_35 = ListItem(List=pt_20, Index=dispatch_12.ListA, Wrap=True)
pshift_13 = ShiftPaths(Data=item_35, Offset=2)
cps_3 = ClosestPoints(Point=pshift_13, Cloud=pt_20, Count=number_slider_3)  # -> ClosestPoint, CPIndex, Distance
pshift_14 = ShiftPaths(Data=cps_3.ClosestPoint, Offset=-1)
cullpt = CullDuplicates(Points=pshift_14, Tolerance=0.01, CullMode=3)  # -> Points, Indices, Valence
pshift_15 = ShiftPaths(Data=cullpt.Points, Offset=-1)
bang = ExplodeTree(Data=pshift_15)  # -> Branch0, Branch1, Branch2
lng_12 = ListLength(List=pshift_15)
dup_3 = DuplicateData(Data=data_12, Number=lng_12, Order=True)
gradient_3 = Gradient(LowerLimit=0, UpperLimit=1, Parameter=dup_3, stops=[0: RGB(255, 158, 181), 1: RGB(255, 0, 47), 1: RGB(161, 0, 29)])

# ----
# {0} _ low
panel_35 = Panel("15")
Y = UnitY(Factor=panel_35)
X_2 = UnitX(Factor=panel_35)
move_8 = Move(Geometry=bang.Branch0, Motion=Y)  # -> Geometry, Transform
move_9 = Move(Geometry=move_8.Geometry, Motion=X_2)  # -> Geometry, Transform
pt_21 = Point(move_9.Geometry)

# ----
# {1} _ mid
panel_36 = Panel("15")
Y_2 = UnitY(Factor=panel_36)
X_3 = UnitX(Factor=panel_36)
move_10 = Move(Geometry=bang.Branch1, Motion=Y_2)  # -> Geometry, Transform
move_11 = Move(Geometry=move_10.Geometry, Motion=expr("-x", X_3))  # -> Geometry, Transform
pt_22 = Point(move_11.Geometry)

# ----
# {2} _ high
panel_37 = Panel("15")
Y_3 = UnitY(Factor=panel_37)
X_4 = UnitX(Factor=panel_37)
move_12 = Move(Geometry=bang.Branch2, Motion=expr("-x", Y_3))  # -> Geometry, Transform
move_13 = Move(Geometry=move_12.Geometry, Motion=X_4)  # -> Geometry, Transform
pt_23 = Point(move_13.Geometry)

# ----
# circle
panel_38 = Panel("10")
cir = Circle(Plane=[pt_23, pt_22, pt_21], Radius=panel_38)
boundary_8 = BoundarySurfaces(Edges=cir)

preview_12 = CustomPreview(Geometry=boundary_8, Shader=gradient_3)

# ----
# Density working
pt_24 = Point(modulecenter_2.pt_5)
data_14 = Data(data_6)
data_15 = Data(data_7)
data_16 = Data(data_5)
lng_13 = ListLength(List=data_15)
series_14 = Series(Start=0, Step=1, Count=lng_13)
equals_7 = Equality(FirstNumber=data_15, SecondNumber=data_16)  # -> Equality, Inequality
dispatch_13 = Dispatch(List=series_14, DispatchPattern=equals_7.Equality)  # -> ListA, ListB
item_36 = ListItem(List=pt_24, Index=dispatch_13.ListA, Wrap=True)
pshift_16 = ShiftPaths(Data=item_36, Offset=2)
lng_14 = ListLength(List=pshift_16)
dup_4 = DuplicateData(Data=data_14, Number=lng_14, Order=True)
gradient_4 = Gradient(LowerLimit=0, UpperLimit=1, Parameter=dup_4, stops=[0: RGB(215, 207, 255), 1: RGB(0, 0, 156)])

bang_2 = ExplodeTree(Data=pshift_16)  # -> Branch0, Branch1, Branch2, Branch3, Branch4, Branch5

# ----
# {0} _ low
pt_25 = Point(bang_2.Branch0)
pt_26 = Point(bang_2.Branch1)

# ----
# {1} _ mid
pt_27 = Point(bang_2.Branch2)
pt_28 = Point(bang_2.Branch3)

# ----
# {2} _ high
pt_29 = Point(bang_2.Branch5)
pt_30 = Point(bang_2.Branch4)

# ----
# {1} _ 10
# {1} _ 50
pt_31 = Point(pt_27)
pt_32 = Point(pt_28)

# ----
# {0} _ 10
# {0} _ 50
pt_33 = Point(pt_25)
pt_34 = Point(pt_26)

# ----
# {2} _ 10
# {2} _ 50
pt_35 = Point(pt_30)
pt_36 = Point(pt_29)

cluster_3 = Cluster(P=pt_33, R=radians)
cluster_4 = Cluster(P=pt_34, R=radians_scale)
cluster_5 = Cluster(P=pt_31, R=radians)
cluster_6 = Cluster(P=pt_35, R=radians)
cluster_7 = Cluster(P=pt_32, R=radians_scale)
cluster_8 = Cluster(P=pt_36, R=radians_scale)
flatten = FlattenTree(Tree=[cluster_3, cluster_4], Path="{0}")
flatten_2 = FlattenTree(Tree=[cluster_5, cluster_7], Path="{0}")
flatten_3 = FlattenTree(Tree=[cluster_6, cluster_8], Path="{0}")
path_mapper = PathMapper(flatten, source="{A}", target="{0}")
path_mapper_2 = PathMapper(flatten_3, source="{A}", target="{2}")
path_mapper_3 = PathMapper(flatten_2, source="{A}", target="{1}")
crv_7 = Curve([path_mapper, path_mapper_3, path_mapper_2])

preview_13 = CustomPreview(Geometry=crv_7, Shader=gradient_4)

gradient_5 = Gradient(LowerLimit=0, UpperLimit=1, Parameter=remap_8.Mapped, stops=[0: RGB(220, 0, 40), 1: RGB(255, 130, 160)])
gradient_6 = Gradient(LowerLimit=0, UpperLimit=1, Parameter=dup_2, stops=[0: RGB(128, 128, 237), 1: RGB(0, 0, 255)])
dom_14 = ConstructDomain(DomainStart="30", DomainEnd=expr("-x", "30"))
rectangle_2 = Rectangle(Plane=item_25, XSize=dom_14, YSize=dom_14, Radius=0)  # -> Rectangle, Length
merge_12 = Merge(Data1=gradient_5, Data2=gradient_6)  # -> flatten(Result)

deplane = DeconstructPlane(Plane=rectangle_2.Rectangle)  # -> Origin, XAxis, YAxis, ZAxis
scale = Scale(Geometry=rectangle_2.Rectangle, Center=deplane.Origin, Factor=Slider(0.8, range=0..1))  # -> Geometry, Transform

boundary_9 = BoundarySurfaces(Edges=scale.Geometry)

preview_14 = CustomPreview(Geometry=boundary_9, Shader=merge_12)

# ==== cluster ModuleCenter
pt = ClusterInput()
int = ClusterInput()
num = ClusterInput()
int_2 = ClusterInput()

# ---- group: y
int_3 = Integer(int)

# ---- group: cell size
num_2 = Number(num)

# ---- group: x
int_4 = Integer(int_2)

# ---- group: center
pt_2 = Point(pt)

# ----
pt_3 = ConstructPoint(XCoordinate=0, YCoordinate=0, ZCoordinate=0)  # disabled
addition = Addition(A=int_4, B=0.5)
vec2pt = Vector2Pt(PointA=pt_3, PointB=pt_2, Unitize=False)  # -> Vector, Length; disabled
addition_2 = Addition(A=int_3, B=0.5)
multiplication = Multiplication(A=addition, B=num_2)
move = Move(Motion=vec2pt.Vector)  # -> Geometry, Transform; disabled
lng = ListLength(List=int_4)  # disabled
multiplication_2 = Multiplication(A=addition_2, B=num_2)
X = UnitX(Factor=multiplication)
repeat = RepeatData(Data=move.Transform, Length=lng)  # disabled
neg = Negative(Value=multiplication_2)
move_2 = Move(Geometry=pt_2, Motion=X)  # -> Geometry, Transform
graft = GraftTree(Tree=move_2.Transform, IncludeEmptyLists=True, IncludeNullItems=True)  # disabled
Y = UnitY(Factor=neg)
pshift = ShiftPaths(Data=repeat, Offset=-1)  # disabled
move_3 = Move(Geometry=move_2.Geometry, Motion=Y)  # -> Geometry, Transform
graft_2 = GraftTree(Tree=move_3.Transform, IncludeEmptyLists=True, IncludeNullItems=True)  # disabled
comp = Compound(Transforms=[graft, graft_2])  # disabled
graft_3 = GraftTree(Tree=pshift, IncludeEmptyLists=True, IncludeNullItems=True)  # disabled
comp_2 = Compound(Transforms=[comp, graft_3])  # disabled

# ---- group: module center
pt_4 = Point(move_3.Geometry)

# ----
pshift_2 = ShiftPaths(Data=comp_2, Offset=-1)  # disabled
transform = Transform(pshift_2)  # disabled
pt_5 = ClusterOutput(pt_4)
transform_2 = ClusterOutput(transform)  # disabled

# ==== cluster MoveToOrgin
num = ClusterInput()
G = ClusterInput()
num_2 = Number(num)
geobottomcenter = GeoBottomCenter(geo=G)
vec2pt = Vector2Pt(PointA=geobottomcenter, PointB=Point(0, 0, 0), Unitize=False)  # -> Vector, Length
move = Move(Geometry=G, Motion=vec2pt.Vector)  # -> Geometry, Transform
scale_nu = ScaleNU(Geometry=move.Geometry, Plane=PlaneXY(0, 0, 0), ScaleX=num_2, ScaleY=num_2, ScaleZ=1)  # -> Geometry, Transform
G_2 = ClusterOutput(scale_nu.Geometry)

# ==== cluster Perspective
int = ClusterInput()
int_2 = ClusterInput()
pt = ClusterInput()

# ---- group: grid extent y
int_3 = Integer(int)

# ---- group: grid extent x
int_4 = Integer(int_2)

# ---- group: Pts Sample Grid Corner
pt_2 = Point(pt)

# ----
subtraction = Subtraction(A=int_4, B=1)
subtraction_2 = Subtraction(A=int_3, B=1)
item = ListItem(List=pt_2, Index=0, Wrap=False)
item_2 = ListItem(List=pt_2, Index=1, Wrap=False)
item_3 = ListItem(List=pt_2, Index=2, Wrap=False)
item_4 = ListItem(List=pt_2, Index=3, Wrap=False)
pt_3 = Point(item_4)
pt_4 = Point(item)
ln = Line(StartPoint=pt_3, EndPoint=pt_4)
pt_5 = Point(item_2)
ln_2 = Line(StartPoint=pt_4, EndPoint=pt_5)
pt_6 = Point(item_3)
ln_3 = Line(StartPoint=pt_6, EndPoint=pt_3)
ln_4 = Line(StartPoint=pt_5, EndPoint=pt_6)
llx = LineLine(Line1=ln, Line2=ln_4)  # -> ParamA, ParamB, PointA, PointB
pt_7 = Point(llx.PointA)
llx_2 = LineLine(Line1=ln_2, Line2=ln_3)  # -> ParamA, ParamB, PointA, PointB
pt_8 = Point(llx_2.PointA)
vec2pt = Vector2Pt(PointA=pt_8, PointB=pt_7, Unitize=False)  # -> Vector, Length
line = LineSDL(Start=pt_3, Direction=vec2pt.Vector, Length=1)
llx_3 = LineLine(Line1=ln_2, Line2=line)  # -> ParamA, ParamB, PointA, PointB
pt_9 = Point(llx_3.PointA)
ln_5 = Line(StartPoint=pt_3, EndPoint=pt_9)
divide = DivideCurve(Curve=ln_5, Count=subtraction_2, Kinks=False)  # -> Points, Tangents, Parameters
ln_6 = Line(StartPoint=pt_8, EndPoint=divide.Points)
llx_4 = LineLine(Line1=ln_4, Line2=line)  # -> ParamA, ParamB, PointA, PointB
pt_10 = Point(llx_4.PointA)
ln_7 = Line(StartPoint=pt_3, EndPoint=pt_10)
divide_2 = DivideCurve(Curve=ln_7, Count=subtraction, Kinks=False)  # -> Points, Tangents, Parameters
ln_8 = Line(StartPoint=pt_7, EndPoint=divide_2.Points)
ln_9 = Line(StartPoint=pt_8, EndPoint=pt_7)

# ---- group: x
line_2 = Line(ln_8)

# ---- group: y
line_3 = Line(ln_6)

# ----
graft = GraftTree(Tree=ln_6, IncludeEmptyLists=True, IncludeNullItems=True)
llx_5 = LineLine(Line1=line_2, Line2=graft)  # -> ParamA, ParamB, PointA, PointB

# ---- group: keystoned grid pts
pt_11 = Point(llx_5.PointA)

# ----
pt_12 = ClusterOutput(pt_11)

# ==== cluster TextFormating
txt = ClusterInput()
txt_2 = Text(txt)

# ---- group: 'Enter'
panel = Panel("")

# ----
split = TextSplit(Text=txt_2, Separators=panel)
lng = ListLength(List=split)
addition = Addition(A=lng, B=1)
division = Division(A=addition, B=2)
series = Series(Start=0, Step=2, Count=division)
item = ListItem(List=split, Index=series, Wrap=False)
pshift = ShiftPaths(Data=item, Offset=1)
graft = GraftTree(Tree=pshift, IncludeEmptyLists=True, IncludeNullItems=True)
split_2 = TextSplit(Text=graft, Separators=",")
pshift_2 = ShiftPaths(Data=split_2, Offset=-2)
txt_3 = Text(pshift_2)
txt_4 = ClusterOutput(txt_3)

# ==== cluster Cluster
P = ClusterInput()
R = ClusterInput()
cir = Circle(Plane=P, Radius=R)
runion = RegionUnion(Curves=cir)
R_2 = ClusterOutput(runion)

# ==== cluster Cluster_2
L = ClusterInput()
L_2 = ClusterInput()
A = ClusterInput()
item = ListItem(List=L_2, Index=0, Wrap=True)
B = ClusterInput()
multiplication = Multiplication(A=A, B=Slider(1.2, range=0..10))
A_2 = ClusterInput()
division = Division(A=item, B=item)
subtraction = Subtraction(A=multiplication, B=B)
L_3 = ClusterInput()
division_2 = Division(A=A_2, B=Slider(2, range=0..1000))
multiplication_2 = Multiplication(A="-1", B=division)
division_3 = Division(A=subtraction, B=2)
multiplication_3 = Multiplication(A=division_3, B="-1")
lng = ListLength(List=L_3)
partition = PartitionList(List=L, Size=lng)
panel = Panel(partition)
multiplication_4 = Multiplication(A=division_2, B=multiplication_2)
number_slider = Slider(6, range=0..100)
vec = VectorXYZ(XComponent=division_3, YComponent=multiplication_3, ZComponent=0)  # -> Vector, Length
pt = ConstructPoint(XCoordinate=division_2, YCoordinate=multiplication_4, ZCoordinate=0)
R = ClusterInput()
A_3 = ClusterInput()
R_2 = ClusterInput()
rev = Reverse(Vector=vec.Vector)
R_3 = ClusterInput()
move = Move(Geometry=pt, Motion=rev)  # -> Geometry, Transform
polygon = Polygon(Plane=move.Geometry, Radius=multiplication, Segments=lng, FilletRadius=Slider(0, range=0..10))  # -> Polygon, Length
polygon_2 = Polygon(Plane=pt, Radius=R, Segments=lng, FilletRadius=0)  # -> Polygon, Length
division_4 = Division(A=A_3, B=number_slider)
polygon_3 = Polygon(Plane=pt, Radius=R_2, Segments=lng, FilletRadius=Slider(52, range=0..100))  # -> Polygon, Length
cp = ControlPoints(Curve=polygon.Polygon)  # -> Points, Weights, Knots
polygon_4 = Polygon(Plane=pt, Radius=R_3, Segments=Slider(63, range=0..100), FilletRadius=Slider(4, range=0..10))  # -> Polygon, Length
series = Series(Start=0, Step=division_4, Count=number_slider)
N = ClusterInput()
number_slider_2 = Slider(223, range=0..1000)
cp_2 = ControlPoints(Curve=polygon_2.Polygon)  # -> Points, Weights, Knots
S = ClusterInput()
cull_i = CullIndex(List=cp.Points, Indices=lng, Wrap=True)
bnd = Bounds(Numbers=N)
cull_i_2 = CullIndex(List=cp_2.Points, Indices=lng, Wrap=True)
cull_i_3 = CullIndex(List=series, Indices=Slider(0, range=0..100), Wrap=True)
ln = Line(StartPoint=pt, EndPoint=graft(cull_i_2))
dedomain = DeconstructDomain(Domain=bnd)  # -> Start, End
W = ClusterInput()
H = ClusterInput()
X = ClusterInput()
Y = ClusterInput()
C = ClusterInput()
launchxpwin = LaunchTransparentWindow(Show=S, Name="CityScope Radar", Width=W, Height=H, ChildStatus=0, EnableHorizScroll=False)
dom = ConstructDomain(DomainStart=Slider(0, range=0..100), DomainEnd=dedomain.End)
pt_2 = ConstructPoint(XCoordinate=X, YCoordinate=Y, ZCoordinate=0)
argb = SplitARGB(Colour=C)  # -> Alpha, Red, Green, Blue
polygon_5 = Polygon(Plane=pt, Radius=cull_i_3, Segments=Slider(63, range=0..100), FilletRadius=Slider(4, range=0..10))  # -> Polygon, Length
remap = RemapNumbers(Value=panel, Source=dom, Target=Domain(0, 1))  # -> Mapped, Clipped
shape = CreateShape(
    Shape=polygon_5.Polygon,
    StrokeWeight=Slider(1, range=0..10),
    StrokeColor=ColourSwatch(SwatchColor=RGBA(255, 255, 255, 98)),
    Scale=Slider(1, range=0..10))
bg = ClusterInput()
shape_2 = CreateShape(
    Shape=polygon_4.Polygon,
    StrokeWeight=Slider(9, range=0..10),
    StrokeColor=ColourSwatch(SwatchColor=RGBA(255, 255, 255, 148)),
    Scale=Slider(1, range=0..10))
frgb = ColourRGBF(Alpha=Slider(0.39, range=0..1), Red=argb.Red, Green=argb.Green, Blue=argb.Blue)
winprops = SetWindowProperties(Window=launchxpwin, StartingLocation=pt_2, ShowTitleBar=Toggle(True), BackgroundColor=bg, ScaleFactor=1)
eval = EvaluateCurve(Curve=flatten(ln), Parameter=remap.Mapped)  # -> Point, Tangent, Angle
pline = PolyLine(Vertices=eval.Point, Closed=True)
fillet = Fillet(Curve=pline, Radius=Slider(4, range=0..10))
sc = ClusterInput()
T = ClusterInput()

panel_2 = Panel(cull_i)
pdecon = Deconstruct(Point=panel_2)  # -> graft(XComponent), graft(YComponent), ZComponent
concat = Concatenate(FragmentA=pdecon.XComponent, FragmentB=",")
abs = Absolute(Value=pdecon.YComponent)
concat_2 = Concatenate(FragmentA=concat, FragmentB=abs)
concat_3 = Concatenate(FragmentA=concat_2, FragmentB=",")
concat_4 = Concatenate(FragmentA=concat_3, FragmentB=Slider(0, range=0..1000))
label = CreateLabel(LabelText=T, LabelSize=12, Justification=0)  # -> flatten(Label)
concat_5 = Concatenate(FragmentA=concat_4, FragmentB=",")
adjustelem = AdjustElementAppearance(ElementsToAdjust=label, Foreground=ColourSwatch(SwatchColor=RGB(255, 239, 248)))
concat_6 = Concatenate(FragmentA=concat_5, FragmentB=Slider(0, range=0..1000))  # -> flatten(Result)
adjustpos = AdjustElementPositioning(ElementsToAdjust=label, Margin=concat_6, AbsolutePositioning=Toggle(True))
panel_3 = Panel(concat_6)

concat_7 = Concatenate(FragmentA=Slider(0, range=0..1000), FragmentB=",")
shape_3 = CreateShape(Shape=fillet, FillColor=frgb, StrokeWeight=Slider(4, range=0..10), StrokeColor=sc, Scale=Slider(1, range=0..10))
shape_4 = CreateShape(
    Shape=ln,
    StrokeWeight=Slider(1, range=0..10),
    StrokeColor=ColourSwatch(SwatchColor=RGBA(255, 255, 255, 98)),
    Scale=Slider(1, range=0..10))
shape_5 = CreateShape(
    Shape=polygon_3.Polygon,
    StrokeWeight=Slider(1, range=0..10),
    StrokeColor=ColourSwatch(SwatchColor=RGBA(255, 255, 255, 47)),
    Scale=Slider(1, range=0..10))
concat_8 = Concatenate(FragmentA=concat_7, FragmentB=Slider(0, range=0..1000))
concat_9 = Concatenate(FragmentA=concat_8, FragmentB=",")
concat_10 = Concatenate(FragmentA=concat_9, FragmentB=Slider(0, range=0..1000))
concat_11 = Concatenate(FragmentA=concat_10, FragmentB=",")
addelems = AddElements(Window=launchxpwin, Elements=flatten([shape_5, shape_2, shape, shape_3, shape_4, label]))  # -> AddedElements, ElementNames
concat_12 = Concatenate(FragmentA=concat_11, FragmentB=Slider(0, range=0..1000))  # -> flatten(Result)
adjustpos_2 = AdjustElementPositioning(
    ElementsToAdjust=flatten([shape_2, shape_5, shape, shape_3, shape_4]),
    Margin=concat_12,
    AbsolutePositioning=Toggle(True))

# ==== cluster Cluster_3
A = ClusterInput()
B = ClusterInput()
lng = ListLength(List=A)
equals = Equality(FirstNumber=A, SecondNumber=B)  # -> Equality, Inequality
series = Series(Start=0, Step=1, Count=lng)
dispatch = Dispatch(List=series, DispatchPattern=equals.Equality)  # -> ListA, ListB
item = ListItem(List=A, Index=dispatch.ListA, Wrap=True)
i = ClusterOutput(item)

# ==== cluster GeoBottomCenter
geo = ClusterInput()
geo_2 = Geometry(geo)
bbox = BoundingBox(Content=geo_2, Plane=PlaneXY(0, 0, 0))  # -> Box, Box_2
box_corners = BoxCorners(Box=bbox.Box)  # -> CornerA, CornerB, CornerC, CornerD, CornerE, CornerF, CornerG, CornerH
pdecon = Deconstruct(Point=box_corners.CornerA)  # -> XComponent, YComponent, ZComponent
pdecon_2 = Deconstruct(Point=box_corners.CornerC)  # -> XComponent, YComponent, ZComponent
addition = Addition(A=pdecon.XComponent, B=pdecon_2.XComponent)
addition_2 = Addition(A=pdecon.YComponent, B=pdecon_2.YComponent)
division = Division(A=addition, B=2)
division_2 = Division(A=addition_2, B=2)
pt = ConstructPoint(XCoordinate=division, YCoordinate=division_2, ZCoordinate=pdecon.ZComponent)
pt_2 = Point(pt)
pt_3 = ClusterOutput(pt_2)
