# Grasshopper definition 161104_CityMatrix_HCU_Mix-use_44x44.gh (Grasshopper 0.9.76)
# plug-ins: Firefly.X, HDTReference

# ---- group: mesh coloring
mesh = Mesh(<mesh referenced from the Rhino model>)
res_color = ColourSwatch(SwatchColor=RGB(251, 255, 122))
sidewalk = ColourSwatch(SwatchColor=RGB(107, 107, 107))
res_gray = ColourSwatch(SwatchColor=RGB(227, 227, 227))
bikelane = ColourSwatch(SwatchColor=RGB(86, 135, 87))
off_gray = ColourSwatch(SwatchColor=RGB(171, 171, 171))
offcolor = ColourSwatch(SwatchColor=RGB(255, 122, 122))
parking = ColourSwatch(SwatchColor=RGB(196, 156, 100))
blank = ColourSwatch(SwatchColor=RGB(110, 110, 110))
road = ColourSwatch(SwatchColor=RGB(64, 64, 64))
park = ColourSwatch(SwatchColor=RGB(165, 201, 44))
# Building Type Mesh
text = ColourSwatch(SwatchColor=RGB(0, 0, 0))
res_warm = ColourSwatch(SwatchColor=RGB(255, 251, 230))
text_new = ColourSwatch(SwatchColor=RGB(64, 64, 64))
off_cold = ColourSwatch(SwatchColor=RGB(230, 242, 255))
mcol = MeshColours(Mesh=mesh, Colours=blank)
mesh_2 = Mesh(mcol)

# ---- group: Int Grid X Extent Intervention
number_slider = Slider(20, range=1..44)

# ---- group: Int Grid X Shift
number_slider_2 = Slider(6, range=1..44)

# ---- group: Int Grid Y Shift
number_slider_3 = Slider(23, range=1..44)

# ---- group: Int Grid Y Extent Intervention
number_slider_4 = Slider(20, range=1..44)

# ---- group: Int Grid X Extent
number_slider_5 = Slider(44, range=1..44)

# ---- group: Int Grid Y Extent
number_slider_6 = Slider(44, range=1..44)

# ---- group: module meshes lego ref: 0 to 5
# Reference in the Building or Road
# geometry from Rhino. They will be
# instantiated/copied to the cell position
# where it has the same Type ID.
# 
# To simplify the data tree. The reference
# geometry should be single Mesh. You
# can paint different mesh with the set-up
# on the right, and join them together.
mesh_3 = Mesh([<mesh referenced from the Rhino model> x10])

# ---- group: module meshes lego ref: -1
mesh_4 = Mesh(<mesh referenced from the Rhino model>)

# ----
# CityMatrix CV
path = FilePath("C:\Users\RYAN\Dropbox (MIT)\01_Work\MAS\06_Fall 2016\CityMatrix\01_Software\RH_GH\Map\CityMatrix_ML_Cam.PNG")
# Everthing below this line is only for CityMatrix
# CV. You don't need to care about them unless
# you want to use the CityMatrix Table. Let me
# know if you need to use them. I will calibrate it
# for you. <ryanz@mit.edu>
load_bitmap = LoadBitmap(FilePathToImageLocation=path)

# ---- group: all color code quarts (no rotation)
panel = Panel("2,0,0,0\t2,1,0,0\t2,0,1,0\t2,0,0,1\t2,1,1,0\t2,1,0,1\t2,0,1,1\t2,1,1,1\t3,0,0,0\t3,1,0,0\t3,0,1,0\t3,0,0,1\t3,1,1,0\t3,1,0,1\t3,0,1,1\t3,1,1,1\t4,0,0,0\t4,1,0,0\t4,0,1,0\t4,0,0,1\t4,1,1,0\t4,1,0,1\t4,0,1,1\t4,1,1,1\t5,0,0,0\t5,1,0,0\t5,0,1,0\t5,0,0,1\t5,1,1,0\t5,1,0,1\t5,0,1,1\t5,1,1,1")

# ---- group: Pts Sample Grid Corner
pt = Point([<point referenced from the Rhino model> x4])

# ----
pline = PolyLine(Vertices=pt, Closed=False)

# ---- group: Sample White
# You need firefly plugin for this. It streams
# the Webcam footage from the CityMatrix
# Table. (It is now disabled and we are now
# using the text data fomat. )
# 
# Ideal setting (right click):
# 100ms
# 480px x 360px
# Reference Color
pt_2 = Point(<point referenced from the Rhino model>)

# ---- group: Sample Black
pt_3 = Point(<point referenced from the Rhino model>)

# ---- group: Sample Red
pt_4 = Point(<point referenced from the Rhino model>)

# ---- group: Sample Yellow
pt_5 = Point(<point referenced from the Rhino model>)

# ---- group: Sample Blue
pt_6 = Point(<point referenced from the Rhino model>)  # disabled

# ---- group: Sample Green
# Grid Sampling
pt_7 = Point(<point referenced from the Rhino model>)  # disabled

# ----
video_stream = WebCamVideoStream()  # disabled
preview = CustomPreview(Geometry=pline, Shader=ColourSwatch(SwatchColor=RGB(255, 0, 230)))

# ---- group: gridExtent_y_i
int = Integer(number_slider_4)

# ---- group: gridExtent_y_s
# Decode Piece ID
int_2 = Integer(number_slider_3)

# ---- group: gridExtent_x_s
int_3 = Integer(number_slider_2)

# ---- group: gridExtent_x_i
int_4 = Integer(number_slider)

# ---- group: gridExtent_y
int_5 = Integer(number_slider_6)

# ---- group: gridExtent_x
int_6 = Integer(number_slider_5)

# ---- group: all color code quarts (with rotation)
panel_2 = Panel("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")

# ----
multiplication = Multiplication(A=int, B=2)
multiplication_2 = Multiplication(A=int_4, B=2)
crv = Curve(<curve referenced from the Rhino model>)  # disabled
crv_2 = Curve(<curve referenced from the Rhino model>)
crv_3 = Curve(<curve referenced from the Rhino model>)  # disabled
crv_4 = Curve(<curve referenced from the Rhino model>)
crv_5 = Curve(<curve referenced from the Rhino model>)
crv_6 = Curve(<curve referenced from the Rhino model>)
boundary = BoundarySurfaces(Edges=crv)  # disabled
boundary_2 = BoundarySurfaces(Edges=crv_3)  # disabled
boundary_3 = BoundarySurfaces(Edges=crv_2)
boundary_4 = BoundarySurfaces(Edges=crv_4)
boundary_5 = BoundarySurfaces(Edges=crv_6)
boundary_6 = BoundarySurfaces(Edges=crv_5)
replacingitemid = ReplacingItemID(int_4=int_4, int=int, int_6=int_6, int_5=int_5, int_3=int_3, int_2=int_2)
perspective = Perspective(pt=pt, int_2=multiplication_2, int=multiplication)

# ---- group: tab
panel_3 = Panel("\t")

# ----
split = TextSplit(Text=panel_2, Separators=panel_3)
mesh_5 = MeshBrep(
    Brep=boundary,
    Settings={GridMaxCount=0, GridMinCount=16, JaggedSeams=False, MaxEdgeLength=0, MinEdgeLength=0.0001, MinTolerance=0, Refine=True, RefineAngle=0, RelativeTolerance=0.65, SimplePlanes=True, Tolerance=0})  # disabled
mesh_6 = MeshBrep(
    Brep=boundary_2,
    Settings={GridMaxCount=0, GridMinCount=16, JaggedSeams=False, MaxEdgeLength=0, MinEdgeLength=0.0001, MinTolerance=0, Refine=True, RefineAngle=0, RelativeTolerance=0.65, SimplePlanes=True, Tolerance=0})  # disabled
mesh_7 = MeshBrep(
    Brep=boundary_3,
    Settings={GridMaxCount=0, GridMinCount=16, JaggedSeams=False, MaxEdgeLength=0, MinEdgeLength=0.0001, MinTolerance=0, Refine=True, RefineAngle=0, RelativeTolerance=0.65, SimplePlanes=True, Tolerance=0})
mesh_8 = MeshBrep(
    Brep=boundary_4,
    Settings={GridMaxCount=0, GridMinCount=16, JaggedSeams=False, MaxEdgeLength=0, MinEdgeLength=0.0001, MinTolerance=0, Refine=True, RefineAngle=0, RelativeTolerance=0.65, SimplePlanes=True, Tolerance=0})
mesh_9 = MeshBrep(
    Brep=boundary_5,
    Settings={GridMaxCount=0, GridMinCount=16, JaggedSeams=False, MaxEdgeLength=0, MinEdgeLength=0.0001, MinTolerance=0, Refine=True, RefineAngle=0, RelativeTolerance=0.65, SimplePlanes=True, Tolerance=0})
mesh_10 = MeshBrep(
    Brep=boundary_6,
    Settings={GridMaxCount=0, GridMinCount=16, JaggedSeams=False, MaxEdgeLength=0, MinEdgeLength=0.0001, MinTolerance=0, Refine=True, RefineAngle=0, RelativeTolerance=0.65, SimplePlanes=True, Tolerance=0})

# ---- group: webcam stream
# You can feed a screen shot of the camera
# stream into the "webcam stream", when
# you don't have a CityMatrix table near
# you.
data = Data(load_bitmap)

# ---- group: replacing item ID
int_7 = Integer(replacingitemid)

# ---- group: CityMatrix CV Calibration
mesh_11 = MeshFromImage(Bmp=data, Sx=Domain(0, 1), Sy=Domain(0, 1), Z=0, C=True)

# ---- group: all color quarts data
txt = Text(split)

# ----
lng = ListLength(List=txt)

# ---- group: webcam stream
bmp = BitmapToModify(data)

# ----
sample = BitmapSampler(BitmapToModify=bmp, PointToSample=pt_6, BitmapToModify_2=bmp, PointToSample_2=pt_6, bitmap_filter=0)  # -> SampledImageData, SampledImageData_2; disabled
sample_2 = BitmapSampler(BitmapToModify=bmp, PointToSample=pt_7, BitmapToModify_2=bmp, PointToSample_2=pt_7, bitmap_filter=0)  # -> SampledImageData, SampledImageData_2; disabled
sample_3 = BitmapSampler(BitmapToModify=bmp, PointToSample=pt_5, BitmapToModify_2=bmp, PointToSample_2=pt_5, bitmap_filter=0)  # -> SampledImageData, SampledImageData_2
sample_4 = BitmapSampler(BitmapToModify=bmp, PointToSample=pt_3, BitmapToModify_2=bmp, PointToSample_2=pt_3, bitmap_filter=0)  # -> SampledImageData, SampledImageData_2
sample_5 = BitmapSampler(BitmapToModify=bmp, PointToSample=pt_4, BitmapToModify_2=bmp, PointToSample_2=pt_4, bitmap_filter=0)  # -> SampledImageData, SampledImageData_2
sample_6 = BitmapSampler(BitmapToModify=bmp, PointToSample=pt_2, BitmapToModify_2=bmp, PointToSample_2=pt_2, bitmap_filter=0)  # -> SampledImageData, SampledImageData_2

# ---- group: x
series = Series(Start=0, Step=1, Count=int_4)

# ---- group: y
series_2 = Series(Start=0, Step=1, Count=int)

# ----
division = Division(A=lng, B="4")

# ---- group: webcam stream
bmp_2 = BitmapToModify(data)

# ----
col = Colour(sample.SampledImageData_2)  # disabled
col_2 = Colour(sample_3.SampledImageData_2)
col_3 = Colour(sample_2.SampledImageData_2)  # disabled
col_4 = Colour(sample_4.SampledImageData_2)
col_5 = Colour(sample_6.SampledImageData_2)
col_6 = Colour(sample_5.SampledImageData_2)
panel_4 = Panel(txt)
mcol_2 = MeshColours(Mesh=mesh_5, Colours=col)  # disabled
mcol_3 = MeshColours(Mesh=mesh_6, Colours=col_3)  # disabled
mcol_4 = MeshColours(Mesh=mesh_7, Colours=col_2)
multiplication_3 = Multiplication(A=series_2, B=4)
mcol_5 = MeshColours(Mesh=mesh_8, Colours=col_4)
mcol_6 = MeshColours(Mesh=mesh_9, Colours=col_6)
mcol_7 = MeshColours(Mesh=mesh_10, Colours=col_5)
series_3 = Series(Start=0, Step=1, Count=division)
# Defining the floor number for each
# building type.
panel_5 = Panel("""0,0,0,0,0,0,0,0,0,0,0,0,0,0,0,4,0,0,0,0,0,0,0,0,0,0,0,0,0,0,0,0,0,0,0,0,0,0,0,0,0,0,0,0
0,0,0,0,0,0,0,0,0,0,0,4,0,0,6,0,0,0,0,0,0,0,0,0,0,0,0,0,0,0,0,0,0,0,0,0,0,0,0,0,0,0,0,0
0,0,0,0,0,0,0,0,0,0,0,0,4,6,6,0,0,0,0,0,0,0,0,0,0,0,0,0,0,0,0,0,0,0,0,0,0,0,0,0,0,0,0,0
0,0,0,0,0,0,0,0,0,0,0,0,0,0,4,0,0,0,0,0,0,0,0,0,0,4,4,4,4,4,4,4,4,4,4,4,4,4,4,4,4,4,4,4
0,0,0,0,0,0,0,4,0,4,0,0,0,0,0,0,0,0,0,0,0,0,0,0,0,0,0,0,0,0,0,0,0,0,0,0,0,0,0,0,0,0,0,0
0,0,0,0,6,0,0,0,0,0,0,0,0,0,0,0,0,0,0,0,0,0,0,0,0,4,4,4,4,4,4,4,4,4,4,4,4,4,4,4,4,4,4,4
0,0,0,4,4,0,0,0,4,0,0,4,6,0,0,0,4,4,4,4,4,0,4,0,0,0,0,0,0,0,0,0,0,0,0,0,0,0,0,0,0,0,0,0
0,0,0,4,4,0,0,0,0,0,0,6,0,6,0,0,4,0,4,6,4,4,4,0,0,0,0,0,0,0,0,0,0,0,0,0,0,0,0,0,0,0,0,0
0,0,0,0,0,0,0,0,0,0,0,0,0,0,0,0,0,4,0,4,0,4,4,0,0,0,0,0,0,0,0,0,0,0,0,0,0,0,0,0,0,0,0,0
0,0,0,0,0,0,0,0,0,0,0,0,0,0,0,0,4,0,4,4,6,4,4,0,0,0,0,0,0,0,0,0,0,4,4,0,4,4,4,4,4,4,0,0
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""")
multiplication_4 = Multiplication(A=series, B=2)

# ---- group: keystoned grid pts
pt_8 = Point(perspective)

# ----
pshift = ShiftPaths(Data=series_3, Offset=-1)
multiplication_5 = Multiplication(A=division, B="4")
multiplication_6 = Multiplication(A=multiplication_3, B=int_4)
preview_2 = CustomPreview(
    Geometry=mcol_2,
    Shader={ambient=RGB(0, 0, 0), diffuse=RGB(255, 105, 180), emission=RGB(76, 32, 54), shine=0.5, specular=RGB(255, 255, 255), transparency=0})  # disabled
preview_3 = CustomPreview(
    Geometry=mcol_3,
    Shader={ambient=RGB(0, 0, 0), diffuse=RGB(255, 105, 180), emission=RGB(76, 32, 54), shine=0.5, specular=RGB(255, 255, 255), transparency=0})  # disabled
preview_4 = CustomPreview(
    Geometry=mcol_4,
    Shader={ambient=RGB(0, 0, 0), diffuse=RGB(255, 105, 180), emission=RGB(76, 32, 54), shine=0.5, specular=RGB(255, 255, 255), transparency=0})
preview_5 = CustomPreview(
    Geometry=mcol_5,
    Shader={ambient=RGB(0, 0, 0), diffuse=RGB(255, 105, 180), emission=RGB(76, 32, 54), shine=0.5, specular=RGB(255, 255, 255), transparency=0})
preview_6 = CustomPreview(
    Geometry=mcol_6,
    Shader={ambient=RGB(0, 0, 0), diffuse=RGB(255, 105, 180), emission=RGB(76, 32, 54), shine=0.5, specular=RGB(255, 255, 255), transparency=0})
pshift_2 = ShiftPaths(Data=pt_8, Offset=-1)

# ---- group: all sample pts
pt_9 = Point(pshift_2)

# ----
sample_7 = BitmapSampler(BitmapToModify=bmp_2, PointToSample=pt_9, BitmapToModify_2=bmp_2, PointToSample_2=pt_9, bitmap_filter=0)  # -> SampledImageData, SampledImageData_2
preview_7 = CustomPreview(
    Geometry=mcol_7,
    Shader={ambient=RGB(0, 0, 0), diffuse=RGB(255, 105, 180), emission=RGB(76, 32, 54), shine=0.5, specular=RGB(255, 255, 255), transparency=0})
box = CenterBox(Base=pt_9, X=0.003, Y=0.003, Z=0.003)
repeat = RepeatData(Data=pshift, Length=multiplication_5)
addition = Addition(A=multiplication_4, B=graft(multiplication_6))
merge = Merge(Data1=col_5, Data2=col_4, Data3=col_6, Data4=col_2, Data5=col, Data6=col_3)

_4_commed = Slider(6, range=1..25)
_1_resmed = Slider(9, range=1..25)
_3_comhq = Slider(3, range=1..25)
# Building Heights
_0_reslux = Slider(1, range=1..25)
_2_resmu = Slider(12, range=1..25)
_5_rescw = Slider(15, range=1..25)

pshift_3 = ShiftPaths(Data=repeat, Offset=-1)

# ---- group: all color quart ids
int_8 = Integer(pshift_3)

# ---- group: all sample color
col_7 = Colour(sample_7.SampledImageData_2)

# ---- group: all sample boxes
box_2 = Box(box)

# ---- group: all piece ids
int_9 = Integer([0, 6, 2, 2, 2, 2, 6, 1, 1, 1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])

# ----
txt_2 = Text(int_9)
shift = ShiftList(List=int_8, Shift=-1, Wrap=False)
pshift_4 = ShiftPaths(Data=addition, Offset=-1)
join = TextJoin(Text=txt_2, Join=",")
multiplication_7 = Multiplication(A=int_4, B=2)
pshift_5 = ShiftPaths(Data=shift, Offset=-1)

# ---- group: all ref colors
col_8 = Colour([RGB(175, 166, 150), RGB(64, 63, 60), RGB(116, 35, 32), RGB(178, 134, 4)])

# ----
addition_2 = Addition(A=pshift_4, B=multiplication_7)
merge_2 = Merge(Data1=pshift_5, Data2=graft("32"))
panel_6 = Panel(merge_2)
addition_3 = Addition(A=pshift_4, B=1)
int_10 = Integer(_5_rescw)

# ---- group: all perfect colors
# Closest Color Code
col_9 = Colour([ColourSwatch(SwatchColor=RGB(255, 255, 255)), ColourSwatch(SwatchColor=RGB(0, 0, 0)), ColourSwatch(SwatchColor=RGB(255, 0, 0))])

# ----
int_11 = Integer(_4_commed)
int_12 = Integer(_2_resmu)
int_13 = Integer(_3_comhq)
int_14 = Integer(_1_resmed)
int_15 = Integer(_0_reslux)
merge_3 = Merge(Data1=int_15, Data2=int_14, Data3=int_12, Data4=int_13, Data5=int_11, Data6=int_10)
addition_4 = Addition(A=addition_2, B=1)
textformating = TextFormating(txt=panel_5)
dist = Distance(PointA=graft(col_7), PointB=col_8)

# ---- group: floor height
panel_7 = Panel("3.5")

# ---- group: floor num for each type
int_16 = Integer(merge_3)

# ----
multiplication_8 = Multiplication(A=int_16, B=panel_7)
lng_2 = ListLength(List=dist)
series_4 = Series(Start=0, Step=1, Count=lng_2)
series_5 = Series(Start=0, Step=1, Count=int_5)

# ---- group: all module piece ids - from Text Data
int_17 = Integer(textformating)

# ----
int_18 = Integer(series_4)

# ---- group: building height for each type
# CityMatrix
# 
# "Ryan" Yan Zhang <ryanz@mit.edu>
# MIT Media Lab, Changing Place Group
# September. 2016
# Here you choose to use Text Data that you
# can edit or CityMatrix CV.
# 
# For Text Data, simple edit the text panel on
# the left (arrow 1), by change the ID in each
# slot, you change what building module to
# copy to the stage. Currently, ID -1 is blank,
# ID 0 to 5 are 6 different building type.
# 
# For CityMatrix CV, rewire this (arrow 2) and
# enable the video stream (arrow 3). Contact
# me for using and calibrating the physical
# CityMatrix table. <ryanz@mit.edu>
num = Number(multiplication_8)

# ----
repeat_2 = RepeatData(Data=graft(series_5), Length=int_6)
sort = SortList(Keys=dist, ValuesA=int_18)  # -> Keys, ValuesA
multiplication_9 = Multiplication(A=int_6, B=int_5)
series_6 = Series(Start=0, Step=1, Count=int_6)

# ---- group: sample pts
item = ListItem(List=pt_9, Index=addition_2, Wrap=False)
item_2 = ListItem(List=pt_9, Index=pshift_4, Wrap=False)
item_3 = ListItem(List=pt_9, Index=addition_4, Wrap=False)
item_4 = ListItem(List=pt_9, Index=addition_3, Wrap=False)

# ----
addition_5 = Addition(A=item_2, B=item_3)

# ---- group: replacing item ID
int_19 = Integer(int_7)

# ----
pshift_6 = ShiftPaths(Data=repeat_2, Offset=-1)
repeat_3 = RepeatData(Data=series_6, Length=multiplication_9)
item_5 = ListItem(List=sort.ValuesA, Index=0, Wrap=False)
division_2 = Division(A=addition_5, B=2)
pshift_7 = ShiftPaths(Data=pshift_6, Offset=-1)
pshift_8 = ShiftPaths(Data=repeat_3, Offset=-1)
lng_3 = ListLength(List=pshift_8)
repeat_4 = RepeatData(Data="0", Length=lng_3)
pshift_9 = ShiftPaths(Data=repeat_4, Offset=-1)

# ---- group: quart mid pts
pt_10 = Point(division_2)

# ----
pshift_10 = ShiftPaths(Data=item_5, Offset=-1)

# ---- group: x
int_20 = Integer(pshift_8)

# ---- group: y
int_21 = Integer(pshift_7)

# ---- group: rotation
int_22 = Integer(pshift_9)

# ----
pshift_11 = ShiftPaths(Data=pshift_10, Offset=-1)
panel_8 = Panel(int_22)
panel_9 = Panel(int_20)
panel_10 = Panel(int_21)

# ---- group: color code of each smaple pt
int_23 = Integer(pshift_11)

# ----
item_6 = ListItem(List=col_8, Index=int_23, Wrap=False)
preview_8 = CustomPreview(Geometry=box_2, Shader=item_6)

# ---- group: color codes
item_7 = ListItem(List=int_23, Index=pshift_4, Wrap=False)
item_8 = ListItem(List=int_23, Index=addition_2, Wrap=False)
item_9 = ListItem(List=int_23, Index=addition_4, Wrap=False)
item_10 = ListItem(List=int_23, Index=addition_3, Wrap=False)

# ----
merge_4 = Merge(Data1=graft(item_7), Data2=graft(item_8), Data3=graft(item_9), Data4=graft(item_10))

# ---- group: color code quarts
int_24 = Integer(merge_4)

# ----
rev = ReverseList(List=int_24)
txt_3 = Text(rev)
join_2 = TextJoin(Text=txt_3, Join=",")
pshift_12 = ShiftPaths(Data=join_2, Offset=-1)

# ---- group: color code quart texts
txt_4 = Text(pshift_12)

# ----
keysearch = KeyValueSearch(Keys=txt, Values=merge_2, Search=graft(txt_4))
nullrep = ReplaceNulls(Items=keysearch, Replacements="-1")  # -> Items, Count
pshift_13 = ShiftPaths(Data=nullrep.Items, Offset=-1)

# ---- group: all module piece ids
int_25 = Integer(pshift_13)

# ----
addition_6 = Addition(A=int_25, B=1)
tag = TextTag3D(Location=pt_10, Text=addition_6, Size=0.01, Justification=5)
panel_11 = Panel(addition_6)

# ---- group: all module piece ids - from CityMatrix CV
int_26 = Integer(addition_6)

# ----
replace = ReplaceItems(List=int_17, Item=int_26, Indices=int_19, Wrap=False)

# ---- group: module id
int_27 = Integer(replace)

# ----
panel_12 = Panel(int_27)

# ---- group: intervention
panel_13 = Panel("0.00001")  # disabled
panel_14 = Panel("0")  # disabled

# ----
pt_11 = ConstructPoint(XCoordinate=int_20, YCoordinate=int_21, ZCoordinate=0)  # disabled
pt_12 = ConstructPoint(XCoordinate=panel_13, YCoordinate=panel_14, ZCoordinate=0)  # disabled
panel_15 = Panel("1873")  # disabled
panel_16 = Panel("1")  # disabled
panel_17 = Panel("1785")  # disabled
panel_18 = Panel("1741")  # disabled
panel_19 = Panel("1829")  # disabled

# ----
# Here's the code for the abstract point
# color example I shown in the class.
# It's a very good starting point to build
# your own logic without worring about
# the output part too much.
# 
# Currently, move arround the 2 reference
# points will change the heatmap.
# 
# Mind that the x,y coordinate is from
# 0 to 15, so it is pretty small. Zoom in to
# see the points, or you can use Camera
# "HeatMapPts" saved for you.
pt_13 = Point(<point referenced from the Rhino model>)  # disabled
pt_14 = Point(<point referenced from the Rhino model>)  # disabled

panel_20 = Panel("1697")  # disabled
item_11 = ListItem(List=panel_12, Index=panel_15, Wrap=False)  # disabled
item_12 = ListItem(List=panel_12, Index=panel_19, Wrap=False)  # disabled
item_13 = ListItem(List=panel_12, Index=panel_18, Wrap=False)  # disabled
item_14 = ListItem(List=panel_12, Index=panel_17, Wrap=False)  # disabled
item_15 = ListItem(List=panel_12, Index=panel_20, Wrap=False)  # disabled
int_28 = Integer(item_11)  # disabled
dist_2 = Distance(PointA=pt_14, PointB=pt_11)  # disabled
dist_3 = Distance(PointA=pt_13, PointB=pt_11)  # disabled
int_29 = Integer(item_12)  # disabled
int_30 = Integer(item_13)  # disabled
int_31 = Integer(item_14)  # disabled
int_32 = Integer(item_15)  # disabled
panel_21 = Panel("32")  # disabled
panel_22 = Panel("1")  # disabled
equals = Equality(FirstNumber=int_28, SecondNumber=panel_21)  # -> Equality, Inequality; disabled
equals_2 = Equality(FirstNumber=int_30, SecondNumber=panel_21)  # -> Equality, Inequality; disabled
equals_3 = Equality(FirstNumber=int_31, SecondNumber=panel_21)  # -> Equality, Inequality; disabled
equals_4 = Equality(FirstNumber=int_32, SecondNumber=panel_21)  # -> Equality, Inequality; disabled
equals_5 = Equality(FirstNumber=int_29, SecondNumber=panel_21)  # -> Equality, Inequality; disabled
min = Minimum(A=dist_3, B=dist_2)  # disabled
panel_23 = Panel(min)  # disabled
show_railway_noise_map = Panel(equals.Equality)  # disabled
show_street_noise_map = Panel(equals_5.Equality)  # disabled
show_google_map = Panel(equals_3.Equality)  # disabled
number_slider_7 = Slider(10, range=0..50)  # disabled

# ---- group: safety score
division_3 = Division(A=panel_22, B=panel_23)  # disabled

# ----
panel_24 = Panel("C:\Users\CSlab\Downloads\CityMatrix\Maps\Railroadnoise.png")  # disabled
panel_25 = Panel("C:\Users\CSlab\Downloads\CityMatrix\Maps\Roadnoise.png")  # disabled
# C:\Users\Cedric\Desktop\Eigene Dateien\Studium\Master\3. Semester\Q-Studie 2 Rothenburgsort\Map\sat_map_rothenburgsort.jpg
panel_26 = Panel("C:\Users\CSlab\Downloads\CityMatrix\Maps\sat_map_rothenburgsort.jpg")  # disabled

# ----
# Radians of Building
number_slider_8 = Slider(2, range=0..30)  # disabled

panel_27 = Panel(division_3)  # disabled
panel_28 = Panel("\"null\"")  # disabled
panel_29 = Panel("\"null\"")  # disabled
panel_30 = Panel("\"null\"")  # disabled
dispatch = Dispatch(List=panel_28, DispatchPattern=equals.Inequality)  # -> ListA, ListB; disabled
dispatch_2 = Dispatch(List=panel_24, DispatchPattern=show_railway_noise_map)  # -> ListA, ListB; disabled
dispatch_3 = Dispatch(List=panel_29, DispatchPattern=equals_5.Inequality)  # -> ListA, ListB; disabled
dispatch_4 = Dispatch(List=panel_30, DispatchPattern=equals_3.Inequality)  # -> ListA, ListB; disabled
dispatch_5 = Dispatch(List=panel_25, DispatchPattern=show_street_noise_map)  # -> ListA, ListB; disabled
dispatch_6 = Dispatch(List=panel_26, DispatchPattern=show_google_map)  # -> ListA, ListB; disabled
gradient = Gradient(LowerLimit=0, UpperLimit=1, Parameter=division_3, stops=[0: RGB(255, 0, 0), 0.5: RGB(255, 255, 0), 1: RGB(0, 128, 0)])  # disabled
preview_9 = CustomPreview(Geometry=pt_11, Shader=gradient)  # disabled
x_width = Slider(2799, range=100..5000)
y_height = Slider(2801, range=100..5000)
number_slider_9 = Slider(0.357, range=0..1)
x_width_2 = Slider(2799, range=100..5000)  # disabled
y_height_2 = Slider(2801, range=100..5000)  # disabled
number_slider_10 = Slider(0.357, range=0..1)  # disabled

radians = Slider(20, range=20..40)  # disabled
radians_scale = Slider(60, range=60..100)  # disabled

multiplication_10 = Multiplication(A=y_height, B=number_slider_9)
multiplication_11 = Multiplication(A=x_width, B=number_slider_9)
x_width_3 = Slider(2799, range=100..5000)  # disabled
y_height_3 = Slider(2801, range=100..5000)  # disabled
number_slider_11 = Slider(0.357, range=0..1)  # disabled
multiplication_12 = Multiplication(A=y_height_2, B=number_slider_10)  # disabled
multiplication_13 = Multiplication(A=x_width_2, B=number_slider_10)  # disabled
number_slider_12 = Slider(360, range=345..360)  # disabled
# Google Map @ Lego
Z = UnitZ(Factor=-5)
multiplication_14 = Multiplication(A=y_height_3, B=number_slider_11)  # disabled
multiplication_15 = Multiplication(A=x_width_3, B=number_slider_11)  # disabled
number_slider_13 = Slider(0.8, range=0..1)  # disabled
number_slider_14 = Slider(20, range=-10..20)  # disabled
number_slider_15 = Slider(360, range=345..360)  # disabled
number_slider_16 = Slider(360, range=345..360)  # disabled
number_slider_17 = Slider(19.758, range=-10..20)  # disabled
Z_2 = UnitZ(Factor=number_slider_14)  # disabled
number_slider_18 = Slider(19.758, range=-10..20)  # disabled
number_slider_19 = Slider(0, range=0..1)  # disabled
Z_3 = UnitZ(Factor=number_slider_17)  # disabled
number_slider_20 = Slider(0, range=0..1)  # disabled
Z_4 = UnitZ(Factor=number_slider_18)  # disabled
number_slider_21 = Slider(0, range=0..1)  # disabled
list = ValueList({"One": 1, "Two": 2, "Three": 2² - 1, "Four": Sqrt(16)}, selected="Three")  # disabled
int_33 = Integer(int_17)  # disabled
panel_31 = Panel(int_33)  # disabled
series_7 = Series(Start=1, Step=1, Count=9)  # -> graft(Series); disabled
cluster = Cluster_2(A=int_33, B=series_7)  # disabled
lng_4 = ListLength(List=cluster)  # -> flatten(Length); disabled
item_16 = ListItem(List=lng_4, Index=[0, 1, 2], Wrap=True)  # disabled
item_17 = ListItem(List=lng_4, Index=[3, 5, 7], Wrap=True)  # disabled
item_18 = ListItem(List=lng_4, Index=[3, 5, 7], Wrap=True)  # disabled
multiplication_16 = Multiplication(A=item_16, B=50)  # disabled
panel_32 = Panel(multiplication_16)  # disabled
multiplication_17 = Multiplication(A=item_17, B=50)  # disabled
multiplication_18 = Multiplication(A=item_18, B=10)  # disabled
item_19 = ListItem(List=multiplication_16, Index=0, Wrap=True)  # disabled
item_20 = ListItem(List=multiplication_16, Index=1, Wrap=True)  # disabled
item_21 = ListItem(List=multiplication_16, Index=2, Wrap=True)  # disabled
item_22 = ListItem(List=multiplication_17, Index=0, Wrap=True)  # disabled
item_23 = ListItem(List=multiplication_17, Index=1, Wrap=True)  # disabled
item_24 = ListItem(List=multiplication_17, Index=2, Wrap=True)  # disabled
item_25 = ListItem(List=multiplication_18, Index=0, Wrap=True)  # disabled
item_26 = ListItem(List=multiplication_18, Index=1, Wrap=True)  # disabled
item_27 = ListItem(List=multiplication_18, Index=2, Wrap=True)  # disabled
dom = ConstructDomain(DomainStart=0, DomainEnd=3000)  # disabled
dom_2 = ConstructDomain(DomainStart=0, DomainEnd=1000)  # disabled
dom_3 = ConstructDomain(DomainStart=0, DomainEnd=300)  # disabled
dom_4 = ConstructDomain(DomainStart=0, DomainEnd=2000)  # disabled
dom_5 = ConstructDomain(DomainStart=0, DomainEnd=5000)  # disabled
dom_6 = ConstructDomain(DomainStart=0, DomainEnd=2000)  # disabled

# ---- group: gridExtent_x
int_34 = Integer(int_6)

# ---- group: shrink
cell_shrink = Slider(0.337, range=0.01..1)

# ---- group: toggle1
bool = Boolean(False)

# ---- group: gridExtent_y
int_35 = Integer(int_5)

# ---- group: rotation
int_36 = Integer(int_22)

# ---- group: module id
int_37 = Integer(int_27)

# ---- group: y
int_38 = Integer(int_21)

# ---- group: x
int_39 = Integer(int_20)

# ---- group: colortizer orgin
pt_15 = Point(<point referenced from the Rhino model>)

# ----
panel_33 = Panel(item_19)  # disabled

# ---- group: table size ref pt
pt_16 = Point(<point referenced from the Rhino model>)

# ----
panel_34 = Panel(item_20)  # disabled
addition_7 = Addition(A=item_25, B=item_22)  # disabled
addition_8 = Addition(A=item_26, B=item_23)  # disabled
addition_9 = Addition(A=item_27, B=item_24)  # disabled
panel_35 = Panel(item_21)  # disabled
# LEGO Grid System
pt_17 = Point(<point referenced from the Rhino model>)
dom_7 = ConstructDomain(DomainStart=1, DomainEnd=10)  # disabled
Z_5 = UnitZ(Factor=Slider(-0.5, range=-10..10))
# Google Map @ Lego
srf = Surface(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)
xy = XYPlane(Origin=pt_17)
dist_4 = Distance(PointA=pt_15, PointB=pt_16)
panel_36 = Panel(addition_8)  # disabled
panel_37 = Panel(addition_7)  # disabled
panel_38 = Panel(addition_9)  # disabled
move = Move(Geometry=srf, Motion=Z_5)  # -> Geometry, Transform
remap = RemapNumbers(Value=item_19, Source=dom_5, Target=dom_7)  # -> Mapped, Clipped; disabled
remap_2 = RemapNumbers(Value=item_20, Source=dom_6, Target=dom_7)  # -> Mapped, Clipped; disabled
remap_3 = RemapNumbers(Value=item_21, Source=dom_3, Target=dom_7)  # -> Mapped, Clipped; disabled
remap_4 = RemapNumbers(Value=addition_7, Source=dom, Target=dom_7)  # -> Mapped, Clipped; disabled
remap_5 = RemapNumbers(Value=addition_8, Source=dom_4, Target=dom_7)  # -> Mapped, Clipped; disabled
remap_6 = RemapNumbers(Value=addition_9, Source=dom_2, Target=dom_7)  # -> Mapped, Clipped; disabled
division_4 = Division(A=dist_4, B=int_34)
movetoorgin = MoveToOrgin(G=mesh_4, num=cell_shrink)
movetoorgin_2 = MoveToOrgin(G=mesh_3, num=cell_shrink)

# ---- group: base cplane
pln = Plane(xy)

# ----
planesrf = PlaneSurface(Plane=pln, XSize=multiplication_11, YSize=multiplication_10)
move_2 = Move(Geometry=planesrf, Motion=Z)  # -> Geometry, Transform
planesrf_2 = PlaneSurface(Plane=pln, XSize=multiplication_13, YSize=multiplication_12)  # disabled
rotate = Rotate(Geometry=planesrf, Angle=degrees(number_slider_12), Plane=PlaneXY(0, 0, 0))  # -> Geometry, Transform; disabled
planesrf_3 = PlaneSurface(Plane=pln, XSize=multiplication_15, YSize=multiplication_14)  # disabled
move_3 = Move(Geometry=rotate.Geometry, Motion=Z_2)  # -> Geometry, Transform; disabled
rotate_2 = Rotate(Geometry=planesrf_2, Angle=degrees(number_slider_15), Plane=PlaneXY(0, 0, 0))  # -> Geometry, Transform; disabled
filter = StreamFilter(Gate=show_google_map, Stream1=move_3.Geometry)  # disabled
move_4 = Move(Geometry=rotate_2.Geometry, Motion=Z_3)  # -> Geometry, Transform; disabled
rotate_3 = Rotate(Geometry=planesrf_3, Angle=degrees(number_slider_16), Plane=PlaneXY(0, 0, 0))  # -> Geometry, Transform; disabled
previewmat = CustomPreviewMaterials(
    Geometry=filter,
    DiffuseColor=RGB(255, 255, 255),
    Transparency=number_slider_19,
    DiffuseBitmap=[dispatch_6.ListA, dispatch_4.ListA])  # disabled
filter_2 = StreamFilter(Gate=show_street_noise_map, Stream1=move_4.Geometry)  # disabled
move_5 = Move(Geometry=rotate_3.Geometry, Motion=Z_4)  # -> Geometry, Transform; disabled
filter_3 = StreamFilter(Gate=show_railway_noise_map, Stream1=move_5.Geometry)  # disabled
previewmat_2 = CustomPreviewMaterials(
    Geometry=filter_2,
    DiffuseColor=RGB(255, 255, 255),
    Transparency=number_slider_20,
    DiffuseBitmap=[dispatch_5.ListA, dispatch_3.ListA])  # disabled
previewmat_3 = CustomPreviewMaterials(Geometry=filter_3, DiffuseColor=RGB(255, 255, 255), Transparency=number_slider_21, DiffuseBitmap=dispatch_2.ListA)  # disabled
planesrf_4 = PlaneSurface(Plane=pln, XSize=Domain(0, 1000), YSize=Domain(-1000, 0))

# ---- group: cell size
num_2 = Number(division_4)

# ----
number_slider_22 = Slider(1, range=0..10)  # disabled
number_slider_23 = Slider(2, range=0..10)  # disabled
number_slider_24 = Slider(3, range=0..10)  # disabled
number_slider_25 = Slider(0, range=0..1)  # disabled
number_slider_26 = Slider(0.5, range=0..1)  # disabled
number_slider_27 = Slider(1, range=0..1)  # disabled
modulecenter = ModuleCenter(pt=pt_15, num=num_2, int_2=int_39, int=int_38)  # -> pt_5, transform_2; disabled
merge_5 = Merge(Data1=number_slider_22, Data2=number_slider_23, Data3=number_slider_24)  # -> graft(Result); disabled
merge_6 = Merge(Data1=number_slider_25, Data2=number_slider_26, Data3=number_slider_27)  # -> graft(Result); disabled
int_40 = Integer(int_17)  # disabled
data_2 = Data(merge_5)  # disabled
data_3 = Data(merge_6)  # disabled
data_4 = Data(int_40)  # disabled

int_41 = Integer(int_17)  # disabled
equals_6 = Equality(FirstNumber=int_41, SecondNumber=0)  # -> Equality, Inequality; disabled
lng_5 = ListLength(List=int_41)  # disabled
series_8 = Series(Start=0, Step=1, Count=lng_5)  # disabled
number_slider_28 = Slider(22, range=0..200)  # disabled
pt_18 = Point(modulecenter.pt_5)  # disabled
dispatch_7 = Dispatch(List=series_8, DispatchPattern=equals_6.Inequality)  # -> ListA, ListB; disabled
item_28 = ListItem(List=pt_18, Index=dispatch_7.ListA, Wrap=True)  # disabled
cps = ClosestPoints(Point=graft(item_28), Cloud=item_28, Count=number_slider_28)  # -> ClosestPoint, CPIndex, Distance; disabled
item_29 = ListItem(List=int_41, Index=cps.CPIndex, Wrap=True)  # disabled
sort_2 = SortList(Keys=item_29)  # -> Keys, ValuesA; disabled
dcon = DeleteConsecutive(Set=sort_2.Keys, Wrap=False)  # -> Set, Count; disabled
number_slider_29 = Slider(7, range=0..10)  # disabled
lng_6 = ListLength(List=dcon.Set)  # disabled
division_5 = Division(A=lng_6, B=number_slider_29)  # -> flatten(Result); disabled
sort_3 = SortList(Keys=division_5)  # -> Keys, ValuesA; disabled
bnd = Bounds(Numbers=sort_3.Keys)  # disabled
dom_8 = ConstructDomain(DomainStart=0, DomainEnd=1)  # disabled
remap_7 = RemapNumbers(Value=division_5, Source=bnd, Target=dom_8)  # -> Mapped, Clipped; disabled
panel_39 = Panel("30")  # disabled
dom_9 = ConstructDomain(DomainStart=panel_39, DomainEnd=expr("-x", panel_39))  # disabled
gradient_2 = Gradient(
    LowerLimit=0,
    UpperLimit=1,
    Parameter=remap_7.Mapped,
    stops=[0: RGB(255, 0, 0), 0.5: RGB(255, 255, 0), 1: RGB(0, 128, 0)])  # disabled
rectangle = Rectangle(Plane=item_28, XSize=dom_9, YSize=dom_9, Radius=0)  # -> Rectangle, Length; disabled
boundary_7 = BoundarySurfaces(Edges=rectangle.Rectangle)  # disabled

high_10 = Slider(8, range=0..10)  # disabled
high = Slider(9, range=0..10)  # disabled
low_10 = Slider(4, range=0..10)  # disabled
low_50 = Slider(5, range=0..10)  # disabled
mid_10 = Slider(6, range=0..10)  # disabled
mid_50 = Slider(7, range=0..10)  # disabled
number_slider_30 = Slider(0, range=0..1)  # disabled
number_slider_31 = Slider(0.5, range=0..1)  # disabled
number_slider_32 = Slider(1, range=0..1)  # disabled
modulecenter_2 = ModuleCenter(pt=pt_15, num=num_2, int_2=int_39, int=int_38)  # -> pt_5, transform_2; disabled
merge_7 = Merge(Data1=low_10, Data2=low_50, Data3=mid_10, Data4=mid_50, Data5=high_10, Data6=high)  # -> graft(Result); disabled
int_42 = Integer(int_17)  # disabled
merge_8 = Merge(Data1=number_slider_30, Data2=number_slider_31, Data3=number_slider_32)  # -> graft(Result); disabled
data_5 = Data(merge_7)  # disabled
data_6 = Data(merge_8)  # disabled
data_7 = Data(int_42)  # disabled

# ----
# Need index numbet from up,
# but compound Index (i) doesnt work
int_43 = Integer(int_17)  # disabled
data_8 = Data(int_43)  # disabled
series_9 = Series(Start=1, Step=1, Count=9)  # -> graft(Series); disabled
lng_7 = ListLength(List=modulecenter.pt_5)  # disabled
equals_7 = Equality(FirstNumber=data_8, SecondNumber=series_9)  # -> Equality, Inequality; disabled
series_10 = Series(Start=0, Step=1, Count=lng_7)  # disabled
dispatch_8 = Dispatch(List=series_10, DispatchPattern=equals_7.Equality)  # -> ListA, ListB; disabled
pt_19 = Point(modulecenter.pt_5)  # disabled
item_30 = ListItem(List=pt_19, Index=dispatch_8.ListA, Wrap=True)  # disabled

number_slider_33 = Slider(50, range=0..50)  # disabled
lng_8 = ListLength(List=item_30)  # disabled
series_11 = Series(Start=0, Step=1, Count=9)  # disabled
pshift_14 = ShiftPaths(Data=lng_8, Offset=-1)  # disabled
merge_9 = Merge(Data1=number_slider_7, Data2=number_slider_33)  # disabled
split_2 = SplitList(List=series_11, Index=3)  # -> ListA, ListB; disabled
dup = DuplicateData(Data=merge_9, Number=3, Order=True)  # disabled
item_31 = ListItem(List=pshift_14, Index=split_2.ListA, Wrap=True)  # disabled
item_32 = ListItem(List=pshift_14, Index=split_2.ListB, Wrap=True)  # disabled
multiplication_19 = Multiplication(A=item_31, B=25)  # -> graft(Result); disabled
multiplication_20 = Multiplication(A=item_32, B=dup)  # disabled
partition = PartitionList(List=multiplication_20, Size=2)  # disabled
ma = MassAddition(Input=partition)  # -> Result, PartialResults; disabled
subtraction = Subtraction(A=multiplication_19, B=ma.Result)  # disabled

panel_40 = Panel(multiplication_19)  # disabled
# > 0 More People than  jobs created
# < 0 Less People than  jobs created
panel_41 = Panel(ma.Result)  # disabled

sort_4 = SortList(Keys=flatten(subtraction))  # -> Keys, ValuesA; disabled
item_33 = ListItem(List=sort_4.Keys, Index=[0, 2], Wrap=True)  # disabled
dispatch_9 = Dispatch(List=item_33, DispatchPattern=[True, False])  # -> ListA, ListB; disabled
dom_10 = ConstructDomain(DomainStart=dispatch_9.ListA, DomainEnd=dispatch_9.ListB)  # disabled
remap_8 = RemapNumbers(Value=flatten(subtraction), Source=dom_10, Target=Domain(0, 1))  # -> Mapped, Clipped; disabled
dup_2 = DuplicateData(Data=remap_8.Mapped, Number=2, Order=False)  # disabled

panel_42 = Panel(dup_2)  # disabled
modulecenter_3 = ModuleCenter(pt=pt_15, num=num_2, int_2=int_39, int=int_38)  # -> pt_5, transform_2

number_slider_34 = Slider(574, range=0..1000)  # disabled
number_slider_35 = Slider(195, range=0..1000)  # disabled
number_slider_36 = Slider(19, range=0..1000)  # disabled
swatch = ColourSwatch(SwatchColor=RGB(0, 0, 0))  # disabled
number_slider_37 = Slider(108, range=0..1000)  # disabled
toggle = BooleanToggle(True)  # disabled
swatch_2 = ColourSwatch(SwatchColor=RGBA(255, 141, 103, 237))  # disabled
swatch_3 = ColourSwatch(SwatchColor=RGBA(253, 0, 244, 237))  # disabled
swatch_4 = ColourSwatch(SwatchColor=RGBA(255, 0, 103, 237))  # disabled
panel_43 = Panel([remap.Mapped, remap_2.Mapped, remap_3.Mapped, remap_4.Mapped, remap_6.Mapped, remap_5.Mapped])  # disabled
panel_44 = Panel([remap.Mapped, remap_2.Mapped, remap_3.Mapped, remap_4.Mapped, remap_6.Mapped, remap_5.Mapped])  # disabled
panel_45 = Panel([remap.Mapped, remap_2.Mapped, remap_3.Mapped, remap_4.Mapped, remap_6.Mapped, remap_5.Mapped])  # disabled
panel_46 = Panel("""Res. Low
Res. Middle
Res. High
Job qualitiy Low
Job qualitiy Medium
Job qualitiy High""")  # disabled
panel_47 = Panel([panel_45, panel_44, panel_43])  # disabled
col_10 = Colour(graft([swatch_4, swatch_2, swatch_3]))  # disabled
cluster_2 = Cluster(
    N=panel_47,
    R_2=number_slider_35,
    sc=col_10,
    R=number_slider_35,
    L=panel_47,
    C=col_10,
    L_3=panel_46,
    A=number_slider_35,
    B=number_slider_35,
    T=panel_46,
    A_3=number_slider_35,
    A_2=number_slider_34,
    L_2=panel_47,
    R_3=number_slider_35,
    S=toggle,
    W=number_slider_34,
    H=number_slider_34,
    X=number_slider_36,
    Y=number_slider_37,
    bg=swatch)  # disabled

previewmat_4 = CustomPreviewMaterials(
    Geometry=move.Geometry,
    DiffuseColor=ColourSwatch(SwatchColor=RGB(255, 255, 255)),
    Transparency="0.0",
    DiffuseBitmap="sat_map_rothenburgsort.jpg")

# ---- group: module meshes lego at orgin
mesh_12 = Mesh(movetoorgin)

mesh_13 = Mesh(movetoorgin_2)

# ---- group: module center
pt_20 = Point(modulecenter_3.pt_5)

# ----
larger = LargerThan(FirstNumber=int_37, SecondNumber="0")  # -> LargerThan, OrEqualTo
smaller = SmallerThan(FirstNumber=int_37, SecondNumber="15")  # -> SmallerThan, OrEqualTo
and = GateAnd(A=larger.OrEqualTo, B=smaller.OrEqualTo)
dispatch_10 = Dispatch(List=int_37, DispatchPattern=and)  # -> ListA, ListB
smaller_2 = SmallerThan(FirstNumber=int_37, SecondNumber="0")  # -> SmallerThan, OrEqualTo
item_34 = ListItem(List=mesh_13, Index=graft(dispatch_10.ListA), Wrap=False)
dispatch_11 = Dispatch(List=pt_20, DispatchPattern=smaller_2.SmallerThan)  # -> ListA, ListB
pshift_15 = ShiftPaths(Data=item_34, Offset=-1)
dispatch_12 = Dispatch(List=int_36, DispatchPattern=and)  # -> ListA, ListB
vec2pt = Vector2Pt(PointA=Point(0, 0, 0), PointB=dispatch_11.ListA, Unitize=False)  # -> Vector, Length
rotate_4 = Rotate(Geometry=pshift_15, Angle=degrees(dispatch_12.ListA), Plane=PlaneXY(0, 0, 0))  # -> Geometry, Transform
dispatch_13 = Dispatch(List=pt_20, DispatchPattern=and)  # -> ListA, ListB
move_6 = Move(Geometry=mesh_12, Motion=vec2pt.Vector)  # -> Geometry, Transform
vec2pt_2 = Vector2Pt(PointA=Point(0, 0, 0), PointB=dispatch_13.ListA, Unitize=False)  # -> Vector, Length
move_7 = Move(Geometry=rotate_4.Geometry, Motion=vec2pt_2.Vector)  # -> Geometry, Transform

# ---- group: building lego modules
mesh_14 = Mesh(move_7.Geometry)

# ---- group: blank
mesh_15 = Mesh(move_6.Geometry)

# ---- group: module center
pt_21 = Point(pt_20)

# ---- group: 3D building site move amount
# 3D City Grid System
panel_48 = Panel("10000")
X = UnitX(Factor=panel_48)

# ---- group: module id
int_44 = Integer(int_27)

# ----
com = ColourSwatch(SwatchColor=RGB(158, 158, 158))
com_2 = ColourSwatch(SwatchColor=RGB(71, 71, 71))
res = ColourSwatch(SwatchColor=RGB(212, 212, 212))
res_2 = ColourSwatch(SwatchColor=RGB(76, 76, 76))

# ---- group: blank
mesh_16 = Mesh(mesh_15)

# ----
larger_2 = LargerThan(FirstNumber=int_44, SecondNumber="0")  # -> LargerThan, OrEqualTo
smaller_3 = SmallerThan(FirstNumber=int_44, SecondNumber="5")  # -> SmallerThan, OrEqualTo

# ---- group: road mesh final!
mesh_17 = Mesh()

# ---- group: sidewalk mesh final!
mesh_18 = Mesh()

# ----
vec = Vector(X)
merge_10 = Merge(Data1=res, Data2=res, Data3=res, Data4=com, Data5=com, Data6=com)
merge_11 = Merge(Data1=res_2, Data2=res_2, Data3=res_2, Data4=com_2, Data5=com_2, Data6=com_2)
and_2 = GateAnd(A=larger_2.OrEqualTo, B=smaller_3.OrEqualTo)
merge_12 = Merge(Data1=merge_10, Data2=merge_11)

# ---- group: is building or not
bool_2 = Boolean(and_2)

# ---- group: cell size
num_3 = Number(division_4)

# ----
dispatch_14 = Dispatch(List=pt_21, DispatchPattern=bool_2)  # -> ListA, ListB
dispatch_15 = Dispatch(List=int_44, DispatchPattern=bool_2)  # -> ListA, ListB

# ---- group: color for each type
col_11 = Colour(merge_12)

# ----
division_6 = Division(A=num_3, B=2)

# ---- group: building center
pt_22 = Point(dispatch_14.ListA)

# ---- group: building id
int_45 = Integer(dispatch_15.ListA)

# ----
equals_8 = Equality(FirstNumber=int_45)  # -> Equality, Inequality
multiplication_21 = Multiplication(A=equals_8.Inequality, B=6)
move_8 = Move(Geometry=mesh_17, Motion=vec)  # -> Geometry, Transform
move_9 = Move(Geometry=mesh_18, Motion=vec)  # -> Geometry, Transform

# ---- group: base height
panel_49 = Panel("5.0")

# ----
move_10 = Move(Geometry=mesh_16, Motion=vec)  # -> Geometry, Transform
multiplication_22 = Multiplication(A=division_6, B=Slider(0.95, range=0..1))
addition_10 = Addition(A=int_45, B=multiplication_21)
neg = Negative(Value=multiplication_22)
filter_4 = StreamFilter(Gate=0, Stream0=addition_10, Stream1=int_45)
item_35 = ListItem(List=col_11, Index=graft(filter_4), Wrap=False)
pshift_16 = ShiftPaths(Data=item_35, Offset=-1)
dom_11 = ConstructDomain(DomainStart=neg, DomainEnd=multiplication_22)
panel_50 = Panel(num)

# ---- group: color for each building
col_12 = Colour(pshift_16)

# ----
item_36 = ListItem(List=panel_50, Index=graft(int_45), Wrap=False)
pshift_17 = ShiftPaths(Data=item_36, Offset=-1)

# ---- group: building height factor
number_slider_38 = Slider(3.1, range=0..10)

# ----
multiplication_23 = Multiplication(A=pshift_17, B=number_slider_38)

# ---- group: building height of each building
num_4 = Number(multiplication_23)

# ----
addition_11 = Addition(A=num_4, B=panel_49)
dom_12 = ConstructDomain(DomainStart=0, DomainEnd=addition_11)
box_3 = DomainBox(Base=pt_22, X=dom_11, Y=dom_11, Z=dom_12)
move_11 = Move(Geometry=box_3, Motion=vec)  # -> Geometry, Transform

# ---- group: building geo
box_4 = Box(move_11.Geometry)

# ---- group: 3D Buldings
preview_10 = CustomPreview(Geometry=box_4, Shader=col_12)

# ---- group: road
mesh_19 = Mesh(move_8.Geometry)

# ---- group: sidewalk
mesh_20 = Mesh(move_9.Geometry)

# ---- group: blank
mesh_21 = Mesh(move_10.Geometry)

# ----
# Density living
data_9 = Data(data_4)  # disabled
data_10 = Data(data_3)  # disabled
data_11 = Data(data_2)  # disabled
pt_23 = Point(modulecenter.pt_5)  # disabled
lng_9 = ListLength(List=data_9)  # disabled
series_12 = Series(Start=0, Step=1, Count=lng_9)  # disabled
equals_9 = Equality(FirstNumber=data_9, SecondNumber=data_11)  # -> Equality, Inequality; disabled
dispatch_16 = Dispatch(List=series_12, DispatchPattern=equals_9.Equality)  # -> ListA, ListB; disabled
item_37 = ListItem(List=pt_23, Index=dispatch_16.ListA, Wrap=True)  # disabled
pshift_18 = ShiftPaths(Data=item_37, Offset=2)  # disabled
cps_2 = ClosestPoints(Point=pshift_18, Cloud=pt_23, Count=number_slider_8)  # -> ClosestPoint, CPIndex, Distance; disabled
pshift_19 = ShiftPaths(Data=cps_2.ClosestPoint, Offset=-1)  # disabled
cullpt = CullDuplicates(Points=pshift_19, Tolerance=0.01, CullMode=3)  # -> Points, Indices, Valence; disabled
pshift_20 = ShiftPaths(Data=cullpt.Points, Offset=-1)  # disabled
bang = ExplodeTree(Data=pshift_20)  # -> Branch0, Branch1, Branch2; disabled
lng_10 = ListLength(List=pshift_20)  # disabled
dup_3 = DuplicateData(Data=data_10, Number=lng_10, Order=True)  # disabled
gradient_3 = Gradient(LowerLimit=0, UpperLimit=1, Parameter=dup_3, stops=[0: RGB(255, 158, 181), 1: RGB(255, 0, 47), 1: RGB(161, 0, 29)])  # disabled

# ----
# {0} _ low
panel_51 = Panel("15")  # disabled
Y = UnitY(Factor=panel_51)  # disabled
X_2 = UnitX(Factor=panel_51)  # disabled
move_12 = Move(Geometry=bang.Branch0, Motion=Y)  # -> Geometry, Transform; disabled
move_13 = Move(Geometry=move_12.Geometry, Motion=X_2)  # -> Geometry, Transform; disabled
pt_24 = Point(move_13.Geometry)  # disabled

# ----
# {1} _ mid
panel_52 = Panel("15")  # disabled
Y_2 = UnitY(Factor=panel_52)  # disabled
X_3 = UnitX(Factor=panel_52)  # disabled
move_14 = Move(Geometry=bang.Branch1, Motion=Y_2)  # -> Geometry, Transform; disabled
move_15 = Move(Geometry=move_14.Geometry, Motion=expr("-x", X_3))  # -> Geometry, Transform; disabled
pt_25 = Point(move_15.Geometry)  # disabled

# ----
# {2} _ high
panel_53 = Panel("15")  # disabled
Y_3 = UnitY(Factor=panel_53)  # disabled
X_4 = UnitX(Factor=panel_53)  # disabled
move_16 = Move(Geometry=bang.Branch2, Motion=expr("-x", Y_3))  # -> Geometry, Transform; disabled
move_17 = Move(Geometry=move_16.Geometry, Motion=X_4)  # -> Geometry, Transform; disabled
pt_26 = Point(move_17.Geometry)  # disabled

# ----
# circle
panel_54 = Panel("10")  # disabled
cir = Circle(Plane=[pt_26, pt_25, pt_24], Radius=panel_54)  # disabled
boundary_8 = BoundarySurfaces(Edges=cir)  # disabled

preview_11 = CustomPreview(Geometry=boundary_8, Shader=gradient_3)  # disabled

# ----
# Density working
pt_27 = Point(modulecenter_2.pt_5)  # disabled
data_12 = Data(data_6)  # disabled
data_13 = Data(data_7)  # disabled
data_14 = Data(data_5)  # disabled
lng_11 = ListLength(List=data_13)  # disabled
series_13 = Series(Start=0, Step=1, Count=lng_11)  # disabled
equals_10 = Equality(FirstNumber=data_13, SecondNumber=data_14)  # -> Equality, Inequality; disabled
dispatch_17 = Dispatch(List=series_13, DispatchPattern=equals_10.Equality)  # -> ListA, ListB; disabled
item_38 = ListItem(List=pt_27, Index=dispatch_17.ListA, Wrap=True)  # disabled
pshift_21 = ShiftPaths(Data=item_38, Offset=2)  # disabled
lng_12 = ListLength(List=pshift_21)  # disabled
dup_4 = DuplicateData(Data=data_12, Number=lng_12, Order=True)  # disabled
gradient_4 = Gradient(LowerLimit=0, UpperLimit=1, Parameter=dup_4, stops=[0: RGB(215, 207, 255), 1: RGB(0, 0, 156)])  # disabled

bang_2 = ExplodeTree(Data=pshift_21)  # -> Branch0, Branch1, Branch2, Branch3, Branch4, Branch5; disabled

pt_28 = Point(bang_2.Branch0)  # disabled
pt_29 = Point(bang_2.Branch1)  # disabled

pt_30 = Point(bang_2.Branch2)  # disabled
pt_31 = Point(bang_2.Branch3)  # disabled

# ----
# {2} _ high
pt_32 = Point(bang_2.Branch4)  # disabled
pt_33 = Point(bang_2.Branch5)  # disabled

pt_34 = Point(pt_30)  # disabled
pt_35 = Point(pt_31)  # disabled

pt_36 = Point(pt_28)  # disabled
pt_37 = Point(pt_29)  # disabled

# ----
# {2} _ 10
# {2} _ 50
pt_38 = Point(pt_32)  # disabled
pt_39 = Point(pt_33)  # disabled

cluster_3 = Cluster_3(P=pt_36, R=radians)  # disabled
cluster_4 = Cluster_3(P=pt_37, R=radians_scale)  # disabled
cluster_5 = Cluster_3(P=pt_34, R=radians)  # disabled
cluster_6 = Cluster_3(P=pt_38, R=radians)  # disabled
cluster_7 = Cluster_3(P=pt_35, R=radians_scale)  # disabled
cluster_8 = Cluster_3(P=pt_39, R=radians_scale)  # disabled
flatten = FlattenTree(Tree=[cluster_3, cluster_4], Path="{0}")  # disabled
flatten_2 = FlattenTree(Tree=[cluster_5, cluster_7], Path="{0}")  # disabled
flatten_3 = FlattenTree(Tree=[cluster_6, cluster_8], Path="{0}")  # disabled
path_mapper = PathMapper(flatten, source="{A}", target="{0}")  # disabled
path_mapper_2 = PathMapper(flatten_3, source="{A}", target="{2}")  # disabled
path_mapper_3 = PathMapper(flatten_2, source="{A}", target="{1}")  # disabled
crv_7 = Curve([path_mapper, path_mapper_2, path_mapper_3])  # disabled

preview_12 = CustomPreview(Geometry=crv_7, Shader=gradient_4)  # disabled

gradient_5 = Gradient(LowerLimit=0, UpperLimit=1, Parameter=remap_8.Mapped, stops=[0: RGB(220, 0, 40), 1: RGB(255, 130, 160)])  # disabled
gradient_6 = Gradient(LowerLimit=0, UpperLimit=1, Parameter=dup_2, stops=[0: RGB(128, 128, 237), 1: RGB(0, 0, 255)])  # disabled
panel_55 = Panel("30")  # disabled
dom_13 = ConstructDomain(DomainStart=panel_55, DomainEnd=expr("-x", panel_55))  # disabled
rectangle_2 = Rectangle(Plane=item_30, XSize=dom_13, YSize=dom_13, Radius=0)  # -> Rectangle, Length; disabled
merge_13 = Merge(Data1=gradient_5, Data2=gradient_6)  # -> flatten(Result); disabled

deplane = DeconstructPlane(Plane=rectangle_2.Rectangle)  # -> Origin, XAxis, YAxis, ZAxis; disabled
scale = Scale(Geometry=rectangle_2.Rectangle, Center=deplane.Origin, Factor=number_slider_13)  # -> Geometry, Transform; disabled

boundary_9 = BoundarySurfaces(Edges=scale.Geometry)  # disabled

preview_13 = CustomPreview(Geometry=boundary_9, Shader=merge_13)  # disabled

filter_5 = StreamFilter(Gate=list, Stream0=boundary_9, Stream1=boundary_7, Stream2=crv_7, Stream3=boundary_8)  # disabled
filter_6 = StreamFilter(Gate=0, Stream0=merge_13, Stream1=gradient_2, Stream2=gradient_4, Stream3=gradient_3)  # disabled
preview_14 = CustomPreview(Geometry=filter_5, Shader=filter_6)  # disabled

# ==== cluster ModuleCenter
pt = ClusterInput()
int = ClusterInput()
num = ClusterInput()
int_2 = ClusterInput()

# ---- group: y
int_3 = Integer(int)

# ---- group: cell size
num_2 = Number(num)

# ---- group: x
int_4 = Integer(int_2)

# ---- group: center
pt_2 = Point(pt)

# ----
pt_3 = ConstructPoint(XCoordinate=0, YCoordinate=0, ZCoordinate=0)  # disabled
addition = Addition(A=int_4, B=0.5)
vec2pt = Vector2Pt(PointA=pt_3, PointB=pt_2, Unitize=False)  # -> Vector, Length; disabled
addition_2 = Addition(A=int_3, B=0.5)
multiplication = Multiplication(A=addition, B=num_2)
move = Move(Motion=vec2pt.Vector)  # -> Geometry, Transform; disabled
lng = ListLength(List=int_4)  # disabled
multiplication_2 = Multiplication(A=addition_2, B=num_2)
X = UnitX(Factor=multiplication)
repeat = RepeatData(Data=move.Transform, Length=lng)  # disabled
neg = Negative(Value=multiplication_2)
move_2 = Move(Geometry=pt_2, Motion=X)  # -> Geometry, Transform
graft = GraftTree(Tree=move_2.Transform, IncludeEmptyLists=True, IncludeNullItems=True)  # disabled
Y = UnitY(Factor=neg)
pshift = ShiftPaths(Data=repeat, Offset=-1)  # disabled
move_3 = Move(Geometry=move_2.Geometry, Motion=Y)  # -> Geometry, Transform
graft_2 = GraftTree(Tree=move_3.Transform, IncludeEmptyLists=True, IncludeNullItems=True)  # disabled
comp = Compound(Transforms=[graft, graft_2])  # disabled
graft_3 = GraftTree(Tree=pshift, IncludeEmptyLists=True, IncludeNullItems=True)  # disabled
comp_2 = Compound(Transforms=[comp, graft_3])  # disabled

# ---- group: module center
pt_4 = Point(move_3.Geometry)

# ----
pshift_2 = ShiftPaths(Data=comp_2, Offset=-1)  # disabled
transform = Transform(pshift_2)  # disabled
pt_5 = ClusterOutput(pt_4)
transform_2 = ClusterOutput(transform)  # disabled

# ==== cluster MoveToOrgin
num = ClusterInput()
G = ClusterInput()
num_2 = Number(num)
geobottomcenter = GeoBottomCenter(geo=G)
vec2pt = Vector2Pt(PointA=geobottomcenter, PointB=Point(0, 0, 0), Unitize=False)  # -> Vector, Length
move = Move(Geometry=G, Motion=vec2pt.Vector)  # -> Geometry, Transform
scale_nu = ScaleNU(Geometry=move.Geometry, Plane=PlaneXY(0, 0, 0), ScaleX=num_2, ScaleY=num_2, ScaleZ=1)  # -> Geometry, Transform
G_2 = ClusterOutput(scale_nu.Geometry)

# ==== cluster Perspective
int = ClusterInput()
int_2 = ClusterInput()
pt = ClusterInput()

# ---- group: grid extent y
int_3 = Integer(int)

# ---- group: grid extent x
int_4 = Integer(int_2)

# ---- group: Pts Sample Grid Corner
pt_2 = Point(pt)

# ----
subtraction = Subtraction(A=int_4, B=1)
subtraction_2 = Subtraction(A=int_3, B=1)
item = ListItem(List=pt_2, Index=0, Wrap=False)
item_2 = ListItem(List=pt_2, Index=1, Wrap=False)
item_3 = ListItem(List=pt_2, Index=2, Wrap=False)
item_4 = ListItem(List=pt_2, Index=3, Wrap=False)
pt_3 = Point(item_4)
pt_4 = Point(item)
ln = Line(StartPoint=pt_3, EndPoint=pt_4)
pt_5 = Point(item_2)
ln_2 = Line(StartPoint=pt_4, EndPoint=pt_5)
pt_6 = Point(item_3)
ln_3 = Line(StartPoint=pt_6, EndPoint=pt_3)
ln_4 = Line(StartPoint=pt_5, EndPoint=pt_6)
llx = LineLine(Line1=ln, Line2=ln_4)  # -> ParamA, ParamB, PointA, PointB
pt_7 = Point(llx.PointA)
llx_2 = LineLine(Line1=ln_2, Line2=ln_3)  # -> ParamA, ParamB, PointA, PointB
pt_8 = Point(llx_2.PointA)
vec2pt = Vector2Pt(PointA=pt_8, PointB=pt_7, Unitize=False)  # -> Vector, Length
line = LineSDL(Start=pt_3, Direction=vec2pt.Vector, Length=1)
llx_3 = LineLine(Line1=ln_2, Line2=line)  # -> ParamA, ParamB, PointA, PointB
pt_9 = Point(llx_3.PointA)
ln_5 = Line(StartPoint=pt_3, EndPoint=pt_9)
divide = DivideCurve(Curve=ln_5, Count=subtraction_2, Kinks=False)  # -> Points, Tangents, Parameters
ln_6 = Line(StartPoint=pt_8, EndPoint=divide.Points)
llx_4 = LineLine(Line1=ln_4, Line2=line)  # -> ParamA, ParamB, PointA, PointB
pt_10 = Point(llx_4.PointA)
ln_7 = Line(StartPoint=pt_3, EndPoint=pt_10)
divide_2 = DivideCurve(Curve=ln_7, Count=subtraction, Kinks=False)  # -> Points, Tangents, Parameters
ln_8 = Line(StartPoint=pt_7, EndPoint=divide_2.Points)
ln_9 = Line(StartPoint=pt_8, EndPoint=pt_7)

# ---- group: x
line_2 = Line(ln_8)

# ---- group: y
line_3 = Line(ln_6)

# ----
graft = GraftTree(Tree=ln_6, IncludeEmptyLists=True, IncludeNullItems=True)
llx_5 = LineLine(Line1=line_2, Line2=graft)  # -> ParamA, ParamB, PointA, PointB

# ---- group: keystoned grid pts
pt_11 = Point(llx_5.PointA)

# ----
pt_12 = ClusterOutput(pt_11)

# ==== cluster TextFormating
txt = ClusterInput()
txt_2 = Text(txt)

# ---- group: 'Enter'
panel = Panel("")

# ----
split = TextSplit(Text=txt_2, Separators=panel)
lng = ListLength(List=split)
addition = Addition(A=lng, B=1)
division = Division(A=addition, B=2)
series = Series(Start=0, Step=2, Count=division)
item = ListItem(List=split, Index=series, Wrap=False)
pshift = ShiftPaths(Data=item, Offset=1)
graft = GraftTree(Tree=pshift, IncludeEmptyLists=True, IncludeNullItems=True)
split_2 = TextSplit(Text=graft, Separators=",")
pshift_2 = ShiftPaths(Data=split_2, Offset=-2)
txt_3 = Text(pshift_2)
txt_4 = ClusterOutput(txt_3)

# ==== cluster ReplacingItemID
int = ClusterInput()
int_2 = ClusterInput()
int_3 = ClusterInput()
int_4 = ClusterInput()
int_5 = ClusterInput()
int_6 = ClusterInput()

# ---- group: gridExtent_y_i
int_7 = Integer(int)

# ---- group: gridExtent_y_s
int_8 = Integer(int_2)

# ---- group: gridExtent_x_s
int_9 = Integer(int_3)

# ---- group: gridExtent_x_i
int_10 = Integer(int_4)

# ---- group: gridExtent_y
int_11 = Integer(int_5)

# ---- group: gridExtent_x
int_12 = Integer(int_6)

# ---- group: adding y
series = Series(Start=0, Step=1, Count=int_7)
int_13 = Integer(series)
graft = GraftTree(Tree=int_13, IncludeEmptyLists=True, IncludeNullItems=True)
repeat = RepeatData(Data=graft, Length=int_10)
pshift = ShiftPaths(Data=repeat, Offset=-2)
addition = Addition(A=int_8, B=pshift)
multiplication = Multiplication(A=addition, B=int_12)

# ---- group: adding x
multiplication_2 = Multiplication(A=int_10, B=int_7)
series_2 = Series(Start=0, Step=1, Count=multiplication_2)
int_14 = Integer(series_2)
mod = Modulus(A=int_14, B=int_10)
addition_2 = Addition(A=int_9, B=mod)

# ----
addition_3 = Addition(A=multiplication, B=addition_2)

# ---- group: item replacing ID
int_15 = Integer(addition_3)

# ----
int_16 = ClusterOutput(int_15)

# ==== cluster Cluster
L = ClusterInput()
L_2 = ClusterInput()
A = ClusterInput()
item = ListItem(List=L_2, Index=0, Wrap=True)
B = ClusterInput()
multiplication = Multiplication(A=A, B=Slider(1.2, range=0..10))
A_2 = ClusterInput()
division = Division(A=item, B=item)
subtraction = Subtraction(A=multiplication, B=B)
L_3 = ClusterInput()
division_2 = Division(A=A_2, B=Slider(2, range=0..1000))
multiplication_2 = Multiplication(A="-1", B=division)
division_3 = Division(A=subtraction, B=2)
multiplication_3 = Multiplication(A=division_3, B="-1")
lng = ListLength(List=L_3)
partition = PartitionList(List=L, Size=lng)
panel = Panel(partition)
multiplication_4 = Multiplication(A=division_2, B=multiplication_2)
number_slider = Slider(6, range=0..100)
vec = VectorXYZ(XComponent=division_3, YComponent=multiplication_3, ZComponent=0)  # -> Vector, Length
pt = ConstructPoint(XCoordinate=division_2, YCoordinate=multiplication_4, ZCoordinate=0)
R = ClusterInput()
A_3 = ClusterInput()
R_2 = ClusterInput()
rev = Reverse(Vector=vec.Vector)
R_3 = ClusterInput()
move = Move(Geometry=pt, Motion=rev)  # -> Geometry, Transform
polygon = Polygon(Plane=move.Geometry, Radius=multiplication, Segments=lng, FilletRadius=Slider(0, range=0..10))  # -> Polygon, Length
polygon_2 = Polygon(Plane=pt, Radius=R, Segments=lng, FilletRadius=0)  # -> Polygon, Length
division_4 = Division(A=A_3, B=number_slider)
polygon_3 = Polygon(Plane=pt, Radius=R_2, Segments=lng, FilletRadius=Slider(52, range=0..100))  # -> Polygon, Length
cp = ControlPoints(Curve=polygon.Polygon)  # -> Points, Weights, Knots
polygon_4 = Polygon(Plane=pt, Radius=R_3, Segments=Slider(63, range=0..100), FilletRadius=Slider(4, range=0..10))  # -> Polygon, Length
series = Series(Start=0, Step=division_4, Count=number_slider)
N = ClusterInput()
number_slider_2 = Slider(223, range=0..1000)
cp_2 = ControlPoints(Curve=polygon_2.Polygon)  # -> Points, Weights, Knots
S = ClusterInput()
cull_i = CullIndex(List=cp.Points, Indices=lng, Wrap=True)
bnd = Bounds(Numbers=N)
cull_i_2 = CullIndex(List=cp_2.Points, Indices=lng, Wrap=True)
cull_i_3 = CullIndex(List=series, Indices=Slider(0, range=0..100), Wrap=True)
ln = Line(StartPoint=pt, EndPoint=graft(cull_i_2))
dedomain = DeconstructDomain(Domain=bnd)  # -> Start, End
W = ClusterInput()
H = ClusterInput()
X = ClusterInput()
Y = ClusterInput()
C = ClusterInput()
launchxpwin = LaunchTransparentWindow(Show=S, Name="CityScope Radar", Width=W, Height=H, ChildStatus=0, EnableHorizScroll=False)
dom = ConstructDomain(DomainStart=Slider(0, range=0..100), DomainEnd=dedomain.End)
pt_2 = ConstructPoint(XCoordinate=X, YCoordinate=Y, ZCoordinate=0)
argb = SplitARGB(Colour=C)  # -> Alpha, Red, Green, Blue
polygon_5 = Polygon(Plane=pt, Radius=cull_i_3, Segments=Slider(63, range=0..100), FilletRadius=Slider(4, range=0..10))  # -> Polygon, Length
remap = RemapNumbers(Value=panel, Source=dom, Target=Domain(0, 1))  # -> Mapped, Clipped
shape = CreateShape(
    Shape=polygon_5.Polygon,
    StrokeWeight=Slider(1, range=0..10),
    StrokeColor=ColourSwatch(SwatchColor=RGBA(255, 255, 255, 98)),
    Scale=Slider(1, range=0..10))
bg = ClusterInput()
shape_2 = CreateShape(
    Shape=polygon_4.Polygon,
    StrokeWeight=Slider(9, range=0..10),
    StrokeColor=ColourSwatch(SwatchColor=RGBA(255, 255, 255, 148)),
    Scale=Slider(1, range=0..10))
frgb = ColourRGBF(Alpha=Slider(0.39, range=0..1), Red=argb.Red, Green=argb.Green, Blue=argb.Blue)
winprops = SetWindowProperties(Window=launchxpwin, StartingLocation=pt_2, ShowTitleBar=Toggle(True), BackgroundColor=bg, ScaleFactor=1)
eval = EvaluateCurve(Curve=flatten(ln), Parameter=remap.Mapped)  # -> Point, Tangent, Angle
pline = PolyLine(Vertices=eval.Point, Closed=True)
fillet = Fillet(Curve=pline, Radius=Slider(4, range=0..10))
sc = ClusterInput()
T = ClusterInput()

panel_2 = Panel(cull_i)
pdecon = Deconstruct(Point=panel_2)  # -> graft(XComponent), graft(YComponent), ZComponent
concat = Concatenate(FragmentA=pdecon.XComponent, FragmentB=",")
abs = Absolute(Value=pdecon.YComponent)
concat_2 = Concatenate(FragmentA=concat, FragmentB=abs)
concat_3 = Concatenate(FragmentA=concat_2, FragmentB=",")
concat_4 = Concatenate(FragmentA=concat_3, FragmentB=Slider(0, range=0..1000))
label = CreateLabel(LabelText=T, LabelSize=12, Justification=0)  # -> flatten(Label)
concat_5 = Concatenate(FragmentA=concat_4, FragmentB=",")
adjustelem = AdjustElementAppearance(ElementsToAdjust=label, Foreground=ColourSwatch(SwatchColor=RGB(255, 239, 248)))
concat_6 = Concatenate(FragmentA=concat_5, FragmentB=Slider(0, range=0..1000))  # -> flatten(Result)
adjustpos = AdjustElementPositioning(ElementsToAdjust=label, Margin=concat_6, AbsolutePositioning=Toggle(True))
panel_3 = Panel(concat_6)

concat_7 = Concatenate(FragmentA=Slider(0, range=0..1000), FragmentB=",")
shape_3 = CreateShape(Shape=fillet, FillColor=frgb, StrokeWeight=Slider(4, range=0..10), StrokeColor=sc, Scale=Slider(1, range=0..10))
shape_4 = CreateShape(
    Shape=ln,
    StrokeWeight=Slider(1, range=0..10),
    StrokeColor=ColourSwatch(SwatchColor=RGBA(255, 255, 255, 98)),
    Scale=Slider(1, range=0..10))
shape_5 = CreateShape(
    Shape=polygon_3.Polygon,
    StrokeWeight=Slider(1, range=0..10),
    StrokeColor=ColourSwatch(SwatchColor=RGBA(255, 255, 255, 47)),
    Scale=Slider(1, range=0..10))
concat_8 = Concatenate(FragmentA=concat_7, FragmentB=Slider(0, range=0..1000))
concat_9 = Concatenate(FragmentA=concat_8, FragmentB=",")
concat_10 = Concatenate(FragmentA=concat_9, FragmentB=Slider(0, range=0..1000))
concat_11 = Concatenate(FragmentA=concat_10, FragmentB=",")
addelems = AddElements(Window=launchxpwin, Elements=flatten([shape_5, shape_2, shape, shape_3, shape_4, label]))  # -> AddedElements, ElementNames
concat_12 = Concatenate(FragmentA=concat_11, FragmentB=Slider(0, range=0..1000))  # -> flatten(Result)
adjustpos_2 = AdjustElementPositioning(
    ElementsToAdjust=flatten([shape_2, shape_5, shape, shape_3, shape_4]),
    Margin=concat_12,
    AbsolutePositioning=Toggle(True))

# ==== cluster Cluster_2
A = ClusterInput()
B = ClusterInput()
lng = ListLength(List=A)
equals = Equality(FirstNumber=A, SecondNumber=B)  # -> Equality, Inequality
series = Series(Start=0, Step=1, Count=lng)
dispatch = Dispatch(List=series, DispatchPattern=equals.Equality)  # -> ListA, ListB
item = ListItem(List=A, Index=dispatch.ListA, Wrap=True)
i = ClusterOutput(item)

# ==== cluster Cluster_3
P = ClusterInput()
R = ClusterInput()
cir = Circle(Plane=P, Radius=R)
runion = RegionUnion(Curves=cir)
R_2 = ClusterOutput(runion)

# ==== cluster GeoBottomCenter
geo = ClusterInput()
geo_2 = Geometry(geo)
bbox = BoundingBox(Content=geo_2, Plane=PlaneXY(0, 0, 0))  # -> Box, Box_2
box_corners = BoxCorners(Box=bbox.Box)  # -> CornerA, CornerB, CornerC, CornerD, CornerE, CornerF, CornerG, CornerH
pdecon = Deconstruct(Point=box_corners.CornerA)  # -> XComponent, YComponent, ZComponent
pdecon_2 = Deconstruct(Point=box_corners.CornerC)  # -> XComponent, YComponent, ZComponent
addition = Addition(A=pdecon.XComponent, B=pdecon_2.XComponent)
addition_2 = Addition(A=pdecon.YComponent, B=pdecon_2.YComponent)
division = Division(A=addition, B=2)
division_2 = Division(A=addition_2, B=2)
pt = ConstructPoint(XCoordinate=division, YCoordinate=division_2, ZCoordinate=pdecon.ZComponent)
pt_2 = Point(pt)
pt_3 = ClusterOutput(pt_2)
